# Grasshopper definition bitmap_capture.gh (Grasshopper 1.0.7)
# plug-ins: Javid

panel = Panel("""NW
NE
SW
SE""")
item = ListItem(List=panel, Index=Slider(3, range=0..3), Wrap=True)

# ---- group: capture viewport
trigger = BooleanToggle(True)
ghpython_script = GhPythonScript(trigger=trigger)  # -> bitmap
# ---------- ghpython_script: Python ----------
__author__ = "Serjoscha Duering"
__version__ = "2024.02.24"

import rhinoscriptsyntax as rs
import Grasshopper.DataTree as tree
import Grasshopper.Kernel.Data.GH_Path as ghpath


import Rhino
import scriptcontext as sc
import System.Drawing as sd
import os
import time

def capture_viewport_to_bitmap():
    tm = str(time.time())
    # Define the path where the screenshot will be saved temporarily
    tmp_filename = "temp_vp"+tm + ".png"
    temp_path = os.path.join(os.environ['TEMP'], tmp_filename)
    
    # Get the active Rhino document's active view
    view = sc.doc.Views.ActiveView
    
    # Ensure there's an active view to work with
    if not view:
        print("No active view found.")
        return None

    # Set the view to rendered mode (if not already)
    view.ActiveViewport.DisplayMode = Rhino.Display.DisplayModeDescription.FindByName("Rendered")
    sc.doc.Views.Redraw()

    # Capture the viewport to the file
    size = view.Size
    view.CaptureToBitmap(sd.Size(size.Width, size.Height)).Save(temp_path)
    
    # Load the image from the file into a System.Drawing.Bitmap
    bitmap = sd.Bitmap(temp_path)
    
    # Optionally, clean up the temporary file
    #os.remove(temp_path)
    
    return bitmap

# Example usage
bitmap = capture_viewport_to_bitmap()
if bitmap:
    print("Viewport captured as bitmap.")
    # Here you can use the bitmap, e.g., display it in a form, save to a file, etc.
else:
    print("Failed to capture viewport.")
# ---------- end ghpython_script ----------

# ---- group: from file
trigger_2 = BooleanToggle(True)
file_path = FilePath("C:\Users\Serjoscha Duering\OneDrive - REHUB digitale Planer GmbH\Dokumente\01_ProjectsOD\Experiments\metaGH\gptVisiont.PNG")
ghpython_script_2 = GhPythonScript(trigger=trigger_2, file_path=file_path)  # -> loaded_bitmap
# ---------- ghpython_script_2: Python ----------
__author__ = "Serjoscha Duering"
__version__ = "2024.02.24"

import rhinoscriptsyntax as rs
import Grasshopper.DataTree as tree
import Grasshopper.Kernel.Data.GH_Path as ghpath


import System
from System.Drawing import Bitmap, Graphics
from System.Windows.Forms import Screen

__author__ = "Serjoscha Duering"
__version__ = "2024.02.24"

import System
from System.Drawing import Bitmap

def load_image_from_file(filepath):
    # Load the image from the specified file path
    try:
        image = Bitmap(filepath)
        return image
    except Exception as e:
        print("Error loading image: " + str(e))
        return None


loaded_bitmap = load_image_from_file(file_path)
# ---------- end ghpython_script_2 ----------

# ----
c_script = CSharpScript(button=Toggle(True), isometric=item)  # -> viewportCapture; inputs isometric: String
# ---------- c_script: C# usings ----------
using System.Drawing;
using System.IO;
using Rhino.Display;
using Rhino.DocObjects;
using Rhino.Input;
using Rhino.Input.Custom;
# ---------- c_script: C# ----------
    viewportCapture = CaptureViewportWithAllObjectsInIsometric(isometric);
# ---------- c_script: C# additional code ----------
    public static Bitmap CaptureViewportWithAllObjectsInIsometric(string isometricView)
    {
      string tempPath = Path.Combine(Path.GetTempPath(), "temp_vp" + DateTime.Now.Ticks + ".png");

      // Get the active Rhino document's active view
      var view = RhinoDoc.ActiveDoc.Views.ActiveView;

      // Ensure there's an active view to work with
      if (view == null)
      {
        RhinoApp.WriteLine("No active view found.");
        return null;
      }

      // Set the view to parallel projection
      view.ActiveViewport.ChangeToParallelProjection(true);

      // Set the view to isometric NE, NW, SE, or SW
      if (isometricView.Equals("NE", StringComparison.OrdinalIgnoreCase))
      {
        view.ActiveViewport.SetCameraLocation(new Point3d(1, -1, 1), true);
        view.ActiveViewport.SetCameraDirection(new Vector3d(-1, 1, -1), true);
      }
      else if (isometricView.Equals("NW", StringComparison.OrdinalIgnoreCase))
      {
        view.ActiveViewport.SetCameraLocation(new Point3d(-1, -1, 1), true);
        view.ActiveViewport.SetCameraDirection(new Vector3d(1, 1, -1), true);
      }
      else if (isometricView.Equals("SE", StringComparison.OrdinalIgnoreCase))
      {
        view.ActiveViewport.SetCameraLocation(new Point3d(1, 1, 1), true);
        view.ActiveViewport.SetCameraDirection(new Vector3d(-1, -1, -1), true);
      }
      else if (isometricView.Equals("SW", StringComparison.OrdinalIgnoreCase))
      {
        view.ActiveViewport.SetCameraLocation(new Point3d(-1, 1, 1), true);
        view.ActiveViewport.SetCameraDirection(new Vector3d(1, -1, -1), true);
      }
      
      // Select all objects
      var allObjects = RhinoDoc.ActiveDoc.Objects.FindByObjectType(ObjectType.AnyObject);
      foreach (var obj in allObjects)
      {
        obj.Select(true);
      }

      // Zoom to selected objects
      RhinoApp.RunScript("_Zoom _Selected", false);
      
      foreach (var obj in allObjects)
      {
        obj.Select(false);
      }
      
      // Set the view to rendered mode (if not already)
      view.ActiveViewport.DisplayMode = DisplayModeDescription.FindByName("Rendered");
      RhinoDoc.ActiveDoc.Views.Redraw();

      // Capture the viewport to the file
      var size = view.Size;
      var bitmap = view.CaptureToBitmap(new Size(size.Width, size.Height));
      bitmap.Save(tempPath);

      // Load the image from the file into a System.Drawing.Bitmap
      var loadedBitmap = new Bitmap(tempPath);

      // Optionally, clean up the temporary file
      // File.Delete(tempPath);

      return loadedBitmap;
    }
# ---------- end c_script ----------

# ---- group: take screenshot
trigger_3 = BooleanToggle(True)
ghpython_script_3 = GhPythonScript(trigger=trigger_3)  # -> screenshot_out
# ---------- ghpython_script_3: Python ----------
__author__ = "Serjoscha Duering"
__version__ = "2024.02.24"

import rhinoscriptsyntax as rs
import Grasshopper.DataTree as tree
import Grasshopper.Kernel.Data.GH_Path as ghpath


import System
from System.Drawing import Bitmap, Graphics
from System.Windows.Forms import Screen

def capture_screen():
    # Get the primary screen's bounds, which gives us the screen's width and height
    screen_bounds = Screen.PrimaryScreen.Bounds
    
    # Create a bitmap of the same size as the screen
    screenshot = Bitmap(screen_bounds.Width, screen_bounds.Height)
    
    # Create a graphics object from the bitmap
    graphics = Graphics.FromImage(screenshot)
    
    # Copy the screen's content into our bitmap
    graphics.CopyFromScreen(screen_bounds.X, screen_bounds.Y, 0, 0, screen_bounds.Size)
    
    # Clean up the graphics object
    graphics.Dispose()
    
    return screenshot

# Capture the screen
screenshot_bitmap = capture_screen()#

screenshot_out = screenshot_bitmap
# ---------- end ghpython_script_3 ----------

# ----
c_script_2 = CSharpScript(button=Toggle(True))  # -> screenCapture
# ---------- c_script_2: C# usings ----------
using System.Drawing;
using System.Windows.Forms;
# ---------- c_script_2: C# ----------
    screenCapture = CaptureScreen();
# ---------- c_script_2: C# additional code ----------
  public static Bitmap CaptureScreen()
  {
    // Get the primary screen's bounds
    Rectangle screenBounds = Screen.PrimaryScreen.Bounds;

    // Create a bitmap of the same size as the screen
    Bitmap screenshot = new Bitmap(screenBounds.Width, screenBounds.Height);

    // Create a graphics object from the bitmap
    using (Graphics graphics = Graphics.FromImage(screenshot))
    {
      // Copy the screen's content into our bitmap
      graphics.CopyFromScreen(screenBounds.X, screenBounds.Y, 0, 0, screenBounds.Size);
    }

    return screenshot;
  }
# ---------- end c_script_2 ----------
preview_bitmap = PreviewBitmap(Bitmap=c_script, LockAspect=False)
