# Grasshopper definition gpt.gh (Grasshopper 1.0.7)
# plug-ins: ScriptParasite

toggle = BooleanToggle(True)
toggle_2 = BooleanToggle(True)
toggle_3 = BooleanToggle(True)
toggle_4 = BooleanToggle(True)
# LineString geoJson
crv = Curve(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)
crv_2 = Curve(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)
# LineString geoJson
crv_3 = Curve(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)
rider = RIder(openFile=toggle)  # -> Folder; inputs openFile: Boolean
# ---------- rider: C# usings ----------
using System.IO;
using System.Diagnostics;

public class ScriptUtilities
{
  public static string GetCurrentFolder(GH_Document doc)
  {
    string filePath = doc.FilePath;
    return Path.GetDirectoryName(filePath);
  }

  public static string[] GetCsFiles(string folderPath)
  {
    return Directory.GetFiles(folderPath, "*.cs");
  }

  public static void OpenFileWithRider(string filePath, Action<string> print)
  {
    try
    {
      // Define the path to the JetBrains Rider executable
      string riderPath = @"C:\Program Files\JetBrains\JetBrains Rider 2024.1.4\bin\rider64.exe";

      if (!File.Exists(riderPath))
      {
        print("Rider executable not found at: " + riderPath);
        return;
      }

      // Start the process to open the file with Rider
      ProcessStartInfo startInfo = new ProcessStartInfo
        {
          FileName = riderPath,
          Arguments = "\"" + filePath + "\"", // Enclose in quotes in case of spaces
          UseShellExecute = true
          };
      Process.Start(startInfo);
    }
    catch (Exception ex)
    {
      print("Error opening file with Rider: " + ex.Message);
    }
  }

  public static void RunScript(bool openFile, ref object Here, IGH_Component owner, Action<string> print)
  {
    // Get the current folder path
    GH_Document doc = owner.OnPingDocument();
    string currentFolder = GetCurrentFolder(doc);
    Here = currentFolder;

    // Get .cs files in the current folder
    string[] csFiles = GetCsFiles(currentFolder);
    if (csFiles.Length > 0)
    {
      string csFilePath = csFiles[0];

      if (openFile)
      {
        OpenFileWithRider(csFilePath, print);
      }
    }
    else
    {
      print("No .cs files found in the directory.");
    }
  }
}
# ---------- rider: C# ----------
   ScriptUtilities.RunScript(openFile, ref Folder, Component, Print);
# ---------- end rider ----------
rider_2 = RIder(openFile=toggle_2)  # -> Folder; inputs openFile: Boolean; same code as rider
rider_3 = RIder(openFile=toggle_3)  # -> Folder; inputs openFile: Boolean; same code as rider
rider_4 = RIder(openFile=toggle_4)  # -> Folder; inputs openFile: Boolean; same code as rider

c_script = CSharpScript(curves=crv_2, thresholdLength=Slider(2.8, range=0..100), bufferDistance=Slider(0, range=0..100))  # -> out, windowCurves, windowSurfaces; inputs curves: list of Curve, thresholdLength: Double, bufferDistance: Double
# ---------- c_script: C# usings ----------
using System.Text;
# ---------- c_script: C# ----------
    // 선택된 커브들과 서피스를 저장할 리스트
    List<Curve> windowCurvesList = new List<Curve>();
    List<Brep> windowSurfacesList = new List<Brep>();

    foreach (var curve in curves)
    {
        // 커브를 Polyline으로 변환
        Polyline polyline;
        if (!curve.TryGetPolyline(out polyline))
        {
            // Polyline으로 변환되지 않는 경우, 일정 간격으로 분할하여 Polyline 생성
            double length = curve.GetLength();
            int segmentCount = (int)(length / 0.5); // 필요에 따라 분할 간격 조절
            if (segmentCount < 2) segmentCount = 2;

            Point3d[] points;
            curve.DivideByCount(segmentCount, true, out points);
            polyline = new Polyline(points);
        }

        // Polyline의 세그먼트들을 가져옴
        for (int i = 0; i < polyline.Count - 1; i++)
        {
            Line segment = new Line(polyline[i], polyline[i + 1]);
            double segmentLength = segment.Length;

            // 세그먼트의 길이가 임계값보다 큰 경우 선택
            if (segmentLength >= thresholdLength)
            {
                // 세그먼트의 방향 벡터 계산
                Vector3d direction = segment.Direction;
                direction.Unitize();

                // 세그먼트에 수직인 벡터 계산 (Z축 방향이 위쪽인 경우)
                Vector3d normal = Vector3d.CrossProduct(direction, Vector3d.ZAxis);
                normal.Unitize();
                normal *= (bufferDistance / 2.0);

                // 사각형의 네 점 계산
                Point3d p1 = segment.From + normal;
                Point3d p2 = segment.To + normal;
                Point3d p3 = segment.To - normal;
                Point3d p4 = segment.From - normal;

                // 버퍼 폴리라인 생성
                Polyline bufferPolyline = new Polyline(new List<Point3d> { p1, p2, p3, p4, p1 });
                PolylineCurve bufferCurve = new PolylineCurve(bufferPolyline);

                // 결과 커브 리스트에 추가
                windowCurvesList.Add(bufferCurve);

                // 서피스 생성
                Brep[] breps = Brep.CreatePlanarBreps(bufferCurve);
                if (breps != null && breps.Length > 0)
                {
                    windowSurfacesList.AddRange(breps);
                }
            }
        }
    }

    // 출력 설정
    windowCurves = windowCurvesList;
    windowSurfaces = windowSurfacesList;
# ---------- end c_script ----------
scriptpar = ScriptParasite(Enable=toggle_3, Folder=rider_3)

scriptpar_2 = ScriptParasite(Enable=toggle, Folder=rider)
c_script_2 = CSharpScript(Reference="C:\Program Files (x86)\Microsoft SDKs\NuGetPackages\newtonsoft.json\9.0.1\lib\net40\Newtonsoft.Json.dll")  # -> out, A; inputs prompt: String, apiKey: String
# ---------- c_script_2: C# usings ----------
using System.IO;
using System.Net;
using System.Text;
using Newtonsoft.Json;
# ---------- c_script_2: C# ----------
        // Set up the request URL and headers
    string url = "https://api.openai.com/v1/chat/completions";
    HttpWebRequest request = (HttpWebRequest) WebRequest.Create(url);
    request.Method = "POST";
    request.ContentType = "application/json";
    request.Headers["Authorization"] = "Bearer " + apiKey;

    // System message to instruct the model to produce valid JSON
    var systemMessage = new
      {
        role = "system",
        content = "Your task is to ensure that the incoming JSON-like object is returned as a valid JSON object."
        };

    // Payload with the prompt and system message
    var payload = new
      {
        model = "gpt-3.5-turbo-0125", // Replace with your preferred model
        response_format = new { type = "json_object" },
        messages = new[]
        {
          systemMessage,
          new
          {
            role = "user",
            content = "Please ensure the JSON-like input is correct and return a valid version of it. The JSON-like object: " + prompt
            }
          }
        };

    // Convert the payload to JSON and then to bytes
    string jsonData = JsonConvert.SerializeObject(payload);
    byte[] bytesData = Encoding.UTF8.GetBytes(jsonData);

    // Write the data to the request stream
    using (Stream requestStream = request.GetRequestStream())
    {
      requestStream.Write(bytesData, 0, bytesData.Length);
    }
# ---------- end c_script_2 ----------

c_script_3 = CSharpScript(curves=crv)  # -> out, geojson; inputs curves: list of Curve
# ---------- c_script_3: C# ----------
    // StringBuilder를 사용하여 GeoJSON 문자열을 구성합니다.
    StringBuilder sb = new StringBuilder();
    sb.Append("{\"type\":\"FeatureCollection\",\"features\":[");
    bool firstFeature = true;

    foreach (var curve in curves)
    {
      // 커브를 일정 간격으로 샘플링하여 포인트 리스트를 생성합니다.
      var points = new List<double[]>();
      double length = curve.GetLength();
      int numPoints = (int)(length / 1.0); // 필요에 따라 샘플링 간격을 조절하세요.
      if (numPoints < 4) numPoints = 4; // 폴리곤을 위해 최소 4개의 포인트 필요 (시작점과 끝점이 같아야 함)

      double t0 = curve.Domain.T0;
      double t1 = curve.Domain.T1;

      for (int i = 0; i <= numPoints; i++)
      {
        double t = t0 + (t1 - t0) * i / numPoints;
        Point3d pt = curve.PointAt(t);
        points.Add(new double[] { pt.X, pt.Y });
      }

      // 폴리곤을 닫기 위해 첫 번째 포인트를 마지막에 추가
      if (points[0][0] != points[points.Count - 1][0] || points[0][1] != points[points.Count - 1][1])
      {
        points.Add(new double[] { points[0][0], points[0][1] });
      }

      // 첫 번째 피처가 아니면 쉼표를 추가합니다.
      if (!firstFeature)
        sb.Append(",");
      else
        firstFeature = false;

      // 피처를 구성합니다.
      sb.Append("{\"type\":\"Feature\",\"geometry\":");
      sb.Append("{\"type\":\"Polygon\",\"coordinates\":[[");

      bool firstPoint = true;
      foreach (var pt in points)
      {
        if (!firstPoint)
          sb.Append(",");
        else
          firstPoint = false;

        sb.AppendFormat("[{0},{1}]", pt[0], pt[1]);
      }

      sb.Append("]]},\"properties\":{}}");
    }

    sb.Append("]}");

    // 결과 GeoJSON 문자열을 출력으로 설정합니다.
    geojson = sb.ToString();
# ---------- end c_script_3 ----------
scriptpar_3 = ScriptParasite(Enable=toggle_2, Folder=rider_2)

c_script_4 = CSharpScript(curves=crv_3)  # -> out, geojson; inputs curves: list of Curve
# ---------- c_script_4: C# ----------
    // StringBuilder를 사용하여 GeoJSON 문자열을 구성합니다.
    StringBuilder sb = new StringBuilder();
    sb.Append("{\"type\":\"FeatureCollection\",\"features\":[");
    bool firstFeature = true;

    foreach (var curve in curves)
    {
      // 커브를 일정 간격으로 샘플링하여 포인트 리스트를 생성합니다.
      var points = new List<double[]>();
      double length = curve.GetLength();
      int numPoints = (int) (length / 1.0); // 필요에 따라 샘플링 간격을 조절하세요.
      if (numPoints < 2) numPoints = 2;

      double t0 = curve.Domain.T0;
      double t1 = curve.Domain.T1;

      for (int i = 0; i <= numPoints; i++)
      {
        double t = t0 + (t1 - t0) * i / numPoints;
        Point3d pt = curve.PointAt(t);
        points.Add(new double[] { pt.X, pt.Y });
      }

      // 첫 번째 피처가 아니면 쉼표를 추가합니다.
      if (!firstFeature)
        sb.Append(",");
      else
        firstFeature = false;

      // 피처를 구성합니다.
      sb.Append("{\"type\":\"Feature\",\"geometry\":");
      sb.Append("{\"type\":\"LineString\",\"coordinates\":[");

      bool firstPoint = true;
      foreach (var pt in points)
      {
        if (!firstPoint)
          sb.Append(",");
        else
          firstPoint = false;

        sb.AppendFormat("[{0},{1}]", pt[0], pt[1]);
      }

      sb.Append("]},\"properties\":{}}");
    }

    sb.Append("]}");

    // 결과 GeoJSON 문자열을 출력으로 설정합니다.
    geojson = sb.ToString();
# ---------- end c_script_4 ----------
scriptpar_4 = ScriptParasite(Enable=toggle_4, Folder=rider_4)

c_script_5 = CSharpScript()  # -> Out, A
panel = Panel(c_script_3.geojson)
crv_4 = Curve(c_script.windowCurves)
geo = Geometry(c_script.windowSurfaces)
panel_2 = Panel(c_script_4.geojson)
