# Grasshopper definition sampleCode.gh (Grasshopper 1.0.7)
# plug-ins: topoBuilding, topoGraphy, topoROK, topoStreet, topoRiver, ScriptParasite

panel = Panel("\"C:\\Users\\BaekInchan\\Downloads\\(B010)수치지도_37608068_2024_00000165193019\"")
toposhp = TopoSHP(SHPFolder=panel)  # -> TopoLines, TopoLinesZ, BuildingLines, BuildingLinesZ, StreetLines, WaterLines, ParkPoints, ShapefileDictionary
pt = Point(toposhp.ParkPoints)
topography = TopoGraphy(TerrainLines=toposhp.TopoLines, TerrainLinesZ=toposhp.TopoLinesZ, Resolution=Slider(5, range=0..100), Run=Toggle(True))
c_script = CSharpScript(x=topography)  # -> out, A, B, C; inputs x: Surface, y: Int32; disabled
# ---------- c_script: C# usings ----------
using System.Linq;
# ---------- c_script: C# ----------
    var edges = x.ToBrep().Edges.ToList();
    var pts = x.ToBrep().Vertices.ToList();
    var minZPoint = pts.OrderBy(p => p.Location.Z).FirstOrDefault();
    Point3d boxStPt = new Point3d(minZPoint.Location.X, minZPoint.Location.Y, minZPoint.Location.Z - y);
    Plane pl = Plane.WorldXY;
    pl.Origin = boxStPt; 
    List<Brep> breps = new List<Brep>() { x.ToBrep() };
    List<Curve> curves = new List<Curve>();
    foreach (var i in edges)
    {
      Curve upCrv = i.DuplicateCurve();
      Curve dnCrv = Curve.ProjectToPlane(upCrv, pl);
      var sideSrf = NurbsSurface.CreateRuledSurface(upCrv, dnCrv);
      breps.Add(sideSrf.ToBrep());
      curves.Add(dnCrv);
    }

    B = PlanarSrf(Curve.JoinCurves(curves)[0]);
    breps.Add(PlanarSrf(Curve.JoinCurves(curves)[0]));
    var union = Brep.JoinBreps(breps, 0.01);

    if (union != null && union.Length > 0)
    {
      A = union[0];
    }
# ---------- c_script: C# additional code ----------
  public Brep PlanarSrf(Curve c)
  {
    string log;
    Brep ret = null;
    if (c.IsValidWithLog(out log) && c.IsPlanar() && c.IsClosed)
    {
      var tmp = Brep.CreatePlanarBreps(c, 0.01);
      ret = tmp[0];
      return ret;
    }
    return ret;
  }
# ---------- end c_script ----------
topobuilding = TopoBuilding(
    TopoSurface=topography,
    BuildingLines=toposhp.BuildingLines,
    BuildingLinesZ=toposhp.BuildingLinesZ,
    BuildingType="parapet",
    RemoveUnderArea=Slider(50, range=0..100),
    Run=Toggle(True))
topostreet = TopoStreet(TopoSurface=topography, StreetLines=toposhp.StreetLines, Run=Toggle(True))  # -> StreetCurve, StreetFlatCurve
topowater = TopoWater(TopoSurface=topography, WaterLine=toposhp.WaterLines, Run=Toggle(True))  # -> WaterCurve, WaterFlatCurve, WaterSurface
brep = Brep(c_script.A)  # disabled
crv = Curve(<curve referenced from the Rhino model>)
brep_2 = Brep()
area = Area(Geometry=crv)  # -> Area, Centroid
toggle = BooleanToggle(True)
rider = RIder(openFile=toggle)  # -> Folder; inputs openFile: Boolean
# ---------- rider: C# usings ----------
using System.IO;
using System.Diagnostics;

public class ScriptUtilities
{
  public static string GetCurrentFolder(GH_Document doc)
  {
    string filePath = doc.FilePath;
    return Path.GetDirectoryName(filePath);
  }

  public static string[] GetCsFiles(string folderPath)
  {
    return Directory.GetFiles(folderPath, "*.cs");
  }

  public static void OpenFileWithRider(string filePath, Action<string> print)
  {
    try
    {
      // Define the path to the JetBrains Rider executable
      string riderPath = @"C:\Program Files\JetBrains\JetBrains Rider 2024.1.4\bin\rider64.exe";

      if (!File.Exists(riderPath))
      {
        print("Rider executable not found at: " + riderPath);
        return;
      }

      // Start the process to open the file with Rider
      ProcessStartInfo startInfo = new ProcessStartInfo
        {
          FileName = riderPath,
          Arguments = "\"" + filePath + "\"", // Enclose in quotes in case of spaces
          UseShellExecute = true
          };
      Process.Start(startInfo);
    }
    catch (Exception ex)
    {
      print("Error opening file with Rider: " + ex.Message);
    }
  }

  public static void RunScript(bool openFile, ref object Here, IGH_Component owner, Action<string> print)
  {
    // Get the current folder path
    GH_Document doc = owner.OnPingDocument();
    string currentFolder = GetCurrentFolder(doc);
    Here = currentFolder;

    // Get .cs files in the current folder
    string[] csFiles = GetCsFiles(currentFolder);
    if (csFiles.Length > 0)
    {
      string csFilePath = csFiles[0];

      if (openFile)
      {
        OpenFileWithRider(csFilePath, print);
      }
    }
    else
    {
      print("No .cs files found in the directory.");
    }
  }
}
# ---------- rider: C# ----------
   ScriptUtilities.RunScript(openFile, ref Folder, Component, Print);
# ---------- end rider ----------

c_script_2 = CSharpScript(TS=topography, zInterval=Slider(41, range=0..100), Run=Toggle(False))  # -> contourBrep, contourCurve; inputs TS: Surface, zInterval: Int32, Run: Boolean
# ---------- c_script_2: C# usings ----------
using System.Collections.Concurrent;
using System.Linq;
using System.Threading.Tasks;
# ---------- c_script_2: C# ----------
    if (!Run) return; 
 // Get edges of the surface
    var edges = TS.ToBrep().Edges.ToList();

    // Get bounding box and its corners
    BoundingBox bbox = TS.GetBoundingBox(true);
    Point3d[] corners = bbox.GetCorners();

    // Find max and min Z points
    Point3d maxZPoint = corners.OrderByDescending(pt => pt.Z).FirstOrDefault();
    Point3d minZPoint = corners.OrderBy(pt => pt.Z).FirstOrDefault();
    minZPoint = new Point3d(minZPoint.X, minZPoint.Y, minZPoint.Z - 3);

    // Create a point below the min Z point
    Point3d boxStPt = new Point3d(minZPoint.X, minZPoint.Y, minZPoint.Z - 100);
    Plane pl = Plane.WorldXY;
    pl.Origin = boxStPt;

    // Initialize lists for breps and curves
    List<Brep> breps = new List<Brep>() { TS.ToBrep() };
    List<Curve> curves = new List<Curve>();

    double maxLength = 0.0;
    foreach (var i in edges)
    {
        Curve upCrv = i.DuplicateCurve();
        Curve dnCrv = Curve.ProjectToPlane(upCrv, pl);
        var sideSrf = NurbsSurface.CreateRuledSurface(upCrv, dnCrv);
        breps.Add(sideSrf.ToBrep());
        curves.Add(dnCrv);
        double length = dnCrv.GetLength();
        if (length > maxLength)
        {
            maxLength = length;
        }
    }

    // Create bottom surface
    breps.Add(PlanarSrf(Curve.JoinCurves(curves)[0]));
    // Union all breps
    var union = Brep.JoinBreps(breps, 0.01);
    QuadRemeshParameters quadRemeshParams = new QuadRemeshParameters();
    quadRemeshParams.GuideCurveInfluence = 1;
    quadRemeshParams.AdaptiveSize = 4.0;
    quadRemeshParams.TargetEdgeLength = 1.0; 
    var mesh = Mesh.QuadRemeshBrep(union[0], quadRemeshParams); 

    Mesh cutted = mesh;
    var contourCurves = Mesh.CreateContourCurves(cutted, minZPoint, maxZPoint, zInterval, 0.001);
    int dist = (int)maxLength + 100;
    Brep[] planarSurfaces = new Brep[contourCurves.Length];
    Parallel.For(0, contourCurves.Length, i =>
    {
      var curve = contourCurves[i];
      BoundingBox bb = curve.GetBoundingBox(false);
      Plane plane = new Plane(bb.Center, Vector3d.ZAxis);
      Surface planarSurface = new PlaneSurface(plane, new Interval(-dist, dist), new Interval(-dist, dist));
      planarSurfaces[i] = planarSurface.ToBrep();
    });
    ConcurrentBag<Brep> extrudedSurfaces = new ConcurrentBag<Brep>();
    Parallel.For(0, contourCurves.Length, i =>
    {
      var curve = contourCurves[i];
      if(AreaMassProperties.Compute(curve).Area < 1000) return;
      Point3d now = curve.PointAtEnd;
      Point3d nxt = MovePt(now, Vector3d.ZAxis, zInterval);
      Curve nxtCurve = curve.DuplicateCurve();
      MoveOrientPoint(nxtCurve, now, nxt);
      var sideSrf = NurbsSurface.CreateRuledSurface(curve, nxtCurve);
      if (sideSrf == null) return;
      var paper = planarSurfaces[i]; 
      var cutter = sideSrf.ToBrep();
      var cuttedSrf = paper.Split(cutter, RhinoDocument.ModelAbsoluteTolerance);
      if (cuttedSrf != null && cuttedSrf.Length > 0)
      {
        Brep caps = cuttedSrf.Last();
        MoveOrientPoint(caps, now, nxt);
        extrudedSurfaces.Add(caps);
        extrudedSurfaces.Add(cutter);
      }
    });
    contourCurve = contourCurves; 
    contourBrep = extrudedSurfaces;
# ---------- c_script_2: C# additional code ----------
  public static DataTree<T> MakeDataTree2D<T>(List<List<T>> ret)
  {
    DataTree<T> tree = new DataTree<T>();
    for (int i = 0; i < ret.Count; i++)
    {
      GH_Path path = new GH_Path(i);
      for (int j = 0; j < ret[i].Count; j++)
      {

        tree.Add(ret[i][j], path);
      }
    }

    return tree;
  }
  public T MoveOrientPoint<T>(T obj, Point3d now, Point3d nxt) where T : GeometryBase
  {
    Plane baseNow = Plane.WorldXY;
    Plane st = new Plane(now, baseNow.XAxis, baseNow.YAxis);
    Plane en = new Plane(nxt, baseNow.XAxis, baseNow.YAxis);
    Transform orient = Transform.PlaneToPlane(st, en);
    obj.Transform(orient);
    return obj;
  }
  public Brep PlanarSrf(Curve c)
  {
    string log;
    Brep ret = null;
    if (c.IsValidWithLog(out log) && c.IsPlanar() && c.IsClosed)
    {
      var tmp = Brep.CreatePlanarBreps(c, 0.01);
      ret = tmp[0];
      return ret;
    }
    return ret;
  }

  public Point3d MovePt(Point3d p, Vector3d v, double amp)
  {
    v.Unitize();
    Point3d newPoint = new Point3d(p);
    newPoint.Transform(Transform.Translation(v * amp));
    return newPoint;
  }
  
  private List<List<T>> SplitList<T>(List<T> list, int chunkSize)
  {
    return list
      .Select((item, index) => new { item, index })
      .GroupBy(x => x.index / chunkSize)
      .Select(g => g.Select(x => x.item).ToList())
      .ToList();
  }
# ---------- end c_script_2 ----------
scriptpar = ScriptParasite(Enable=toggle, Folder=rider)

geo = Geometry(c_script_2.contourBrep)
geo_2 = Geometry(c_script_2.contourCurve)
