# Grasshopper definition testshpfile.gh (Grasshopper 1.0.7)
# plug-ins: ScriptParasite

panel = Panel(""""C:\Users\BaekInchan\Downloads\(B010)수치지도_37709081__00000416119175"
"C:\Users\BaekInchan\Downloads\(B010)수치지도_37713013__00000571432660"
"C:\Users\BaekInchan\Downloads\(B010)수치지도_37608068_2024_00000165193019"
"C:\Users\BaekInchan\Downloads\(B010)수치지도_37709081__00000416119175"
"C:\Users\BaekInchan\Downloads\(B010)수치지도_37713013__00000571432660"
"C:\Users\BaekInchan\Downloads\(B010)수치지도_37608068_2024_00000165193019"
""")
panel_2 = Panel("N3A_E0010001")
toggle = BooleanToggle(True)
panel_3 = Panel("N3A_B0010000")
rider = RIder(openFile=toggle)  # -> Folder; inputs openFile: Boolean
# ---------- rider: C# usings ----------
using System.IO;
using System.Diagnostics;

public class ScriptUtilities
{
  public static string GetCurrentFolder(GH_Document doc)
  {
    string filePath = doc.FilePath;
    return Path.GetDirectoryName(filePath);
  }

  public static string[] GetCsFiles(string folderPath)
  {
    return Directory.GetFiles(folderPath, "*.cs");
  }

  public static void OpenFileWithRider(string filePath, Action<string> print)
  {
    try
    {
      // Define the path to the JetBrains Rider executable
      string riderPath = @"C:\Program Files\JetBrains\JetBrains Rider 2024.1.4\bin\rider64.exe";

      if (!File.Exists(riderPath))
      {
        print("Rider executable not found at: " + riderPath);
        return;
      }

      // Start the process to open the file with Rider
      ProcessStartInfo startInfo = new ProcessStartInfo
        {
          FileName = riderPath,
          Arguments = "\"" + filePath + "\"", // Enclose in quotes in case of spaces
          UseShellExecute = true
          };
      Process.Start(startInfo);
    }
    catch (Exception ex)
    {
      print("Error opening file with Rider: " + ex.Message);
    }
  }

  public static void RunScript(bool openFile, ref object Here, IGH_Component owner, Action<string> print)
  {
    // Get the current folder path
    GH_Document doc = owner.OnPingDocument();
    string currentFolder = GetCurrentFolder(doc);
    Here = currentFolder;

    // Get .cs files in the current folder
    string[] csFiles = GetCsFiles(currentFolder);
    if (csFiles.Length > 0)
    {
      string csFilePath = csFiles[0];

      if (openFile)
      {
        OpenFileWithRider(csFilePath, print);
      }
    }
    else
    {
      print("No .cs files found in the directory.");
    }
  }
}
# ---------- rider: C# ----------
   ScriptUtilities.RunScript(openFile, ref Folder, Component, Print);
# ---------- end rider ----------

c_script = CSharpScript(shpFolders=panel, y="F0010000")  # -> out, A, B; inputs shpFolders: list of String, y: String
# ---------- c_script: C# usings ----------
using DotSpatial.Projections;
using DotSpatial.Topology;
using DotSpatial.Mono;
using DotSpatial.Data;
using System.Linq;
# ---------- c_script: C# ----------
// Dictionary to store SHP files with keys extracted from the filename, using HashSet to avoid duplicates
    Dictionary<string, HashSet<string>> shpFileDict = new Dictionary<string, HashSet<string>>();

    foreach (string i in shpFolders)
    {
      string folderPath = i;
      if (folderPath.Length > 2 && folderPath[0] == '\"' && folderPath[folderPath.Length - 1] == '\"')
      {
        folderPath = folderPath.Substring(1, folderPath.Length - 2);
      }

      if (System.IO.Directory.Exists(folderPath))
      {
        // Get all .shp files in the directory
        string[] shpFiles = System.IO.Directory.GetFiles(folderPath, "*.shp");
        foreach (var shpFile in shpFiles)
        {
          // Extract the filename from the path
          string fileName = System.IO.Path.GetFileNameWithoutExtension(shpFile);
          // Split the filename by underscore and convert to a list
          List<string> parts = fileName.Split('_').ToList();

          // The key is the last part of the filename
          if (parts.Count > 0)
          {
            string key = parts[parts.Count - 1]; // Get the last element

            // If the key exists in the dictionary, add to the HashSet; otherwise, create a new entry
            if (shpFileDict.ContainsKey(key))
            {
              shpFileDict[key].Add(shpFile); // HashSet prevents duplicates
            }
            else
            {
              shpFileDict[key] = new HashSet<string> { shpFile };
            }
          }
        }
      }
    }

    var tmp = GetFiles(y, shpFileDict)[0];
    var tmp1 = Shapefile.OpenFile(tmp, null);
    var atr = tmp1.Attributes.Columns;
    B = atr; 
    
    A = GetFiles(y, shpFileDict);
# ---------- c_script: C# additional code ----------
  static List<string> GetFiles(string key, Dictionary<string, HashSet<string>> hs)
  {
    List<string> resultList;
    if (hs.ContainsKey(key))
    {
      resultList = hs[key].ToList(); // Convert HashSet to List<string>
    }
    else
    {
      resultList = new List<string>(); // Handle the case where the key 'y' is not found
    }

    return resultList; 
  }
# ---------- end c_script ----------
scriptpar = ScriptParasite(Enable=toggle, Folder=rider)

panel_4 = Panel(c_script.B)
