# Grasshopper definition unnamed.gh (Grasshopper 1.0.7)
# plug-ins: atit, ScriptParasite

panel = Panel(""""C:\Users\BaekInchan\Downloads\(B010)수치지도_37608068_2024_00000165193019\N3P_E0072325.shp"
"C:\Users\BaekInchan\Downloads\(B010)수치지도_37608068_2024_00000165193019\N3P_F0020000.shp"
"C:\Users\BaekInchan\Downloads\(B010)수치지도_37608068_2024_00000165193019\N3P_H0020000.shp"
"C:\Users\BaekInchan\Downloads\(B010)수치지도_37608068_2024_00000165193019\N3P_H0040000.shp"
"C:\Users\BaekInchan\Downloads\(B010)수치지도_37608068_2024_00000165193019\N3P_H0059153.shp"
"C:\Users\BaekInchan\Downloads\(B010)수치지도_37608068_2024_00000165193019\N3A_A0010000.shp"
"C:\Users\BaekInchan\Downloads\(B010)수치지도_37608068_2024_00000165193019\N3A_A0033320.shp"
"C:\Users\BaekInchan\Downloads\(B010)수치지도_37608068_2024_00000165193019\N3A_A0053326.shp"
"C:\Users\BaekInchan\Downloads\(B010)수치지도_37608068_2024_00000165193019\N3A_A0063321.shp"
"C:\Users\BaekInchan\Downloads\(B010)수치지도_37608068_2024_00000165193019\N3A_A0070000.shp"
"C:\Users\BaekInchan\Downloads\(B010)수치지도_37608068_2024_00000165193019\N3A_A0080000.shp"
"C:\Users\BaekInchan\Downloads\(B010)수치지도_37608068_2024_00000165193019\N3A_A0090000.shp"
"C:\Users\BaekInchan\Downloads\(B010)수치지도_37608068_2024_00000165193019\N3A_A0110020.shp"
"C:\Users\BaekInchan\Downloads\(B010)수치지도_37608068_2024_00000165193019\N3A_B0010000.shp"
"C:\Users\BaekInchan\Downloads\(B010)수치지도_37608068_2024_00000165193019\N3A_C0390000.shp"
"C:\Users\BaekInchan\Downloads\(B010)수치지도_37608068_2024_00000165193019\N3A_C0423365.shp"
"C:\Users\BaekInchan\Downloads\(B010)수치지도_37608068_2024_00000165193019\N3A_C0430000.shp"
"C:\Users\BaekInchan\Downloads\(B010)수치지도_37608068_2024_00000165193019\N3A_D0010000.shp"
"C:\Users\BaekInchan\Downloads\(B010)수치지도_37608068_2024_00000165193019\N3A_E0010001.shp"
"C:\Users\BaekInchan\Downloads\(B010)수치지도_37608068_2024_00000165193019\N3A_E0032111.shp"
"C:\Users\BaekInchan\Downloads\(B010)수치지도_37608068_2024_00000165193019\N3A_E0052114.shp"
"C:\Users\BaekInchan\Downloads\(B010)수치지도_37608068_2024_00000165193019\N3A_G0010000.shp"
"C:\Users\BaekInchan\Downloads\(B010)수치지도_37608068_2024_00000165193019\N3A_G0020000.shp"
"C:\Users\BaekInchan\Downloads\(B010)수치지도_37608068_2024_00000165193019\N3A_H0010000.shp"
"C:\Users\BaekInchan\Downloads\(B010)수치지도_37608068_2024_00000165193019\N3L_A0010000.shp"
"C:\Users\BaekInchan\Downloads\(B010)수치지도_37608068_2024_00000165193019\N3L_A0020000.shp"
"C:\Users\BaekInchan\Downloads\(B010)수치지도_37608068_2024_00000165193019\N3L_A0033330.shp"
"C:\Users\BaekInchan\Downloads\(B010)수치지도_37608068_2024_00000165193019\N3L_A0123373.shp"
"C:\Users\BaekInchan\Downloads\(B010)수치지도_37608068_2024_00000165193019\N3L_B0020000.shp"
"C:\Users\BaekInchan\Downloads\(B010)수치지도_37608068_2024_00000165193019\N3L_C0050000.shp"
"C:\Users\BaekInchan\Downloads\(B010)수치지도_37608068_2024_00000165193019\N3L_C0060000.shp"
"C:\Users\BaekInchan\Downloads\(B010)수치지도_37608068_2024_00000165193019\N3L_C0070000.shp"
"C:\Users\BaekInchan\Downloads\(B010)수치지도_37608068_2024_00000165193019\N3L_C0520000.shp"
"C:\Users\BaekInchan\Downloads\(B010)수치지도_37608068_2024_00000165193019\N3L_E0020000.shp"
"C:\Users\BaekInchan\Downloads\(B010)수치지도_37608068_2024_00000165193019\N3L_F0010000.shp"
"C:\Users\BaekInchan\Downloads\(B010)수치지도_37608068_2024_00000165193019\N3L_F0030000.shp"
"C:\Users\BaekInchan\Downloads\(B010)수치지도_37608068_2024_00000165193019\N3L_F0040000.shp"
"C:\Users\BaekInchan\Downloads\(B010)수치지도_37608068_2024_00000165193019\N3L_G0030000.shp"
"C:\Users\BaekInchan\Downloads\(B010)수치지도_37608068_2024_00000165193019\N3P_C0090000.shp"
"C:\Users\BaekInchan\Downloads\(B010)수치지도_37608068_2024_00000165193019\N3P_C0285311.shp"
"C:\Users\BaekInchan\Downloads\(B010)수치지도_37608068_2024_00000165193019\N3P_C0330000.shp"
"C:\Users\BaekInchan\Downloads\(B010)수치지도_37608068_2024_00000165193019\N3P_C0340000.shp"
"C:\Users\BaekInchan\Downloads\(B010)수치지도_37608068_2024_00000165193019\N3P_C0380000.shp"
"C:\Users\BaekInchan\Downloads\(B010)수치지도_37608068_2024_00000165193019\N3P_D0030000.shp"
"C:\Users\BaekInchan\Downloads\(B010)수치지도_37608068_2024_00000165193019\N3P_E0042326.shp"
""")
python = GhPythonScript(x="F0010000", shapeFile=panel)  # -> out, a, ans; inputs shapeFile: list
# ---------- python: Python ----------
__author__ = "BaekInchan"
__version__ = "2024.03.23"

import rhinoscriptsyntax as rs


a = []

for i in shapeFile : 
    if(i[0] == '"') : i = i[1 :]
    if(i[-1] == '"') : i = i[:-1]
    #if(i.split("\\")[-1].split("_")[0][-1] == 'P') : continue; 
    a.append(i)

ans = ""

for i in a : 
    if x in i : 
        ans = i
        break
# ---------- end python ----------
path = FilePath(python.ans)
toggle = BooleanToggle(True)
python_2 = GhPythonScript(x="A0010000", shapeFile=panel)  # -> out, a, ans; inputs shapeFile: list; same code as python
toggle_2 = BooleanToggle(True)
toggle_3 = BooleanToggle(True)
python_3 = GhPythonScript(x="N3A_E0010001", shapeFile=panel)  # -> out, a, ans; inputs shapeFile: list; same code as python
imp_it = ImpIt(ShapefileShpPath=python_2.ans, Project2WGS84=False, TrueOrFalse=toggle)  # -> Shapes, Features
python_4 = GhPythonScript(x="N3A_B0010000", shapeFile=panel)  # -> out, a, ans; inputs shapeFile: list; same code as python
imp_it_2 = ImpIt(ShapefileShpPath=python.ans, Project2WGS84=False, TrueOrFalse=toggle_3)  # -> Shapes, Features
toggle_4 = BooleanToggle(True)
imp_it_3 = ImpIt(ShapefileShpPath=python_3.ans, Project2WGS84=False, TrueOrFalse=toggle_2)  # -> Shapes, Features
item = ListItem(List=imp_it.Features, Index=Slider(5, range=0..10), Wrap=True)
item_2 = ListItem(List=imp_it_3.Features, Index=Slider(5, range=0..10), Wrap=True)
imp_it_4 = ImpIt(ShapefileShpPath=python_4.ans, Project2WGS84=False, TrueOrFalse=toggle_4)  # -> Shapes, Features
item_3 = ListItem(List=imp_it_2.Features, Index=Slider(1, range=0..10), Wrap=True)
datavis_it = DataVisIt(Shapes=imp_it.Shapes, GetValueofFeature=item, TrueOrFalse=toggle)  # -> Polygon, Polyline, Point, AttValues
datavis_it_2 = DataVisIt(Shapes=imp_it_3.Shapes, GetValueofFeature=item_2, TrueOrFalse=toggle_2)  # -> Polygon, Polyline, Point, AttValues
datavis_it_3 = DataVisIt(Shapes=imp_it_2.Shapes, GetValueofFeature=item_3, TrueOrFalse=toggle_3)  # -> Polygon, Polyline, Point, AttValues
item_4 = ListItem(List=imp_it_4.Features, Index=Slider(5, range=0..10), Wrap=True)
datavis_it_4 = DataVisIt(Shapes=imp_it_4.Shapes, GetValueofFeature=item_4, TrueOrFalse=toggle_4)  # -> Polygon, Polyline, Point, AttValues
sec = BrepPlane(Plane=PlaneXY(0, 0, 0))  # -> Curves, Points
crv = Curve(datavis_it.Polygon)
geo = Geometry(datavis_it_3.Polyline)
crv_2 = Curve(datavis_it_2.Polygon)
c_script = CSharpScript(topoLine=datavis_it_3.Polyline, topoHeight=datavis_it_3.AttValues, resolution=Slider(5, range=0..100), Run=Toggle(True))  # -> out, topo3D; inputs topoLine: tree of Curve, topoHeight: tree of Double, resolution: Int32, Run: Boolean
# ---------- c_script: C# usings ----------
using System.Linq;
using System.Threading.Tasks;
# ---------- c_script: C# ----------
    
      if (!Run) return;

      // 데이터를 중첩된 리스트로 변환
      List<List<Curve>> topoLineList = ConvertTreeToNestedList(topoLine);
      List<List<double>> topoHeightList = ConvertTreeToNestedList(topoHeight);
      List<List<Curve>> topoLineRet = new List<List<Curve>>();
      List<GeometryBase> gemoList = new List<GeometryBase>();
      List<Point3d> allDividePts = new List<Point3d>();

      // 병렬 처리: 각 라인을 처리하고 분할 포인트 계산
      Parallel.For(0, topoLineList.Count, i =>
        {
        if (topoLineList[i] == null || topoHeightList[i] == null) return;

        Curve now = topoLineList[i][0];
        double height = topoHeightList[i][0];
        Point3d st = now.PointAtStart;
        Point3d en = MovePt(st, Vector3d.ZAxis, height);
        Curve nxt = MoveOrientPoint(now, st, en);

        lock (topoLineRet)
        {
          topoLineRet.Add(new List<Curve>() { nxt });
          gemoList.Add(now);
        }

        Point3d[] divLenPts;
        nxt.DivideByLength(10, false, out divLenPts);
        if (divLenPts != null)
        {
          lock (allDividePts)
          {
            allDividePts.AddRange(divLenPts);
          }
        }
        });

      // Bounding Box 생성 및 계산
      Brep bbox = CalculateBoundingBox(gemoList).ToBrep();
      var segRectangle = bbox.Faces;
      var sortedRectangle = segRectangle.OrderBy(x => x.GetBoundingBox(false).Center.Z).ToList();
      var bottomCrv = Curve.JoinCurves(sortedRectangle[0].ToBrep().Edges)[0];
      var bottomCrvOffset = OffsetCurve(bottomCrv, Plane.WorldXY, 20);

      // 가장 가까운 커브 찾기
      var findNearestCrv = bbox.Edges
        .Where(edge =>
        {
        Vector3d edgeDirection = edge.PointAtEnd - edge.PointAtStart;
        edgeDirection.Unitize();
        return Math.Abs(edgeDirection * Vector3d.ZAxis - 1) < RhinoMath.ZeroTolerance;
        })
        .Select(edge => edge.ToNurbsCurve())
        .ToList();


      // 병렬 처리: 가장 가까운 커브 찾기에서 거리 정렬 최적화
      Parallel.For(0, findNearestCrv.Count, i =>
        {
        var now = findNearestCrv[i];
        double t;

        // 가장 가까운 포인트를 찾기 위해 거리 비교 (불필요한 정렬 제거)
        Point3d closestPt = allDividePts.OrderBy(pt =>
          {
          now.ClosestPoint(pt, out t);
          return now.PointAt(t).DistanceTo(pt);
          }).First();

        now.ClosestPoint(closestPt, out t);
        var nxt = now.PointAt(t);

        lock (allDividePts)
        {
          allDividePts.Add(nxt);
        }
        });

      // 델로니 메쉬 생성
      var delMesh = CreateDelaunayMesh(allDividePts);
      int uCount = 0, vCount = 0;
      var ptsSrf = DivideSurface(PlanarSrf(bottomCrvOffset), resolution, ref uCount, ref vCount);

      // 초기화: uCount, vCount를 사용하여 2차원 리스트 생성
      Point3d?[,] sortedPtsDelMesh = new Point3d?[uCount + 1, vCount + 1]; // 2D 배열을 사용하여 포인트를 정렬된 위치에 저장

      // 병렬 처리: 레이와 메쉬 교차점 찾기 및 u, v 정렬
      Parallel.For(0, ptsSrf.Count, i =>
        {
        var now = ptsSrf[i];
        Ray3d ray = new Ray3d(new Point3d(now.X, now.Y, now.Z - 1000.0), Vector3d.ZAxis);
        Point3d? intersectionPoint = MeshRay(delMesh, ray);
        if (intersectionPoint != null)
        {
          // i를 u, v 인덱스로 변환
          int uIndex = i / (vCount + 1);
          int vIndex = i % (vCount + 1);

          // 스레드 안전한 방식으로 2D 배열에 포인트 저장
          sortedPtsDelMesh[uIndex, vIndex] = intersectionPoint.Value;
        }
        });

      List<Point3d> ptsDelMesh = new List<Point3d>(uCount * vCount);
      for (int u = 0; u <= uCount; u++)
      {
        for (int v = 0; v <= vCount; v++)
        {
          var point = sortedPtsDelMesh[u, v];
          if (point.HasValue)
          {
            ptsDelMesh.Add(point.Value);
          }
        }
      }

      var finalTopo = SurfaceFromPoints(ptsDelMesh, uCount + 1, vCount + 1);
      topo3D = finalTopo;
# ---------- c_script: C# additional code ----------
    public Surface SurfaceFromPoints(List < Point3d > points, int uCount, int vCount)
    {
      // 입력 검증
      if (points == null || points.Count < 4)
        throw new ArgumentException("At least 4 points are required to create a surface.");
      if (uCount * vCount != points.Count)
        throw new ArgumentException("The number of points must be equal to uCount * vCount.");

      // NurbsSurface 생성 및 반환
      return NurbsSurface.CreateFromPoints(points, uCount, vCount, 3, 3);
    }

    public static Point3d? MeshRay(Mesh mesh, Ray3d ray)
    {
      if (mesh == null || !mesh.IsValid)
        return null;

      // 레이와 메쉬의 교차점 계산
      int[] t;
      var intersection = Rhino.Geometry.Intersect.Intersection.MeshRay(mesh, ray, out t);
      return intersection >= 0 ? (Point3d?) ray.PointAt(intersection) : null;
    }

    public int Gcd(int a, int b)
    {
      while (b != 0)
      {
        int temp = b;
        b = a % b;
        a = temp;
      }

      return Math.Abs(a);
    }

    public Surface PlanarSrf(Curve c)
    {
      if (c.IsValid && c.IsPlanar() && c.IsClosed)
      {
        var tmp = Brep.CreatePlanarBreps(c, 0.01);
        return tmp[0].Faces[0];
      }

      return null;
    }

    public List<Point3d> DivideSurface(Surface surface, int k, ref int uCount, ref int vCount)
    {
      List<Point3d> pointsOnSurface = new List<Point3d>();
      int ul = (int) surface.Domain(0).Length / 100 * 100;
      int vl = (int) surface.Domain(1).Length / 100 * 100;
      int gcd = Gcd(ul, vl);
      var candidates = GetDivisors(gcd);
      int u = ul / candidates[Math.Min(candidates.Count - 1, k)];
      int v = vl / candidates[Math.Min(candidates.Count - 1, k)];

      double uSteps = surface.Domain(0).Length / u;
      double vSteps = surface.Domain(1).Length / v;

      // 초기 용량을 설정하여 메모리 할당 최적화
      pointsOnSurface.Capacity = (u + 1) * (v + 1);

      for (int i = 0; i <= u; i++)
      {
        for (int j = 0; j <= v; j++)
        {
          double uParam = surface.Domain(0).T0 + i * uSteps;
          double vParam = surface.Domain(1).T0 + j * vSteps;
          pointsOnSurface.Add(surface.PointAt(uParam, vParam));
        }
      }

      uCount = u;
      vCount = v;
      return pointsOnSurface;
    }

    public List<int> GetDivisors(int n)
    {
      List<int> divisors = new List<int>();

      for (int i = 1; i <= Math.Sqrt(n); i++)
      {
        if (n % i == 0)
        {
          divisors.Add(i);
          if (i != n / i)
            divisors.Add(n / i);
        }
      }

      // 조건에 맞는 약수 필터링 및 정렬
      return divisors.Where(x => x >= 10).OrderByDescending(x => x).ToList();
    }

    public static Mesh CreateDelaunayMesh(List < Point3d > pts)
    {
      if (pts == null || pts.Count < 3)
      {
        return null;
      }

      // Create Node2List from points
      var nodes = new Grasshopper.Kernel.Geometry.Node2List();
      for (int i = 0; i < pts.Count; i++)
      {
        nodes.Append(new Grasshopper.Kernel.Geometry.Node2(pts[i].X, pts[i].Y));
      }

      // Solve Delaunay
      var faces = new List<Grasshopper.Kernel.Geometry.Delaunay.Face>();
      faces = Grasshopper.Kernel.Geometry.Delaunay.Solver.Solve_Faces(nodes, 0);
      var delMesh = Grasshopper.Kernel.Geometry.Delaunay.Solver.Solve_Mesh(nodes, 0, ref faces);

      // Update mesh vertices with original points
      for (int i = 0; i < pts.Count; i++)
      {
        delMesh.Vertices.SetVertex(i, pts[i]);
      }

      return delMesh;
    }

    public Curve OffsetCurve(Curve c, Plane p, double interval)
    {
      var seg = c.DuplicateSegments();
      var joinseg = Curve.JoinCurves(seg);
      List<Curve> outLines = new List<Curve>(joinseg.Length);

      foreach (var js in joinseg)
        outLines.AddRange(c.Offset(p, interval, 0, CurveOffsetCornerStyle.Sharp));

      var ret = Curve.JoinCurves(outLines);
      return ret != null && ret.Length > 0 ? ret[0] : null;
    }

    public static BoundingBox CalculateBoundingBox(IEnumerable < GeometryBase > geometries)
    {
      BoundingBox bbox = BoundingBox.Empty;
      foreach (var geometry in geometries)
        bbox.Union(geometry.GetBoundingBox(true));

      return bbox;
    }

    public Point3d MovePt(Point3d p, Vector3d v, double amp)
    {
      v.Unitize();
      p.Transform(Transform.Translation(v * amp));
      return p;
    }

    public T MoveOrientPoint<T > (T obj, Point3d now, Point3d nxt) where T : GeometryBase
    {
      Plane st = new Plane(now, Plane.WorldXY.XAxis, Plane.WorldXY.YAxis);
      Plane en = new Plane(nxt, Plane.WorldXY.XAxis, Plane.WorldXY.YAxis);
      obj.Transform(Transform.PlaneToPlane(st, en));
      return obj;
    }

    public List<List<T>> ConvertTreeToNestedList<T > (DataTree < T > tree)
    {
      List<List<T>> nestedList = new List<List<T>>();
      foreach (GH_Path path in tree.Paths)
      {
        List<T> subList = new List<T>(tree.Branch(path));
        nestedList.Add(subList);
      }

      return nestedList;
    }
# ---------- end c_script ----------
toggle_5 = BooleanToggle(True)
rider = RIder(openFile=toggle_5)  # -> Folder; inputs openFile: Boolean
# ---------- rider: C# usings ----------
using System.IO;
using System.Diagnostics;

public class ScriptUtilities
{
  public static string GetCurrentFolder(GH_Document doc)
  {
    string filePath = doc.FilePath;
    return Path.GetDirectoryName(filePath);
  }

  public static string[] GetCsFiles(string folderPath)
  {
    return Directory.GetFiles(folderPath, "*.cs");
  }

  public static void OpenFileWithRider(string filePath, Action<string> print)
  {
    try
    {
      // Define the path to the JetBrains Rider executable
      string riderPath = @"C:\Program Files\JetBrains\JetBrains Rider 2024.1.4\bin\rider64.exe";

      if (!File.Exists(riderPath))
      {
        print("Rider executable not found at: " + riderPath);
        return;
      }

      // Start the process to open the file with Rider
      ProcessStartInfo startInfo = new ProcessStartInfo
        {
          FileName = riderPath,
          Arguments = "\"" + filePath + "\"", // Enclose in quotes in case of spaces
          UseShellExecute = true
          };
      Process.Start(startInfo);
    }
    catch (Exception ex)
    {
      print("Error opening file with Rider: " + ex.Message);
    }
  }

  public static void RunScript(bool openFile, ref object Here, IGH_Component owner, Action<string> print)
  {
    // Get the current folder path
    GH_Document doc = owner.OnPingDocument();
    string currentFolder = GetCurrentFolder(doc);
    Here = currentFolder;

    // Get .cs files in the current folder
    string[] csFiles = GetCsFiles(currentFolder);
    if (csFiles.Length > 0)
    {
      string csFilePath = csFiles[0];

      if (openFile)
      {
        OpenFileWithRider(csFilePath, print);
      }
    }
    else
    {
      print("No .cs files found in the directory.");
    }
  }
}
# ---------- rider: C# ----------
   ScriptUtilities.RunScript(openFile, ref Folder, Component, Print);
# ---------- end rider ----------
panel_2 = Panel("street")
crv_3 = Curve(crv)
srf = Surface(c_script.topo3D)
srf_2 = Surface(c_script.topo3D)
srf_3 = Surface(c_script.topo3D)
crv_4 = Curve(crv_2)

scriptpar = ScriptParasite(Enable=toggle_5, Folder=rider)
c_script_2 = CSharpScript(streets=crv_3, topo3D=srf, Run=Toggle(True))  # -> out, streetLine, streetFlatLine; inputs streets: tree of Curve, topo3D: Brep, Run: Boolean
# ---------- c_script_2: C# usings ----------
using System.Collections.Concurrent;
using System.Linq;
using System.Threading.Tasks;
# ---------- c_script_2: C# ----------
    if (!Run) return;
    List<Curve> streetLines = new List<Curve>(); 
    var sLine = ConvertTreeToNestedList(streets);
    
    
    foreach (var i in sLine)
    {
      if (i.Count > 0) streetLines.Add(i[0]); 
    }
    
    var regionCurve = Curve.CreateBooleanUnion(streetLines, 0.001).ToList();
    var validCurves = new ConcurrentBag<Curve>();

    Parallel.ForEach(regionCurve, curve =>
      {
      var area = AreaMassProperties.Compute(curve).Area;
      if (area > 100)
      {
        var tmp = Curve.ProjectToBrep(curve, topo3D, Vector3d.ZAxis, 0.001);
        if (tmp != null && tmp.Length > 0)
        {
          foreach (var t in tmp)
          {
            validCurves.Add(t);
          }
        }
      }
      });
    streetLine = validCurves;
    streetFlatLine = regionCurve;
# ---------- c_script_2: C# additional code ----------
  public List<List<T>> ConvertTreeToNestedList<T>(DataTree<T> tree)
  {
    List<List<T>> nestedList = new List<List<T>>();
    foreach (GH_Path path in tree.Paths)
    {
      List<T> subList = new List<T>(tree.Branch(path));
      nestedList.Add(subList);
    }

    return nestedList;
  }
# ---------- end c_script_2 ----------

c_script_3 = CSharpScript(
    buildingLine=datavis_it_4.Polygon,
    buildingHeight=datavis_it_4.AttValues,
    topo3D=srf_3,
    type="parapet",
    removeUnderArea=Slider(23, range=0..100),
    Run=Toggle(True))  # -> out, buildings; inputs buildingLine: tree of Curve, buildingHeight: tree of Double, topo3D: Surface, type: String, removeUnderArea: Double, Run: Boolean
# ---------- c_script_3: C# usings ----------
using System.Linq;
using System.Threading;
using System.Threading.Tasks;
using Rhino.Geometry.Intersect;
# ---------- c_script_3: C# ----------
      if (!Run) return;

      var buildingLines = ConvertTreeToNestedList(buildingLine);
      var buildingHeights = ConvertTreeToNestedList(buildingHeight);

      List<List<Curve>> pureLines = new List<List<Curve>>(buildingLines.Count);
      List<List<Point3d>> purePoints = new List<List<Point3d>>(buildingLines.Count);
      List<List<Point3d>> nxtPurePoints = new List<List<Point3d>>(buildingLines.Count);

      var raySrf = new List<GeometryBase>() { topo3D.ToBrep() };
      List<List<double>> pureHeights = new List<List<double>>(buildingLines.Count);
      List<List<double>> deem = new List<List<double>>(buildingLines.Count);

      // 병렬로 빌딩 라인 처리
      Parallel.For(0, buildingLines.Count, i =>
        {
        var now = buildingLines[i][0];
        var disconNow = Discontinuity(now);
        var rayPts = new List<Point3d>(disconNow.Count);
        var bulidArea = AreaMassProperties.Compute(now).Area;
        if(bulidArea < removeUnderArea) return;
        foreach (var disconPts in disconNow)
        {
          Ray3d ray = new Ray3d(new Point3d(disconPts.X, disconPts.Y, disconPts.Z - 100.0), Vector3d.ZAxis);
          var pts = Intersection.RayShoot(ray, raySrf, 1).ToList();
          if (pts.Count != 0) rayPts.Add(pts[0]);
        }

        if (rayPts.Count != disconNow.Count) return;

        double minDist = double.MaxValue, maxDist = double.MinValue;
        int id = -1;

        for (int j = 0; j < rayPts.Count; j++)
        {
          var dist = rayPts[j].DistanceTo(disconNow[j]);
          if (dist < minDist)
          {
            minDist = dist;
            id = j;
          }

          if (dist > maxDist)
          {
            maxDist = dist;
          }
        }

        lock (nxtPurePoints)
        {
          nxtPurePoints.Add(new List<Point3d>() { rayPts[id] });
          purePoints.Add(new List<Point3d>() { disconNow[id] });
          pureLines.Add(buildingLines[i]);
          pureHeights.Add(buildingHeights[i]);
          deem.Add(new List<double>() { maxDist - minDist });
        }
        });

      List<Brep> makeBuildings = new List<Brep>(pureLines.Count);
      List<Brep> makeBuildingsParapet = new List<Brep>(pureLines.Count);

      
      // 병렬 처리: 건물 생성 작업
      Parallel.For(0, pureLines.Count, i =>
      {
        var now = pureLines[i][0];
        Plane pl;
        now.TryGetPlane(out pl);
        if (pl.ZAxis.Z < 0) now.Reverse();
        var nxt = MoveOrientPoint(now, purePoints[i][0], nxtPurePoints[i][0]);
        
        
        
        if (type == "flat")
        {
          lock (makeBuildings)
          {
            makeBuildings.Add(Extrude(nxt, deem[i][0] + 3.5 * pureHeights[i][0]).ToBrep());
          }
        }
        
        else if (type == "parapet")
        {
          List<Brep> faces = new List<Brep>();
          Curve nxtUpper = nxt.DuplicateCurve();
          nxtUpper = MoveOrientPoint(nxtUpper, nxtPurePoints[i][0],
            MovePt(nxtPurePoints[i][0], Vector3d.ZAxis, deem[i][0] + 3.5 * pureHeights[i][0]));
          faces.Add(NurbsSurface.CreateRuledSurface(nxt, nxtUpper).ToBrep());

          nxtUpper.TryGetPlane(out pl);
          var nxtUpperParapet = OffsetCurve(nxtUpper, pl, -0.3);
          if (nxtUpperParapet == null) return;
          faces.AddRange(nxtUpperParapet);

          var finalBuilding = JoinAndCapBreps(faces);
          if (finalBuilding == null) return;



          lock (makeBuildingsParapet)
          {
            makeBuildingsParapet.Add(finalBuilding);
          }
        }
      });

      if (type == "flat")
      {
        buildings = makeBuildings;
      }else if (type == "parapet")
      {
        buildings = makeBuildingsParapet;
      }
# ---------- c_script_3: C# additional code ----------
  
  public static Brep JoinAndCapBreps(List<Brep> breps)
  {
    if (breps == null || breps.Count == 0)
      return null;

    // Join the Breps
    Brep[] joinedBreps = Brep.JoinBreps(breps, Rhino.RhinoMath.ZeroTolerance);
    if (joinedBreps == null || joinedBreps.Length == 0)
      return null;

    // Cap the joined Brep
    Brep cappedBrep = joinedBreps[0].CapPlanarHoles(Rhino.RhinoMath.ZeroTolerance);
    return cappedBrep;
  }
  
    // 포인트를 주어진 벡터 방향으로 이동시키는 함수
    public Point3d MovePt(Point3d p, Vector3d v, double amp)
    {
      v.Unitize(); // 벡터를 단위 벡터로 변환
      p.Transform(Transform.Translation(v * amp)); // 변환을 바로 적용
      return p; // 이동된 포인트 반환
    }

    // 주어진 커브로부터 평면 브렙 생성
    public Brep PlanarSrf(Curve c)
    {
      // 유효성 검사 및 평면 여부 확인
      if (c.IsValid && c.IsPlanar() && c.IsClosed)
      {
        var tmp = Brep.CreatePlanarBreps(c, 0.01);
        if (tmp != null && tmp.Length > 0)
          return tmp[0]; // 유효한 브렙 반환
      }

      return null; // 유효하지 않으면 null 반환
    }

    // 커브를 오프셋하고 결과 브렙 생성
    public List<Brep> OffsetCurve(Curve c, Plane p, double interval)
    {
      var seg = c.DuplicateSegments(); // 커브 세그먼트 복제
      var joinseg = Curve.JoinCurves(seg); // 세그먼트를 조인
      List<Curve> outLines = new List<Curve>(joinseg.Length); // 리스트의 초기 용량 설정

      foreach (var js in joinseg)
      {
        var offset = js.Offset(p, interval, 0.001, CurveOffsetCornerStyle.Sharp);
        if (offset != null && offset.Length > 0)
          outLines.AddRange(offset);
      }

      var ret = Curve.JoinCurves(outLines);
      if (ret == null || ret.Length == 0) return null; // 오프셋 결과가 유효하지 않은 경우

      var boundary = PlanarSrf(c);
      if (boundary == null) return null; // 평면 브렙이 생성되지 않은 경우

      var outBrep = boundary.Split(ret, 0.001); // 오프셋 커브로 분할
      if (outBrep == null || outBrep.Length == 0) return null; // 분할 결과가 없는 경우
      
      List<Brep> parapet = new List<Brep>() { outBrep[0] };
      foreach (var crv in ret)
      {
        var tmp = crv.DuplicateCurve(); 
        var nxt = MoveOrientPoint(tmp, crv.PointAtStart, MovePt(crv.PointAtStart, -Vector3d.ZAxis, 1.3));
        parapet.Add(NurbsSurface.CreateRuledSurface(crv, nxt).ToBrep());
      }

      return parapet;  // 첫 번째 분할 결과 반환
    }

    // 주어진 커브를 주어진 높이로 extrusion(압출)하는 함수
    public static Extrusion Extrude(Curve curve, double height)
    {
      return Extrusion.Create(curve, height, true); // extrusion 생성 및 반환
    }

    // 커브의 불연속 점들을 찾는 함수
    public List<Point3d> Discontinuity(Curve x)
    {
      var seg = x.DuplicateSegments(); // 커브 세그먼트 복제
      List<Point3d> pts = new List<Point3d>(seg.Length + 1); // 리스트의 초기 용량 설정

      // 모든 세그먼트의 시작과 끝점을 추가
      foreach (var s in seg)
      {
        if (pts.Count == 0) pts.Add(s.PointAtStart);
        pts.Add(s.PointAtEnd);
      }

      // 닫힌 커브의 경우 마지막 중복 점 제거
      if (x.IsClosed) pts.RemoveAt(pts.Count - 1);
      return pts; // 불연속점 리스트 반환
    }

    // 오브젝트를 두 점 사이에서 이동시키는 함수
    public T MoveOrientPoint<T > (T obj, Point3d now, Point3d nxt) where T : GeometryBase
    {
      Plane st = new Plane(now, Plane.WorldXY.XAxis, Plane.WorldXY.YAxis); // 시작 평면
      Plane en = new Plane(nxt, Plane.WorldXY.XAxis, Plane.WorldXY.YAxis); // 목표 평면
      obj.Transform(Transform.PlaneToPlane(st, en)); // 변환 적용
      return obj; // 변환된 오브젝트 반환
    }
    public List<List<T>> ConvertTreeToNestedList<T > (DataTree < T > tree)
    {
      List<List<T>> nestedList = new List<List<T>>();
      foreach (GH_Path path in tree.Paths)
      {
        List<T> subList = new List<T>(tree.Branch(path));
        nestedList.Add(subList);
      }

      return nestedList;
      ;
    }
# ---------- end c_script_3 ----------
c_script_4 = CSharpScript(streets=crv_4, topo3D=srf_2, Run=Toggle(True))  # -> out, streetLine, streetFlatLine; inputs streets: tree of Curve, topo3D: Brep, Run: Boolean
# ---------- c_script_4: C# ----------
    if (!Run) return;
    List<Curve> streetLines = new List<Curve>(); 
    var sLine = ConvertTreeToNestedList(streets);
    
    
    foreach (var i in sLine)
    {
      if (i.Any()) streetLines.Add(i[0]); 
    }
    
    var regionCurve = Curve.CreateBooleanUnion(streetLines, 0.001).ToList();
    var validCurves = new ConcurrentBag<Curve>();

    Parallel.ForEach(regionCurve, curve =>
      {
      var area = AreaMassProperties.Compute(curve).Area;
      if (area > 100)
      {
        var tmp = Curve.ProjectToBrep(curve, topo3D, Vector3d.ZAxis, 0.001);
        if (tmp != null && tmp.Length > 0)
        {
          foreach (var t in tmp)
          {
            validCurves.Add(t);
          }
        }
      }
      });
    streetLine = validCurves;
    streetFlatLine = regionCurve;
# ---------- c_script_4: C# additional code ----------
  public List<List<T>> ConvertTreeToNestedList<T>(DataTree<T> tree)
  {
    List<List<T>> nestedList = new List<List<T>>();
    foreach (GH_Path path in tree.Paths)
    {
      List<T> subList = new List<T>(tree.Branch(path));
      nestedList.Add(subList);
    }

    return nestedList;
  }
# ---------- end c_script_4 ----------
toggle_6 = BooleanToggle(True)
python_5 = GhPythonScript(x="C0380000", shapeFile=panel)  # -> out, a, ans; inputs shapeFile: list; same code as python
brep = Brep(c_script_3.buildings)
crv_5 = Curve(c_script_2.streetLine)
crv_6 = Curve(c_script_4.streetLine)
imp_it_5 = ImpIt(ShapefileShpPath=python_5.ans, Project2WGS84=False, TrueOrFalse=toggle_6)  # -> Shapes, Features
item_5 = ListItem(List=imp_it_5.Features, Index=Slider(1, range=0..10), Wrap=True)
datavis_it_5 = DataVisIt(Shapes=imp_it_5.Shapes, GetValueofFeature=item_5, TrueOrFalse=toggle_6)  # -> Polygon, Polyline, Point, AttValues
pt = Point(datavis_it_5.Point)
panel_3 = Panel(datavis_it_5.AttValues)
toggle_7 = BooleanToggle(True)
toggle_8 = BooleanToggle(True)
srf_4 = Surface(c_script.topo3D)
rider_2 = RIder(openFile=toggle_7)  # -> Folder; inputs openFile: Boolean; same code as rider
rider_3 = RIder(openFile=toggle_8)  # -> Folder; inputs openFile: Boolean; same code as rider

c_script_5 = CSharpScript()  # -> out, blockLine, streetLine, streetFlatLine; inputs streetLines: list of Curve, topo3D: Brep; disabled
# ---------- c_script_5: C# usings ----------
using System.Collections.Concurrent;
using System.Linq;
using System.Threading.Tasks;
using GH_IO.Types;
# ---------- c_script_5: C# ----------
    var regionCurve = Curve.CreateBooleanUnion(streetLines, 0.001).ToList();
    var validCurves = new ConcurrentBag<Curve>();
    var maxArea = 0.0;
    Curve largestCurve = null;
    Parallel.ForEach(regionCurve, curve =>
    {
      var area = AreaMassProperties.Compute(curve).Area;
      if (area > 100)
      {
        Plane pl;
        if (curve.TryGetPlane(out pl) && pl.Normal.Z < 0)
        {
          curve.Reverse();
        }

        validCurves.Add(curve);
        lock (regionCurve)
        {
          if (area > maxArea)
          {
            maxArea = area;
            largestCurve = curve;
          }
        }
      }
    });
    regionCurve = validCurves.Where(c => c != largestCurve).ToList(); 
    var boss = Extrude(largestCurve, 500).ToBrep();
    var block = topo3D.Split(boss, 0.01);
    var street = block.Last(); 
    var splitResults = new ConcurrentBag<Brep>();
    var brepList = new ConcurrentBag<Brep>(); 
    
    for (int i = 0; i < block.Length - 1; i++)
    {
      splitResults.Add(block[i]); 
    }
    
    Parallel.ForEach(regionCurve, curve =>
    {
      if(largestCurve.Contains(curve.PointAtStart, Plane.WorldXY, 0.01) == PointContainment.Inside)
      {
        var cutter = Extrude(curve, 1000).ToBrep(); 
        var tmp = topo3D.Split(cutter, 0.001);
        if (tmp != null && tmp.Length > 0)
        {
          splitResults.Add(tmp.Last());
        }

        brepList.Add(cutter); 
      }
    });
    
    foreach (var i in brepList)
    {
      var tmp = street.Split(i, 0.001);
      if (tmp == null || tmp.Length == 0) continue;
      street = street.Split(i, 0.001)[0];
    }

    blockLine = splitResults;
    streetLine = street;
# ---------- c_script_5: C# additional code ----------
  public Point3d MovePt(Point3d p, Vector3d v, double amp)
  {
    var copyPt = new Point3d(p); 
    v.Unitize();
    Transform move = Transform.Translation(v * amp);
    copyPt.Transform(move);
    return copyPt;
  }
  public static Extrusion Extrude(Curve curve, double height)
  {
    return Extrusion.Create(curve, height, false); // extrusion 생성 및 반환
  }

  public T MoveOrientPoint<T>(T obj, Point3d now, Point3d nxt) where T : GeometryBase
  {
    Plane baseNow = Plane.WorldXY;
    Plane st = new Plane(now, baseNow.XAxis, baseNow.YAxis);
    Plane en = new Plane(nxt, baseNow.XAxis, baseNow.YAxis);
    Transform orient = Transform.PlaneToPlane(st, en);
    obj.Transform(orient);
    return obj;
  }
# ---------- end c_script_5 ----------
scriptpar_2 = ScriptParasite(Enable=toggle_7, Folder=rider_2)

scriptpar_3 = ScriptParasite(Enable=toggle_8, Folder=rider_3)
c_script_6 = CSharpScript(streetLines=flatten(crv_4), topo3D=srf_4)  # -> out, blockLine, streetLine, streetFlatLine; inputs streetLines: list of Curve, topo3D: Brep
# ---------- c_script_6: C# ----------
    var regionCurve = Curve.CreateBooleanUnion(streetLines, 0.001).ToList();
    var validCurves = new ConcurrentBag<Curve>();
    var maxArea = 0.0;
    Curve largestCurve = null;
    Parallel.ForEach(regionCurve, curve =>
    {
      var area = AreaMassProperties.Compute(curve).Area;
      if (area > 100)
      {
        Plane pl;
        if (curve.TryGetPlane(out pl) && pl.Normal.Z < 0)
        {
          curve.Reverse();
        }

        validCurves.Add(curve);
        lock (regionCurve)
        {
          if (area > maxArea)
          {
            maxArea = area;
            largestCurve = curve;
          }
        }
      }
    });
    var splitResults = new ConcurrentBag<Brep>();
    
    Parallel.ForEach(regionCurve, curve =>
    {
      var cutter = Extrude(curve, 1000).ToBrep(); 
      var tmp = topo3D.Split(cutter, 0.001);
      if (tmp != null && tmp.Length > 0)
      {
        splitResults.Add(tmp.Last());
      }
    });

    streetLine = splitResults;
    blockLine = validCurves;
# ---------- c_script_6: C# additional code ----------
  public static Extrusion Extrude(Curve curve, double height)
  {
    return Extrusion.Create(curve, height, false); // extrusion 생성 및 반환
  }
# ---------- end c_script_6 ----------

geo_2 = Geometry(c_script_5.blockLine)
geo_3 = Geometry(c_script_6.blockLine)
geo_4 = Geometry(c_script_5.streetLine)
geo_5 = Geometry(c_script_6.streetLine)
