# Grasshopper definition 02_How to use vector multiplication.gh (Grasshopper 1.0.7)

panel = Panel("""위치벡터
단위벡터""")
crv = Curve([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])
join = JoinCurves(Curves=crv, Preserve=False)
crv_2 = Curve([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])
# 3 Level - 02
crv_3 = Curve([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])
line = Line(Line((5, 2, 0), (12, 14, 0)))
crv_4 = Curve([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])
crv_5 = Curve(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)
crv_6 = Curve(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)
pt = Point(Point(12, 8, 0))
pt_2 = Point(Point(4, 6, 0))
explode = Explode(Curve=join, Recursive=True)  # -> Segments, Vertices
explode_2 = Explode(Curve=crv_3, Recursive=True)  # -> flatten(Segments), Vertices
line_2 = Line(crv_6)
join_2 = JoinCurves(Curves=crv_4, Preserve=False)
vec = Vector(crv_5)
vec_2 = Vector(line)
vec_3 = Vector(pt)
vec2pt = Vector2Pt(PointA=pt_2, PointB=pt, Unitize=Toggle(True))  # -> Vector, Length
vec_4 = Vector(line_2)
shift = ShiftList(List=explode.Segments, Shift="-1", Wrap=True)
panel_2 = Panel(crv_3)
vlen = VectorLength(Vector=vec_3)
explode_3 = Explode(Curve=join_2, Recursive=True)  # -> Segments, Vertices
panel_3 = Panel(vec2pt.Length)
shift_2 = ShiftList(List=explode_2.Segments, Shift=1, Wrap=True)
pi = Pi(Factor=Slider(0.52, range=0..2))
vec_5 = Vector(shift)
vec_6 = Vector(explode.Segments)
item = ListItem(List=shift, Index=0, Wrap=True)
panel_4 = Panel(vlen)
kinkcrv = KinkyCurve(Vertices=explode_3.Vertices, Degree="3", Angle=pi)  # -> Curve, Length, Domain
angle = Angle(VectorA=explode_2.Segments, VectorB=shift_2)  # -> Angle, Reflex
multiplication = Multiplication(A=vec_6, B=vec_5)
box = Box()
disc = Discontinuity(Curve=kinkcrv.Curve, Level=1)  # -> Points, Parameters
num = Number(angle.Angle)
xprod = CrossProduct(Unitize=False)  # -> Vector, Length
smaller = SmallerThan(FirstNumber=multiplication, SecondNumber="0")  # -> SmallerThan, OrEqualTo
pline = PolyLine(Vertices=disc.Points, Closed=invert(False))
sort = SortList(Keys=num, ValuesA=angle.Angle)  # -> Keys, ValuesA
cull = CullPattern(List=explode.Vertices, CullPattern=smaller.SmallerThan)
item_2 = ListItem(List=sort.ValuesA, Index=Slider(10, range=0..10), Wrap=True)
panel_5 = Panel(sort.ValuesA)
pline_2 = PolyLine(Vertices=cull, Closed=False)
xy = XYPlane(Origin=Point(0, 0, 0))
crv_7 = Curve(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)
crv_8 = Curve(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)
xy_2 = XYPlane(Origin=Point(0, 0, 0))
crv_9 = Curve(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)
crv_10 = Curve(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)
vec_7 = Vector(crv_7)
vec_8 = Vector(crv_8)
angle_2 = Angle(VectorA=crv_10, VectorB=crv_9, Plane=xy_2)  # -> Angle, Reflex
angle_3 = Angle(VectorA=crv_7, VectorB=crv_8, Plane=xy)  # -> Angle, Reflex
deg = Degrees(Radians=angle_2.Angle)
deg_2 = Degrees(Radians=angle_3.Angle)
dprod = DotProduct(VectorA=vec_7, VectorB=vec_8, Unitize=False)
panel_6 = Panel([angle_2.Angle, deg])
multiplication_2 = Multiplication(A=vec_7, B=vec_8)
cos = Cosine(Value=angle_3.Angle)
panel_7 = Panel(dprod)
panel_8 = Panel(multiplication_2)
panel_9 = Panel(cos)
crv_11 = Curve(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)
crv_12 = Curve(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)
vec_9 = Vector(crv_11)
vec_10 = Vector(crv_12)
xy_3 = XYPlane(Origin=Point(0, 0, 0))
crv_13 = Curve(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)
crv_14 = Curve(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)
crv_15 = Curve([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])
angle_4 = Angle(VectorA=crv_13, VectorB=crv_14, Plane=xy_3)  # -> Angle, Reflex
join_3 = JoinCurves(Curves=crv_15, Preserve=False)
dprod_2 = DotProduct(VectorA=vec_10, VectorB=vec_9, Unitize=False)
multiplication_3 = Multiplication(A=vec_10, B=vec_9)
explode_4 = Explode(Curve=join_3, Recursive=True)  # -> Segments, Vertices
cos_2 = Cosine(Value=angle_4.Angle)
deg_3 = Degrees(Radians=angle_4.Angle)
shift_3 = ShiftList(List=explode_4.Segments, Shift="-1", Wrap=True)
panel_10 = Panel(dprod_2)
panel_11 = Panel(multiplication_3)
panel_12 = Panel(deg_3)
vec_11 = Vector(shift_3)
vec_12 = Vector(explode_4.Segments)
panel_13 = Panel(cos_2)
multiplication_4 = Multiplication(A=vec_12, B=vec_11)
smaller_2 = SmallerThan(FirstNumber=multiplication_4, SecondNumber="0")  # -> SmallerThan, OrEqualTo
crv_16 = Curve([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])
cull_2 = CullPattern(List=explode_4.Vertices, CullPattern=smaller_2.SmallerThan)
join_4 = JoinCurves(Curves=crv_16, Preserve=False)
pline_3 = PolyLine(Vertices=cull_2, Closed=False)
explode_5 = Explode(Curve=join_4, Recursive=True)  # -> Segments, Vertices
shift_4 = ShiftList(List=explode_5.Segments, Shift="-1", Wrap=True)
vec_13 = Vector(shift_4)
vec_14 = Vector(explode_5.Segments)
multiplication_5 = Multiplication(A=vec_14, B=vec_13)
smaller_3 = SmallerThan(FirstNumber=multiplication_5, SecondNumber="0")  # -> SmallerThan, OrEqualTo
cull_3 = CullPattern(List=explode_5.Vertices, CullPattern=smaller_3.SmallerThan)
pline_4 = PolyLine(Vertices=cull_3, Closed=False)
