# Grasshopper definition 03_Extruding a quadrilateral polyline according to given conditions..gh (Grasshopper 1.0.7)
# plug-ins: Human, ScriptParasite

# 3 Level - 03
crv = Curve([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])
crv_2 = Curve([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])
item = ListItem(List=crv_2, Index=0, Wrap=True)
neg = Negative(Value=Slider(0.2, range=0..1))
crv_3 = Curve([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])
number_slider = Slider(10, range=0..10)
item_2 = ListItem(List=crv_3, Index=0, Wrap=True)
crv_4 = Curve([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])
flip = FlipCurve(Curve=crv_2, Guide=item)  # -> Curve, Flag
offset = OffsetCurve(Curve=crv, Distance=neg, Corners=1)  # -> flatten(Curve)
crv_5 = Curve([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])
neg_2 = Negative(Value=Slider(0.2, range=0..1))
toggle = BooleanToggle(False)
neg_3 = Negative(Value=Slider(0.2, range=0..1))
runion = RegionUnion(Curves=crv_5)
flip_2 = FlipCurve(Curve=crv_3, Guide=item_2)  # -> Curve, Flag
neg_4 = Negative(Value=Slider(0.2, range=0..1))
area = Area(Geometry=offset)  # -> Area, Centroid
offset_2 = OffsetCurve(Curve=flip.Curve, Distance=neg_2, Corners=1)  # -> flatten(Curve)
offset_3 = OffsetCurve(Curve=crv_4, Distance=neg_3, Corners=1)  # -> flatten(Curve)
crv_6 = Curve([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])
colom = CollisionOneMany(Collider=crv_5, Obstacles=runion)  # -> Collision, Index
offset_4 = OffsetCurve(Curve=crv_5, Distance=neg_4, Corners=1)  # -> flatten(Curve)
avr = Average()
area_2 = Area(Geometry=offset_2)  # -> Area, Centroid
runion_2 = RegionUnion(Curves=crv_6)
area_3 = Area(Geometry=offset_3)  # -> Area, Centroid
cull = CullPattern(List=crv_5, CullPattern=colom.Collision)
runion_3 = RegionUnion()
area_4 = Area(Geometry=offset_4)  # -> Area, Centroid
dist = Distance(PointB=avr)
avr_2 = Average(Input=flatten(area_2.Centroid))
avr_3 = Average(Input=flatten(area_3.Centroid))
colom_2 = CollisionOneMany(Collider=crv_6, Obstacles=runion_2)  # -> Collision, Index
colom_3 = CollisionOneMany(Obstacles=runion_3)  # -> Collision, Index
crv_7 = Curve(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)
sort = SortList(Keys=dist, ValuesA=offset)  # -> Keys, ValuesA
lng = ListLength(List=cull)
dist_2 = Distance(PointA=area_2.Centroid, PointB=avr_2)
relay = Relay()
planar = IsPlanar(Surface=crv_7, Interior=True)  # -> Planar, Plane
dist_3 = Distance(PointA=area_3.Centroid, PointB=avr_3)
equals = Equality()  # -> Equality, Inequality
dispatch = Dispatch(DispatchPattern=colom_3.Collision)  # -> ListA, ListB
item_3 = ListItem(List=sort.ValuesA, Index=0, Wrap=True)
series = Series(Start=Slider(0.4, range=0..10), Step=Slider(2, range=0..10), Count=Slider(4, range=0..10))
number_slider_2 = Slider(3, range=0..10)
crv_cp = CurveClosestPoint(Point=area_4.Centroid, Curve=graft(runion))  # -> Point, Parameter, Distance
sort_2 = SortList(Keys=dist_2, ValuesA=offset_2)  # -> Keys, ValuesA
lng_2 = ListLength(List=dispatch.ListB)
disc = Discontinuity(Curve=crv_7, Level=1)  # -> Points, Parameters
sort_3 = SortList(Keys=dist_3, ValuesA=offset_3)  # -> Keys, ValuesA
planar_2 = Planar(Curve=crv_7)  # -> Planar, Plane, Deviation
area_5 = Area(Geometry=item_3)  # -> Area, Centroid
item_4 = ListItem(List=sort_2.ValuesA, Index=0, Wrap=True)
series_2 = Series(Start=Slider(0.4, range=0..10), Step=Slider(2, range=0..10), Count=Slider(4, range=0..10))
bool = Boolean(invert(lng_2))
item_5 = ListItem(List=sort_3.ValuesA, Index=0, Wrap=True)
series_3 = Series(Start=Slider(0.4, range=0..10), Step=Slider(2, range=0..10), Count=Slider(4, range=0..10))
line = LineSDL(Start=disc.Points, Direction=planar_2.Plane, Length=Slider(4.45, range=0..10))
scale = Scale(Geometry=item_3, Center=Point(0, 0, 0), Factor=series)  # -> Geometry, Transform
deplane = DeconstructPlane(Plane=item_3)  # -> Origin, XAxis, YAxis, ZAxis
boundary = BoundarySurfaces(Edges=sort_2.ValuesA)
sort_4 = SortList(Keys=crv_cp.Distance, ValuesA=offset_4)  # -> Keys, ValuesA
number_slider_3 = Slider(2, range=0..10)
panel = Panel("""1
8
16
24""")
scale_2 = Scale(Geometry=item_4, Center=avr_2, Factor=series_2)  # -> Geometry, Transform
scale_3 = Scale(Geometry=item_5, Center=avr_3, Factor=series_3)  # -> Geometry, Transform
partition = PartitionList(List=sort_4.ValuesA, Size=reverse(panel))
viewer = ParamViewer()
colom_4 = CollisionOneMany(Collider=sort_3.ValuesA, Obstacles=graft(scale_3.Geometry))  # -> Collision, Index
colom_5 = CollisionOneMany(Collider=boundary, Obstacles=graft(scale_2.Geometry))  # -> Collision, Index
crv_cp_2 = CurveClosestPoint(Point=relay, Curve=graft(scale.Geometry))  # -> Point, Parameter, Distance
planar_3 = IsPlanar(Interior=True)  # -> Planar, Plane
merge = Merge(
    Data1=ColourSwatch(SwatchColor=RGB(237, 68, 26)),
    Data2=ColourSwatch(SwatchColor=RGB(26, 153, 237)),
    Data3=ColourSwatch(SwatchColor=RGB(26, 237, 96)),
    Data4=ColourSwatch(SwatchColor=RGB(111, 26, 237)))
crv_8 = Curve(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)
number_slider_4 = Slider(2, range=0..10)
series_4 = Series(Start=number_slider_3, Step=number_slider_3, Count=Slider(4, range=0..10))
viewer_2 = ParamViewer(partition)
end = EndPoints(Curve=crv_8)  # -> Start, End
cull_2 = CullPattern(List=boundary, CullPattern=colom_5.Collision)
vec = Vector(crv_8)
cull_3 = CullPattern(List=sort_3.ValuesA, CullPattern=colom_4.Collision)
preview = CustomPreview(Geometry=scale_3.Geometry, Material=merge)
amp = Amplitude(Vector=planar_3.Plane, Amplitude=graft(series_4))
smaller = SmallerThan(FirstNumber=crv_cp_2.Distance, SecondNumber=Slider(3, range=0..10))  # -> SmallerThan, OrEqualTo
merge_2 = Merge(Data1=simplify(cull_3), Data2=item_5)
line_2 = LineSDL(Start=end.End, Direction=vec, Length=Slider(4.6, range=0..10))
viewer_3 = ParamViewer(cull_2)
series_5 = Series(Start=number_slider_4, Step=number_slider_4, Count=Slider(4, range=0..10))  # -> reverse(Series)
viewer_4 = ParamViewer(cull_3)
planar_4 = IsPlanar(Surface=cull_2, Interior=True)  # -> Planar, Plane
extr = Extrude(Direction=amp)
crv_9 = Curve(merge_2)
cull_4 = CullPattern(List=offset, CullPattern=smaller.SmallerThan)
viewer_5 = ParamViewer(merge_2)
amp_2 = Amplitude(Vector=planar_4.Plane, Amplitude=graft(series_5))
cap = CapHoles(Brep=extr)
number_slider_5 = Slider(2, range=0..10)
tstat = TreeStatistics(Tree=cull_4)  # -> Paths, Length, Count
preview_2 = CustomPreview(Geometry=crv_9, Material=graft(merge))
extr_2 = Extrude(Base=cull_2, Direction=amp_2)
previewmat = CustomPreviewMaterials(Geometry=cap, DiffuseColor=RGB(255, 255, 255))
cap_2 = CapHoles(Brep=extr_2)
series_6 = Series(Start=number_slider_5, Step=number_slider_5, Count=tstat.Count)  # -> reverse(Series)
previewmat_2 = CustomPreviewMaterials(Geometry=cap_2, DiffuseColor=RGB(255, 255, 255))
amp_3 = Amplitude(Vector=deplane.ZAxis, Amplitude=series_6)
extr_3 = Extrude(Base=cull_4, Direction=graft(amp_3))
cap_3 = CapHoles(Brep=extr_3)
crv_10 = Curve([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])
rider = RIder(openFile=Toggle(True))  # -> Folder; inputs openFile: Boolean
# ---------- rider: C# usings ----------
using System.IO;
using System.Diagnostics;

public class ScriptUtilities
{
  public static string GetCurrentFolder(GH_Document doc)
  {
    string filePath = doc.FilePath;
    return Path.GetDirectoryName(filePath);
  }

  public static string[] GetCsFiles(string folderPath)
  {
    return Directory.GetFiles(folderPath, "*.cs");
  }

  public static void OpenFileWithRider(string filePath, Action<string> print)
  {
    try
    {
      // Define the path to the JetBrains Rider executable
      string riderPath = @"C:\Program Files\JetBrains\JetBrains Rider 2024.1.4\bin\rider64.exe";

      if (!File.Exists(riderPath))
      {
        print("Rider executable not found at: " + riderPath);
        return;
      }

      // Start the process to open the file with Rider
      ProcessStartInfo startInfo = new ProcessStartInfo
        {
          FileName = riderPath,
          Arguments = "\"" + filePath + "\"", // Enclose in quotes in case of spaces
          UseShellExecute = true
          };
      Process.Start(startInfo);
    }
    catch (Exception ex)
    {
      print("Error opening file with Rider: " + ex.Message);
    }
  }

  public static void RunScript(bool openFile, ref object Here, IGH_Component owner, Action<string> print)
  {
    // Get the current folder path
    GH_Document doc = owner.OnPingDocument();
    string currentFolder = GetCurrentFolder(doc);
    Here = currentFolder;

    // Get .cs files in the current folder
    string[] csFiles = GetCsFiles(currentFolder);
    if (csFiles.Length > 0)
    {
      string csFilePath = csFiles[0];

      if (openFile)
      {
        OpenFileWithRider(csFilePath, print);
      }
    }
    else
    {
      print("No .cs files found in the directory.");
    }
  }
}
# ---------- rider: C# ----------
   ScriptUtilities.RunScript(openFile, ref Folder, Component, Print);
# ---------- end rider ----------
xy = XYPlane(Origin=Point(0, 0, 0))

c_script = CSharpScript(x=crv_10, y=xy)  # -> out, A; inputs x: list of Curve, y: Plane
# ---------- c_script: C# usings ----------
using System.Linq;
# ---------- c_script: C# ----------
    List<List<Curve>> ret = new List<List<Curve>>();
    for (int i = 0; i < 100; i++)
    {
      List<Curve> li = Curve.CreateBooleanUnion(x, 0.01).ToList();
      if (li.Count == 0) break;
      Curve tmp = li[0];
      List<Curve> include = new List<Curve>();
      List<Curve> exclusion = new List<Curve>();
      foreach (var j in x)
      {
        if (Curve.PlanarCurveCollision(tmp, j, y, 0.01))
        {
          include.Add(j);
        }
        else
        {
          exclusion.Add(j);
        }
      }

      ret.Add(include);
      x = exclusion; 
    }

    var result = makeDataTree(ret); 
    A = result;
# ---------- c_script: C# additional code ----------
  public static DataTree<T> makeDataTree<T>(List<List<T>> ret)
  {
    DataTree<T> tree = new DataTree<T>();
    for (int i = 0; i < ret.Count; i++)
    {
      GH_Path path = new GH_Path(i);
      for (int j = 0; j < ret[i].Count; j++)
      {

        tree.Add(ret[i][j], path);
      }
    }

    return tree;
  }
# ---------- end c_script ----------
scriptpar = ScriptParasite(Enable=Toggle(True), Folder=rider)

viewer_6 = ParamViewer(c_script.A)
crv_11 = Curve([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])
panel_2 = Panel(c_script.A)
neg_5 = Negative(Value=Slider(0.2, range=0..1))
offset_5 = OffsetCurve(Curve=crv_11, Distance=neg_5, Corners=1)  # -> flatten(Curve)
area_6 = Area(Geometry=offset_5)  # -> Area, Centroid
avr_4 = Average(Input=flatten(area_6.Centroid))
dist_4 = Distance(PointA=area_6.Centroid, PointB=avr_4)
sort_5 = SortList(Keys=dist_4, ValuesA=offset_5)  # -> Keys, ValuesA
series_7 = Series(Start=Slider(0.4, range=0..10), Step=Slider(2, range=0..10), Count=Slider(4, range=0..10))
item_6 = ListItem(List=sort_5.ValuesA, Index=0, Wrap=True)
scale_4 = Scale(Geometry=item_6, Center=avr_4, Factor=series_7)  # -> Geometry, Transform
crv_cp_3 = CurveClosestPoint(Point=area_6.Centroid, Curve=graft(scale_4.Geometry))  # -> Point, Parameter, Distance
smaller_2 = SmallerThan(FirstNumber=crv_cp_3.Distance, SecondNumber=Slider(3, range=0..10))  # -> SmallerThan, OrEqualTo
number_slider_6 = Slider(2, range=0..10)
cull_5 = CullPattern(List=offset_5, CullPattern=smaller_2.SmallerThan)
tstat_2 = TreeStatistics(Tree=cull_5)  # -> Paths, Length, Count
series_8 = Series(Start=number_slider_6, Step=number_slider_6, Count=tstat_2.Count)  # -> reverse(Series)
amp_4 = Amplitude(Vector=item_6, Amplitude=series_8)
extr_4 = Extrude(Base=cull_5, Direction=graft(amp_4))
cap_4 = CapHoles(Brep=extr_4)
