# Grasshopper definition 04_Creating a tree branch shape using the given line.gh (Grasshopper 1.0.7)
# plug-ins: ScriptParasite

number_slider = Slider(6, range=0..10)
number_slider_2 = Slider(6, range=0..10)
xy = XYPlane(Origin=Point(0, 0, 0))
X = UnitX(Factor=1)
# 3 Level - 04
xy_2 = XYPlane(Origin=Point(0, 0, 0))
range = Range(Domain=Domain(0, 1), Steps=expr("x-1", number_slider))
X_2 = UnitX(Factor=1)
line = LineSDL(Start=xy_2, Direction=X, Length=Slider(10, range=0..10))
series = Series(Start=Slider(0, range=0..10), Step=Slider(3.5, range=0..10), Count=number_slider_2)
graph = GraphMapper(
    range,
    x0=0,
    x1=1,
    y0=0,
    y1=1,
    container_name="Bezier",
    cpx=[0, 0.299689889, 0.6259439588, 1],
    cpy=[0, 0.369762063, 0.6129698753, 1])
line_2 = LineSDL(Start=xy, Direction=X_2, Length=Slider(20, range=0..20))
Z = UnitZ(Factor=series)
bnd = Bounds(Numbers=graph)
move = Move(Geometry=line, Motion=Z)  # -> Geometry, Transform
remap = RemapNumbers(Value=graph, Source=bnd, Target=Slider(30, range=0..30))  # -> Mapped, Clipped
series_2 = Series(Start=0, Step=1, Count=number_slider_2)
_2º = PowerOf2(Value=series_2)
Z_2 = UnitZ(Factor=remap.Mapped)
move_2 = Move(Geometry=line_2, Motion=Z_2)  # -> Geometry, Transform
divide = DivideCurve(Curve=move.Geometry, Count=_2º, Kinks=False)  # -> Points, Tangents, Parameters
series_3 = Series(Start=0, Step=1, Count=number_slider)
_2º_2 = PowerOf2(Value=series_3)
shatter = Shatter(Curve=graft(move.Geometry), Parameters=divide.Parameters)
divide_2 = DivideCurve(Curve=move_2.Geometry, Count=_2º_2, Kinks=False)  # -> Points, Tangents, Parameters
midpt = CurveMiddle(Curve=shatter)
shatter_2 = Shatter(Curve=graft(move_2.Geometry), Parameters=divide_2.Parameters)
tstat = TreeStatistics(Tree=midpt)  # -> Paths, Length, Count
midpt_2 = CurveMiddle(Curve=shatter_2)
shift = ShiftList(List=tstat.Paths, Shift=1, Wrap=invert(True))
tstat_2 = TreeStatistics(Tree=midpt_2)  # -> Paths, Length, Count
short = ShortestList(ListA=tstat.Paths, ListB=shift, TrimMode=2)  # -> ListA, ListB
shift_2 = ShiftList(List=tstat_2.Paths, Shift=1, Wrap=invert(True))
branch = TreeBranch(Tree=midpt, Path=short.ListA, MaintainPaths=True)
branch_2 = TreeBranch(Tree=midpt, Path=short.ListB, MaintainPaths=True)
short_2 = ShortestList(ListA=tstat_2.Paths, ListB=shift_2, TrimMode=2)  # -> ListA, ListB
cps = ClosestPoints(Point=branch, Cloud=branch_2, Count="2")  # -> ClosestPoint, CPIndex, Distance
branch_3 = TreeBranch(Tree=midpt_2, Path=short_2.ListA, MaintainPaths=True)
branch_4 = TreeBranch(Tree=midpt_2, Path=short_2.ListB, MaintainPaths=True)
ln = Line(StartPoint=graft(branch), EndPoint=cps.ClosestPoint)
cps_2 = ClosestPoints(Point=branch_3, Cloud=branch_4, Count="2")  # -> ClosestPoint, CPIndex, Distance
pshift = ShiftPaths(Data=ln, Offset=-1)  # -> simplify(Data)
ln_2 = Line(StartPoint=graft(branch_3), EndPoint=cps_2.ClosestPoint)
dom = ConstructDomain(DomainStart=Slider(0.3, range=0..1), DomainEnd=Slider(0.1, range=0..0.1))
tstat_3 = TreeStatistics(Tree=pshift)  # -> Paths, Length, Count
panel = Panel(branch_4)
range_2 = Range(Domain=dom, Steps=expr("x - 1", tstat_3.Count))  # -> graft(Range)
pipe = Pipe(Curve=pshift, Radius=range_2, Caps=0)
cap = CapHoles(Brep=pipe)
xy_3 = XYPlane(Origin=Point(0, 0, 0))
range_3 = Range(Domain=Domain(0, 1), Steps=expr("x-1", Slider(6, range=0..10)))
X_3 = UnitX(Factor=1)
graph_2 = GraphMapper(
    range_3,
    x0=0,
    x1=1,
    y0=0,
    y1=1,
    container_name="Bezier",
    cpx=[0, 0.299689889, 0.6259439588, 1],
    cpy=[0, 0.369762063, 0.6129698753, 1])
line_3 = LineSDL(Start=xy_3, Direction=X_3, Length=Slider(20, range=0..20))
bnd_2 = Bounds(Numbers=graph_2)
remap_2 = RemapNumbers(Value=graph_2, Source=bnd_2, Target=Slider(30, range=0..30))  # -> Mapped, Clipped
toggle = BooleanToggle(True)
Z_3 = UnitZ(Factor=remap_2.Mapped)
move_3 = Move(Geometry=line_3, Motion=Z_3)  # -> Geometry, Transform
rider = RIder(openFile=toggle)  # -> Folder; inputs openFile: Boolean
# ---------- rider: C# usings ----------
using System.IO;
using System.Diagnostics;

public class ScriptUtilities
{
  public static string GetCurrentFolder(GH_Document doc)
  {
    string filePath = doc.FilePath;
    return Path.GetDirectoryName(filePath);
  }

  public static string[] GetCsFiles(string folderPath)
  {
    return Directory.GetFiles(folderPath, "*.cs");
  }

  public static void OpenFileWithRider(string filePath, Action<string> print)
  {
    try
    {
      // Define the path to the JetBrains Rider executable
      string riderPath = @"C:\Program Files\JetBrains\JetBrains Rider 2024.1.4\bin\rider64.exe";

      if (!File.Exists(riderPath))
      {
        print("Rider executable not found at: " + riderPath);
        return;
      }

      // Start the process to open the file with Rider
      ProcessStartInfo startInfo = new ProcessStartInfo
        {
          FileName = riderPath,
          Arguments = "\"" + filePath + "\"", // Enclose in quotes in case of spaces
          UseShellExecute = true
          };
      Process.Start(startInfo);
    }
    catch (Exception ex)
    {
      print("Error opening file with Rider: " + ex.Message);
    }
  }

  public static void RunScript(bool openFile, ref object Here, IGH_Component owner, Action<string> print)
  {
    // Get the current folder path
    GH_Document doc = owner.OnPingDocument();
    string currentFolder = GetCurrentFolder(doc);
    Here = currentFolder;

    // Get .cs files in the current folder
    string[] csFiles = GetCsFiles(currentFolder);
    if (csFiles.Length > 0)
    {
      string csFilePath = csFiles[0];

      if (openFile)
      {
        OpenFileWithRider(csFilePath, print);
      }
    }
    else
    {
      print("No .cs files found in the directory.");
    }
  }
}
# ---------- rider: C# ----------
   ScriptUtilities.RunScript(openFile, ref Folder, Component, Print);
# ---------- end rider ----------

c_script = CSharpScript(x=move_3.Geometry)  # -> out, A; inputs x: list of Line
# ---------- c_script: C# usings ----------
using System.Linq;
# ---------- c_script: C# ----------
    //divide the line by 2 square
    List<List<Point3d>> pt = new List<List<Point3d>>();
    int cnt = 2;
    for (int i = 0; i < x.Count; i++)
    {
      Curve tmp = x[i].ToNurbsCurve(); 
      var li = tmp.DivideByCount(cnt, true);
      List<Point3d> loc = new List<Point3d>();
      //choose odd index and input the loc List
      for (int j = 1; j < li.Length; j += 2)
      {
        loc.Add(tmp.PointAt(li[j])); 
      }
      pt.Add(loc);
      cnt *= 2; 
    }
    
    //I want to get for the answer
    List<List<Line>> ans = new List<List<Line>>(); 
    
    
    //Select some Point to others points
    for (int i = 0; i < x.Count - 1; i++)
    {
      List<Point3d> st = pt[i];
      List<Point3d> en = pt[i + 1];
      List<Line> liL = new List<Line>(); 
      for (int j = 0; j < st.Count; j++)
      {
        Point3d now = st[j];
        en.Sort((u, v) => u.DistanceTo(now).CompareTo(v.DistanceTo(now)));
        for (int k = 0; k < 2; k++)
        {
          liL.Add(new Line(now, en[k])); 
        }
      }

      ans.Add(liL); 
    }

    var ptLoc = makeDataTree(pt);
    var liLoc = makeDataTree(ans); 
    A = liLoc;
# ---------- c_script: C# additional code ----------
  public static DataTree<T> makeDataTree<T>(List<List<T>> ret)
  {
    DataTree<T> tree = new DataTree<T>();
    for (int i = 0; i < ret.Count; i++)
    {
      GH_Path path = new GH_Path(i);
      for (int j = 0; j < ret[i].Count; j++)
      {

        tree.Add(ret[i][j], path);
      }
    }

    return tree;
  }
# ---------- end c_script ----------
scriptpar = ScriptParasite(Enable=toggle, Folder=rider)
