# Grasshopper definition 05_Data Tree - Shift Paths.gh (Grasshopper 1.0.7)
# plug-ins: Human, ScriptParasite

crv = Curve([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])
panel = Panel(crv)
divide = DivideCurve(Curve=crv, Count="2", Kinks=False)  # -> Points, Tangents, Parameters
viewer = ParamViewer(divide.Points)
cir = Circle(Plane=divide.Points, Radius="5")
toggle = BooleanToggle(True)
number_slider = Slider(1, range=0..10)
divide_2 = DivideCurve(Curve=cir, Count=Slider(8, range=0..10), Kinks=False)  # -> Points, Tangents, Parameters
crv_2 = Curve([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])
viewer_2 = ParamViewer(cir)
cir_2 = Circle(Plane=divide_2.Points, Radius="1")
tstat = TreeStatistics(Tree=cir_2)  # -> Paths, Length, Count
rider = RIder(openFile=toggle)  # -> Folder; inputs openFile: Boolean
# ---------- rider: C# usings ----------
using System.IO;
using System.Diagnostics;

public class ScriptUtilities
{
  public static string GetCurrentFolder(GH_Document doc)
  {
    string filePath = doc.FilePath;
    return Path.GetDirectoryName(filePath);
  }

  public static string[] GetCsFiles(string folderPath)
  {
    return Directory.GetFiles(folderPath, "*.cs");
  }

  public static void OpenFileWithRider(string filePath, Action<string> print)
  {
    try
    {
      // Define the path to the JetBrains Rider executable
      string riderPath = @"C:\Program Files\JetBrains\JetBrains Rider 2024.1.4\bin\rider64.exe";

      if (!File.Exists(riderPath))
      {
        print("Rider executable not found at: " + riderPath);
        return;
      }

      // Start the process to open the file with Rider
      ProcessStartInfo startInfo = new ProcessStartInfo
        {
          FileName = riderPath,
          Arguments = "\"" + filePath + "\"", // Enclose in quotes in case of spaces
          UseShellExecute = true
          };
      Process.Start(startInfo);
    }
    catch (Exception ex)
    {
      print("Error opening file with Rider: " + ex.Message);
    }
  }

  public static void RunScript(bool openFile, ref object Here, IGH_Component owner, Action<string> print)
  {
    // Get the current folder path
    GH_Document doc = owner.OnPingDocument();
    string currentFolder = GetCurrentFolder(doc);
    Here = currentFolder;

    // Get .cs files in the current folder
    string[] csFiles = GetCsFiles(currentFolder);
    if (csFiles.Length > 0)
    {
      string csFilePath = csFiles[0];

      if (openFile)
      {
        OpenFileWithRider(csFilePath, print);
      }
    }
    else
    {
      print("No .cs files found in the directory.");
    }
  }
}
# ---------- rider: C# ----------
   ScriptUtilities.RunScript(openFile, ref Folder, Component, Print);
# ---------- end rider ----------
item = ListItem(List=tstat.Length, Index=0, Wrap=True)
series = Series(Start=number_slider, Step=number_slider, Count=item)  # -> simplify(graft(Series))
viewer_3 = ParamViewer(tstat.Length)

c_script = CSharpScript(x=crv_2, y=Slider(5, range=0..10), z=Slider(10, range=0..10), w=Slider(5, range=0..10), u=Slider(3, range=0..10))  # -> out, simplify(A); inputs x: list of Curve, y: Int32, z: Int32, w: Int32, u: Int32
# ---------- c_script: C# usings ----------
using System.IO.Pipes;
using System.Linq;
# ---------- c_script: C# ----------
    List<List<Point3d>> llp = new List<List<Point3d>>();
    for (int i = 0; i < 3; i++)
    {
      llp.Add(DividePts(x[i], 2, true)); 
    }

    List<List<List<Surface>>> llls = new List<List<List<Surface>>>();
    for (int i = 0; i < 3; i++)
    {
      List<List<Surface>> lls = new List<List<Surface>>();
      for (int j = 0; j < 3; j++)
      {
        Curve c = new Circle(llp[i][j], y).ToNurbsCurve();
        List<Point3d> lp = DividePts(c, z, true);
        List<Surface> ls = new List<Surface>();
        for (int k = 0; k < lp.Count; k++)
        {
          Curve tmp = new Circle(lp[k], 1).ToNurbsCurve(); 
          Surface s = Surface.CreateExtrusion(tmp, new Vector3d(0, 0, w));
          ls.Add(s); 
        }

        w += u; 
        lls.Add(ls); 
      }

      llls.Add(lls); 
    }

    A = MakeDataTree3D(llls);
# ---------- c_script: C# additional code ----------
  public static List<Point3d> DividePts(Curve crv, int cnt, bool end)
  {
    List<Point3d> ret = new List<Point3d>();
    var crvT = crv.DivideByCount(cnt, end);
    for (int i = 0; i < crvT.Length; i++)
    {
      var pt = crv.PointAt(crvT[i]);
      ret.Add(pt);
    }

    return ret;
  }

  public static DataTree<T> MakeDataTree3D<T>(List<List<List<T>>> ret)
  {
    DataTree<T> tree = new DataTree<T>();
    for (int i = 0; i < ret.Count; i++)
    {
      for (int j = 0; j < ret[i].Count; j++)
      {
        for (int k = 0; k < ret[i][j].Count; k++)
        {
          GH_Path path = new GH_Path(0, i, j);
          tree.Add(ret[i][j][k], path);
        }
      }
    }

    return tree;
  }
# ---------- end c_script ----------
scriptpar = ScriptParasite(Enable=toggle, Folder=rider)

Z = UnitZ(Factor=series)
extr = Extrude(Base=cir_2, Direction=Z)
panel_2 = Panel(c_script.A)
c_script_2 = CSharpScript(X=c_script.A)  # -> Out, A
cap = CapHoles(Brep=extr)
previewmat = CustomPreviewMaterials(Geometry=cap, DiffuseColor=RGB(255, 255, 255))
panel_3 = Panel(series)
viewer_4 = ParamViewer(series)
