# Grasshopper definition 06_Converting the given line into a flat surface.gh (Grasshopper 1.0.7)
# plug-ins: ScriptParasite

toggle = BooleanToggle(True)  # disabled
number_slider = Slider(5, range=0..100)  # disabled
number_slider_2 = Slider(3, range=0..10)  # disabled
toggle_2 = BooleanToggle(True)  # disabled
number_slider_3 = Slider(5, range=0..100)  # disabled
rider = RIder(openFile=toggle)  # -> Folder; inputs openFile: Boolean; disabled
# ---------- rider: C# usings ----------
using System.IO;
using System.Diagnostics;

public class ScriptUtilities
{
  public static string GetCurrentFolder(GH_Document doc)
  {
    string filePath = doc.FilePath;
    return Path.GetDirectoryName(filePath);
  }

  public static string[] GetCsFiles(string folderPath)
  {
    return Directory.GetFiles(folderPath, "*.cs");
  }

  public static void OpenFileWithRider(string filePath, Action<string> print)
  {
    try
    {
      // Define the path to the JetBrains Rider executable
      string riderPath = @"C:\Program Files\JetBrains\JetBrains Rider 2024.1.4\bin\rider64.exe";

      if (!File.Exists(riderPath))
      {
        print("Rider executable not found at: " + riderPath);
        return;
      }

      // Start the process to open the file with Rider
      ProcessStartInfo startInfo = new ProcessStartInfo
        {
          FileName = riderPath,
          Arguments = "\"" + filePath + "\"", // Enclose in quotes in case of spaces
          UseShellExecute = true
          };
      Process.Start(startInfo);
    }
    catch (Exception ex)
    {
      print("Error opening file with Rider: " + ex.Message);
    }
  }

  public static void RunScript(bool openFile, ref object Here, IGH_Component owner, Action<string> print)
  {
    // Get the current folder path
    GH_Document doc = owner.OnPingDocument();
    string currentFolder = GetCurrentFolder(doc);
    Here = currentFolder;

    // Get .cs files in the current folder
    string[] csFiles = GetCsFiles(currentFolder);
    if (csFiles.Length > 0)
    {
      string csFilePath = csFiles[0];

      if (openFile)
      {
        OpenFileWithRider(csFilePath, print);
      }
    }
    else
    {
      print("No .cs files found in the directory.");
    }
  }
}
# ---------- rider: C# ----------
   ScriptUtilities.RunScript(openFile, ref Folder, Component, Print);
# ---------- end rider ----------
planar = Planar()  # -> Planar, Plane, Deviation; disabled
crv = Curve([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])  # disabled
crv_2 = Curve([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])  # disabled
rider_2 = RIder(openFile=toggle_2)  # -> Folder; inputs openFile: Boolean; disabled; same code as rider
lng = ListLength()  # disabled
planar_2 = Planar()  # -> Planar, Plane, Deviation; disabled
lng_2 = ListLength()  # disabled

scriptpar = ScriptParasite(Enable=toggle, Folder=rider)  # disabled
c_script = CSharpScript(x=crv_2, y=number_slider_2)  # -> out, A, B; inputs x: list of Curve, y: Int32; disabled
# ---------- c_script: C# usings ----------
using System.Linq;
# ---------- c_script: C# ----------
    
      Dictionary<Plane, List<Curve>> coplanarGroups = new Dictionary<Plane, List<Curve>>();
      List<Curve> checkLinear = new List<Curve>();

      for (int i = 0; i < x.Count; i++)
      {
        if (x[i].IsLinear())
        {
          checkLinear.Add(x[i]);
        }
        else
        {
          Plane curvePlane;
          if (x[i].TryGetPlane(out curvePlane, 0.01))
          {
            bool found = false;

            // 이미 존재하는 평면인지 확인
            foreach (var plane in coplanarGroups.Keys)
            {
              if (ArePlanesEqual(plane, curvePlane))
              {
                coplanarGroups[plane].Add(x[i]);
                found = true;
                break;
              }
            }

            // 존재하지 않으면 새로운 그룹에 추가
            if (!found)
            {
              coplanarGroups[curvePlane] = new List<Curve> { x[i] };
            }
          }
        }
      }

      x = checkLinear;
      for (int i = 0; i < 10000; i++)
      {
        List<Curve> bucket = new List<Curve>();
        if (x.Count >= 3)
        {
          List<Curve> rdCurve = new List<Curve>();
          List<bool> vis = Enumerable.Repeat(false, x.Count).ToList();
          while (rdCurve.Count < 3)
          {
            int now = GetRandomInt(0, x.Count - 1);
            if (vis[now] == false)
            {
              rdCurve.Add(x[now]);
              vis[now] = true;
            }
          }

          var ok = CheckCoplanar(rdCurve);


          if (ok.Item1 == true)
          {
            bool found = false;
            foreach (var plane in coplanarGroups.Keys)
            {
              if (ArePlanesEqual(plane, ok.Item2))
              {
                coplanarGroups[plane].AddRange(rdCurve);
                found = true;
                break;
              }
            }

            if (!found)
            {
              coplanarGroups[ok.Item2] = rdCurve;
            }

            for(int j = 0; j < x.Count(); j++)
            {
              if(vis[j]) continue;
              var curve = x[j];
              Vector3d v = new Line(curve.PointAtStart, curve.PointAtEnd).Direction;
              foreach (var g in coplanarGroups)
              {
                if (Math.Abs(Vector3d.Multiply(g.Key.Normal, v)) < 0.1)
                {
                  if (IsCurveOnPlane(curve, g.Key, 1))
                  {
                    g.Value.Add(curve);
                    vis[j] = true;
                    break;
                  }
                }
                else
                {
                  Print(Vector3d.Multiply(g.Key.Normal, v).ToString());
                }
              }
            }
          }


          for (int j = 0; j < x.Count; j++)
          {
            if ((vis[j] == true) && (ok.Item1 == true)) continue;
            bucket.Add(x[j]);
          }
        }
        else
        {
          break;
        }

        x = bucket;
      }


      List<List<Curve>> ans = new List<List<Curve>>();
      foreach (var g in coplanarGroups)
      {
        ans.Add(g.Value);
      }

      A = MakeDataTree2D(ans);
# ---------- c_script: C# additional code ----------
    public static DataTree<T> MakeDataTree2D<T > (List < List < T >> ret)
    {
      DataTree<T> tree = new DataTree<T>();
      for (int i = 0; i < ret.Count; i++)
      {
        GH_Path path = new GH_Path(i);
        for (int j = 0; j < ret[i].Count; j++)
        {
          tree.Add(ret[i][j], path);
        }
      }

      return tree;
    }

    private bool ArePlanesEqual(Plane plane1, Plane plane2)
    {
      bool normalsAreParallel = plane1.Normal.IsParallelTo(plane2.Normal, 0.1) == 1;
      double distanceDifference = Math.Abs(plane1.DistanceTo(Point3d.Origin) - plane2.DistanceTo(Point3d.Origin));

      return normalsAreParallel && distanceDifference < 1;
    }


    public Tuple<bool, Plane> CheckCoplanar(List < Curve > crves)
    {
      if (crves.Count != 3)
      {
        throw new ArgumentException("This function requires exactly three curves.");
      }

      // 1. 방향 벡터 리스트 생성
      Point3d point1 = RoundPoint(crves[0].PointAtStart);
      Point3d point2 = RoundPoint(crves[1].PointAtStart);

      Vector3d direction1 = new Line(point1, RoundPoint(crves[0].PointAtEnd)).Direction;
      Vector3d direction2 = new Line(point2, RoundPoint(crves[1].PointAtEnd)).Direction;

      // 2. 법선 벡터 계산 (두 직선의 방향 벡터의 외적)
      Vector3d normal = Vector3d.CrossProduct(direction1, direction2);
      normal.Unitize();
      normal.X = Math.Round(normal.X, 3) * 1e3;
      normal.Y = Math.Round(normal.Y, 3) * 1e3;
      normal.Z = Math.Round(normal.Z, 3) * 1e3;

      if (normal.IsZero)
      {
        return new Tuple<bool, Plane>(false, Plane.Unset); // 두 벡터가 평행하면 평면을 정의할 수 없음
      }

      double D = -(normal.X * point1.X + normal.Y * point1.Y + normal.Z * point1.Z);
      // 5. 두 번째 직선이 이 평면에 포함되는지 확인 (허용 오차 사용)
      double distanceToPlane = normal.X * point2.X + normal.Y * point2.Y + normal.Z * point2.Z + D;


      if (Math.Abs(distanceToPlane) > 1e2)
      {
        return new Tuple<bool, Plane>(false, Plane.Unset); // 두 번째 직선이 평면에 속하지 않음
      }

      // 6. 세 번째 직선이 동일한 평면에 있는지 확인 (허용 오차 사용)
      Point3d testPointStart = RoundPoint(crves[2].PointAtStart);
      Point3d testPointEnd = RoundPoint(crves[2].PointAtEnd);

      double distanceToPlaneStart =
        normal.X * testPointStart.X + normal.Y * testPointStart.Y + normal.Z * testPointStart.Z + D;
      double distanceToPlaneEnd = normal.X * testPointEnd.X + normal.Y * testPointEnd.Y + normal.Z * testPointEnd.Z + D;

      if (Math.Abs(distanceToPlaneStart) > 1e2 || Math.Abs(distanceToPlaneEnd) > 1e2)
      {
        return new Tuple<bool, Plane>(false, Plane.Unset); // 세 번째 직선이 평면에 속하지 않음
      }

      // 7. 평면을 정의하고 반환
      Plane plane = new Plane(RoundPoint(point1), normal);
      return new Tuple<bool, Plane>(true, plane);
    }

    private bool IsCurveOnPlane(Curve curve, Plane plane, double tolerance = 0.01)
    {
      // 곡선의 양 끝점 구하기
      Point3d startPoint = RoundPoint(curve.PointAtStart);
      Point3d endPoint = RoundPoint(curve.PointAtEnd);

      // 시작점과 끝점이 평면에 포함되는지 여부 확인
      double distanceToStart = plane.DistanceTo(startPoint);
      double distanceToEnd = plane.DistanceTo(endPoint);

      // 두 점이 모두 평면에 포함되는지 확인
      return Math.Abs(distanceToStart) <= tolerance && Math.Abs(distanceToEnd) <= tolerance;
    }

    private static Point3d RoundPoint(Point3d point)
    {
      return new Point3d(
        Math.Round(point.X, 3),
        Math.Round(point.Y, 3),
        Math.Round(point.Z, 3)
        );
    }

    private int GetRandomInt(int l = 0, int r = int.MaxValue)
    {
      Random rd = new Random(GetSeed());
      return rd.Next(l, r + 1); // Next method in C# is exclusive of the upper bound, so add 1
    }

    // Function to get a random double between l and r
    private double GetRandomDouble(double l = 0.0, double r = 1.0)
    {
      Random rd = new Random(GetSeed());
      return rd.NextDouble() * (r - l) + l;
    }

    // Function to get a time-based seed
    private int GetSeed()
    {
      long seed = DateTime.UtcNow.Ticks;
      return (int) (seed & 0xFFFFFFFF) ^ (int) (seed >> 32); // Combine lower and upper bits for the seed
    }
# ---------- end c_script ----------

scriptpar_2 = ScriptParasite(Enable=toggle_2, Folder=rider_2)  # disabled
c_script_2 = CSharpScript(x=crv, y=number_slider_3)  # -> out, A; inputs x: list of Curve, y: Int32; disabled
# ---------- c_script_2: C# ----------
    
      Dictionary<string, List<Curve>> coplanarGroups = new Dictionary<string, List<Curve>>();
      List<Curve> checkLinear = new List<Curve>();

      // 첫 번째 반복: 직선과 곡선을 구분
      for (int i = 0; i < x.Count; i++)
      {
        if (x[i].IsLinear())
        {
          checkLinear.Add(x[i]);
        }
        else
        {
          Plane curvePlane;
          if (x[i].TryGetPlane(out curvePlane, Rhino.RhinoMath.ZeroTolerance))
          {
            // 법선 벡터와 원점에서의 최단 거리를 기반으로 키 생성
            string planeKey = GeneratePlaneKey(curvePlane.Normal, curvePlane.DistanceTo(Point3d.Origin));

            // 이미 키가 존재하는지 확인 후, 곡선을 추가
            if (coplanarGroups.ContainsKey(planeKey))
            {
              coplanarGroups[planeKey].Add(x[i]);
            }
            else
            {
              coplanarGroups[planeKey] = new List<Curve> { x[i] };
            }
          }
        }
      }

      // 두 번째 반복: 남은 직선을 기존 그룹에 추가
      for (int i = 0; i < checkLinear.Count; i++)
      {
        Line li = new Line(checkLinear[i].PointAtStart, checkLinear[i].PointAtEnd);

        // 각 그룹의 법선 벡터와 현재 직선의 방향 벡터를 비교
        foreach (var g in coplanarGroups)
        {
          string[] keyParts = g.Key.Split('_');
          Vector3d normal = new Vector3d(double.Parse(keyParts[0]), double.Parse(keyParts[1]), double.Parse(keyParts[2]));

          // 직선의 방향 벡터와 법선 벡터가 평행한지 확인
          if (Math.Abs(Vector3d.Multiply(normal, li.Direction)) <= RhinoMath.ZeroTolerance)
          {
            coplanarGroups[g.Key].Add(checkLinear[i]);
            break;
          }
        }
      }

      // 결과를 데이터 트리로 변환
      List<List<Curve>> ans = new List<List<Curve>>();
      foreach (var g in coplanarGroups)
      {
        ans.Add(g.Value);
      }
      A = MakeDataTree2D(ans);
# ---------- c_script_2: C# additional code ----------
    private static string GeneratePlaneKey(Vector3d normal, double distance)
    {
      normal.Unitize();  // 법선 벡터를 정규화

      // 법선 벡터와 최단 거리 값을 기반으로 고유 키 생성 (소수점 이하 6자리로 반올림)
      string key = string.Format("{0}_{1}_{2}_{3}",
        Math.Round(normal.X, 6),
        Math.Round(normal.Y, 6),
        Math.Round(normal.Z, 6),
        Math.Round(distance, 6));
      return key;
    }

    public static DataTree<T> MakeDataTree2D<T > (List < List < T >> ret)
    {
      DataTree<T> tree = new DataTree<T>();
      for (int i = 0; i < ret.Count; i++)
      {
        GH_Path path = new GH_Path(i);
        for (int j = 0; j < ret[i].Count; j++)
        {
          tree.Add(ret[i][j], path);
        }
      }
      return tree;
    }

    private int GetRandomInt(int l = 0, int r = int.MaxValue)
    {
      Random rd = new Random(GetSeed());
      return rd.Next(l, r + 1); // Next method in C# is exclusive of the upper bound, so add 1
    }

    private double GetRandomDouble(double l = 0.0, double r = 1.0)
    {
      Random rd = new Random(GetSeed());
      return rd.NextDouble() * (r - l) + l;
    }

    private int GetSeed()
    {
      long seed = DateTime.UtcNow.Ticks;
      return (int) (seed & 0xFFFFFFFF) ^ (int) (seed >> 32); // Combine lower and upper bits for the seed
    }
# ---------- end c_script_2 ----------

number_slider_4 = Slider(11, range=0..100)  # disabled
tstat = TreeStatistics(Tree=c_script.A)  # -> Paths, Length, Count; disabled
number_slider_5 = Slider(23, range=0..100)  # disabled
tstat_2 = TreeStatistics(Tree=c_script_2.A)  # -> Paths, Length, Count; disabled
panel = Panel(c_script_2.out)  # disabled
item = ListItem(List=tstat.Paths, Index=number_slider_4, Wrap=True)  # disabled
panel_2 = Panel(c_script_2.A)  # disabled
item_2 = ListItem(List=tstat_2.Paths, Index=number_slider_5, Wrap=True)  # disabled
branch = TreeBranch(Tree=c_script.A, Path=item, MaintainPaths=True)  # disabled
branch_2 = TreeBranch(Tree=c_script_2.A, Path=item_2, MaintainPaths=True)  # disabled
panel_3 = Panel(c_script.A)  # disabled
panel_4 = Panel(c_script.out)  # disabled
crv_3 = Curve([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])
crv_4 = Curve([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])
# 3 Level - 17
crv_5 = Curve([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])
item_3 = ListItem(List=crv_3, Index=0, Wrap=True)  # -> Item, Item1
mcx = MultipleCurves(Curves=crv_3)  # -> Points, IndexA, IndexB, ParamA, ParamB
item_4 = ListItem(List=crv_4, Index=0, Wrap=True)  # -> Item, Item1
mcx_2 = MultipleCurves(Curves=crv_5)  # -> Points, IndexA, IndexB, ParamA, ParamB
mcx_3 = MultipleCurves(Curves=crv_4)  # -> Points, IndexA, IndexB, ParamA, ParamB
ccx = CurveCurve(CurveA=item_3.Item, CurveB=item_3.Item1)  # -> Points, ParamsA, ParamsB
bbox = BoundingBox(Content=mcx.Points, Plane=PlaneXY(0, 0, 0), UnionBox=True)  # -> Box, Box_2
ccx_2 = CurveCurve(CurveA=item_4.Item, CurveB=item_4.Item1)  # -> Points, ParamsA, ParamsB
avr = Average(Input=mcx.Points)
avr_2 = Average(Input=mcx_2.Points)
pl = ConstructPlane(Origin=ccx.Points, XAxis=item_3.Item, YAxis=item_3.Item1)
pl_2 = ConstructPlane(Origin=ccx_2.Points, XAxis=item_4.Item, YAxis=item_4.Item1)
debox = DeconstructBox(Box=bbox.Box)  # -> Plane, X, Y, Z
box = EvaluateBox(Box=bbox.Box, UParameter=0.5, VParameter=0.5, WParameter=Slider(0.5, range=0..1))  # -> Plane, Point, Include
cir = Circle(Plane=avr_2, Radius=1)
cp = PlaneClosestPoint(Point=mcx_3.Points, Plane=pl_2)  # -> Point, UVPoint, Distance
num = Number(debox.Z)
pl_origin = PlaneOrigin(Base=pl, Origin=box.Point)
alongcrv = SortAlongCurve(Points=mcx_2.Points, Curve=cir)  # -> Points, Indices
sort = SortList(Keys=cp.Distance, ValuesA=mcx_3.Points)  # -> Keys, ValuesA
vec = Vector(pl_origin)
neg = Negative(Value=num)
item_5 = ListItem(List=mcx_2.Points, Index=alongcrv.Indices, Wrap=True)
line = LineSDL(Start=pl_origin, Direction=vec, Length=flatten([num, neg]))
int = Integer(sort.Keys)
partition = PartitionList(List=item_5, Size="8")
cset = CreateSet(List=int)  # -> Set, Map
join = JoinCurves(Curves=line, Preserve=False)
pdecon = Deconstruct(Point=partition)  # -> XComponent, YComponent, ZComponent
mindex = MemberIndex(Set=int, Member=cset.Set)  # -> Index, Count
crv_cp = CurveClosestPoint(Point=mcx.Points, Curve=join)  # -> Point, Parameter, Distance
divide = DivideCurve(Count=10, Kinks=False)  # -> Points, Tangents, Parameters
sdivide = DivideSurface(UCount=10, VCount=10)  # -> Points, Normals, Parameters
sort_2 = SortList(Keys=pdecon.ZComponent, ValuesA=partition)  # -> Keys, ValuesA
item_6 = ListItem(List=sort.ValuesA, Index=mindex.Index, Wrap=True)
toggle_3 = BooleanToggle(True)
sort_3 = SortList(Keys=crv_cp.Parameter, ValuesA=mcx.Points, ValuesB=crv_cp.Point)  # -> Keys, ValuesA, ValuesB
flip = FlipMatrix(Data=sort_2.ValuesA)
vec_2 = Vector(divide.Tangents)
num_2 = Number(divide.Parameters)
avr_3 = Average(Input=item_6)
pgroups = PointGroups(Points=sort_3.ValuesB, Distance="1")  # -> Groups, Indices
pline = PolyLine(Vertices=flip, Closed="1")
cir_2 = Circle(Plane=avr_3, Radius=1)
rider_3 = RIder(openFile=toggle_3)  # -> Folder; inputs openFile: Boolean; same code as rider
item_7 = ListItem(List=sort_3.ValuesA, Index=pgroups.Indices, Wrap=True)
crv_6 = Curve([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])
alongcrv_2 = SortAlongCurve(Points=item_6, Curve=cir_2)  # -> Points, Indices
boundary = BoundarySurfaces(Edges=pline)
avr_4 = Average(Input=item_7)
pline_2 = PolyLine(Vertices=alongcrv_2.Points, Closed=invert(False))

scriptpar_3 = ScriptParasite(Enable=toggle_3, Folder=rider_3)
c_script_3 = CSharpScript(x=crv_6)  # -> out, A, B; inputs x: list of Curve
# ---------- c_script_3: C# usings ----------
using System.Drawing.Printing;
using System.Linq;
using System.Reflection;
using Rhino.FileIO;
using Rhino.Geometry.Intersect;
using Rhino.PlugIns;
# ---------- c_script_3: C# ----------
    
      var dictPlane = MakeHashCurvePlane(x);
      List<List<Curve>> ret = new List<List<Curve>>();
      List<List<Plane>> pls = new List<List<Plane>>();
      foreach (var g in dictPlane.Values)
      {
        ret.Add(g);
      }

      foreach (var g in dictPlane)
      {
        pls.Add(new List<Plane> { g.Key });
      }

      A = MakeDataTree2D(ret);
      B = MakeDataTree2D(pls);
# ---------- c_script_3: C# additional code ----------
    public Dictionary<Plane, List<Curve>> MakeHashCurvePlane(List < Curve > crv)
    {
      Dictionary<Plane, List<Curve>> dictPlane = new Dictionary<Plane, List<Curve>>();
      List<Line> lines = new List<Line>();
      for (int i = 0; i < crv.Count; i++)
      {
        Curve now = crv[i];
        Plane p;

        if (now.IsLinear())
        {
          lines.Add(new Line(now.PointAtStart, now.PointAtEnd));
        }
        else if (now.IsPlanar())
        {
          if (FindPlane(dictPlane.Keys.ToList(), now, out p))
          {
            dictPlane[p].Add(now);
          }
          else
          {
            now.TryGetPlane(out p);
            dictPlane[p] = new List<Curve> { now };
          }
        }
      }

      List<bool> vis = Enumerable.Repeat(false, lines.Count).ToList();
      for (int i = 0; i < lines.Count; i++)
      {
        if (vis[i] == true) continue;
        for (int j = 0; j < lines.Count; j++)
        {
          if (vis[j] == true || (i == j)) continue;
          var ccw = Intersection.CurveCurve(lines[i].ToNurbsCurve(), lines[j].ToNurbsCurve(), 0.1, 0.0);
          if (ccw.Count > 0)
          {
            Plane p;
            if (FindPlane(dictPlane.Keys.ToList(), lines[i].ToNurbsCurve(), out p))
            {
              dictPlane[p].Add(lines[i].ToNurbsCurve());
              dictPlane[p].Add(lines[j].ToNurbsCurve());
            }
            else
            {
              p = new Plane(lines[i].From, lines[i].Direction, lines[j].Direction);
              dictPlane[p] = new List<Curve> { lines[i].ToNurbsCurve(), lines[j].ToNurbsCurve() };
            }

            vis[j] = true;
            vis[i] = true;
            break;
          }
        }
      }

      for (int i = 0; i < lines.Count; i++)
      {
        Print(vis[i].ToString());
        if (vis[i] == false)
        {
          Plane p;
          if (FindPlane(dictPlane.Keys.ToList(), lines[i].ToNurbsCurve(), out p))
          {
            dictPlane[p].Add(lines[i].ToNurbsCurve());
          }
        }
      }

      return dictPlane;
    }

    public bool FindPlane(List < Plane > planes, Curve crv, out Plane p)
    {
      bool find = false;
      p = Plane.Unset;
      foreach (var pl in planes)
      {
        double dist1 = Math.Abs(pl.DistanceTo(crv.PointAtStart));
        double dist2 = Math.Abs(pl.DistanceTo(crv.PointAtEnd));
        if (dist1 < 0.01 && dist2 < 0.01)
        {
          find = true;
          p = pl;
          break;
        }
      }

      return find;
    }

    public static DataTree<T> MakeDataTree2D<T > (List < List < T >> ret)
    {
      DataTree<T> tree = new DataTree<T>();
      for (int i = 0; i < ret.Count; i++)
      {
        GH_Path path = new GH_Path(i);
        for (int j = 0; j < ret[i].Count; j++)
        {
          tree.Add(ret[i][j], path);
        }
      }

      return tree;
    }
# ---------- end c_script_3 ----------

cir_3 = Circle(Plane=avr_4, Radius=1)
boundary_2 = BoundarySurfaces(Edges=pline_2)
alongcrv_3 = SortAlongCurve(Points=item_7, Curve=cir_3)  # -> Points, Indices
pline_3 = PolyLine(Vertices=alongcrv_3.Points, Closed=invert(False))
viewer = ParamViewer(c_script_3.A)
viewer_2 = ParamViewer(c_script_3.B)
boundary_3 = BoundarySurfaces(Edges=pline_3)  # -> flatten(Surfaces)
crv_7 = Curve(graft([<curve referenced from the Rhino model> x2]))
item_8 = ListItem(List=boundary_3, Index=Slider(7, range=0..7), Wrap=True)
bang = ExplodeTree(Data=crv_7)  # -> Branch0, Branch1
random = Random(Range=Slider(5, range=0..10), Number=Slider(20, range=0..20), Seed=Slider(3, range=0..10), Integers=True)
planar_3 = Planar(Curve=bang.Branch0)  # -> Planar, Plane, Deviation
planar_4 = Planar(Curve=bang.Branch1)  # -> Planar, Plane, Deviation
sort_4 = SortList(Keys=random)  # -> Keys, ValuesA
panel_5 = Panel(random)
panel_6 = Panel(planar_3.Planar)
panel_7 = Panel(planar_4.Planar)
cset_2 = CreateSet(List=sort_4.Keys)  # -> Set, Map
mindex_2 = MemberIndex(Set=sort_4.Keys, Member=cset_2.Set)  # -> Index, Count
panel_8 = Panel(cset_2.Set)
bbox_2 = BoundingBox(Content=bang.Branch0, Plane=PlaneXY(0, 0, 0))  # -> Box, Box_2
bbox_3 = BoundingBox(Content=bang.Branch1, Plane=PlaneXY(0, 0, 0))  # -> Box, Box_2
item_9 = ListItem(List=sort_4.Keys, Index=mindex_2.Index, Wrap=True)
panel_9 = Panel(item_9)
