# Grasshopper definition 07_Variable offset curve.gh (Grasshopper 1.0.7)
# plug-ins: ScriptParasite

number_slider = Slider(8, range=0..50)
number_slider_2 = Slider(27, range=0..50)
number_slider_3 = Slider(7, range=0..10)
# 3 Level - 18
crv = Curve(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)
crv_2 = Curve(<curve referenced from the Rhino model>)
number_slider_4 = Slider(6, range=0..10)
panel = Panel("""0
1""")
crv_3 = Curve(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)
pframe = PerpFrame(Curve=reparameterize(crv), Parameter=panel)
dom = ConstructDomain(DomainStart=Slider(4.66, range=0..10), DomainEnd=Slider(5.05, range=0..10))
divide = DivideCurve(Curve=crv_3, Count=number_slider_2, Kinks=False)  # -> Points, Tangents, Parameters
hframes = HorizontalFrames(Curve=crv_3, Count=number_slider)  # -> Frames, Parameters
neg = Negative(Value=number_slider_3)
pframes = PerpFrames(Curve=crv_2, Count=number_slider_2, Align=True)  # -> Frames, Parameters
neg_2 = Negative(Value=number_slider_4)
toggle = BooleanToggle(True)
deplane = DeconstructPlane(Plane=hframes.Frames)  # -> graft(Origin), XAxis, graft(YAxis), ZAxis
range = Range(Domain=dom, Steps=number_slider)
pframes_2 = PerpFrames(Curve=crv_3, Count=number_slider_2, Align=True)  # -> Frames, Parameters
merge = Merge(Data1=number_slider_3, Data2=neg)  # -> graft(Result)
pframe_2 = PerpFrame()
merge_2 = Merge(Data1=number_slider_4, Data2=neg_2)  # -> graft(Result)
dispatch = Dispatch(List=pframe, DispatchPattern=[True, False])  # -> ListA, ListB
c_script = CSharpScript(X=pframes.Frames)  # -> Out, A
rider = RIder(openFile=toggle)  # -> Folder; inputs openFile: Boolean
# ---------- rider: C# usings ----------
using System.IO;
using System.Diagnostics;

public class ScriptUtilities
{
  public static string GetCurrentFolder(GH_Document doc)
  {
    string filePath = doc.FilePath;
    return Path.GetDirectoryName(filePath);
  }

  public static string[] GetCsFiles(string folderPath)
  {
    return Directory.GetFiles(folderPath, "*.cs");
  }

  public static void OpenFileWithRider(string filePath, Action<string> print)
  {
    try
    {
      // Define the path to the JetBrains Rider executable
      string riderPath = @"C:\Program Files\JetBrains\JetBrains Rider 2024.1.4\bin\rider64.exe";

      if (!File.Exists(riderPath))
      {
        print("Rider executable not found at: " + riderPath);
        return;
      }

      // Start the process to open the file with Rider
      ProcessStartInfo startInfo = new ProcessStartInfo
        {
          FileName = riderPath,
          Arguments = "\"" + filePath + "\"", // Enclose in quotes in case of spaces
          UseShellExecute = true
          };
      Process.Start(startInfo);
    }
    catch (Exception ex)
    {
      print("Error opening file with Rider: " + ex.Message);
    }
  }

  public static void RunScript(bool openFile, ref object Here, IGH_Component owner, Action<string> print)
  {
    // Get the current folder path
    GH_Document doc = owner.OnPingDocument();
    string currentFolder = GetCurrentFolder(doc);
    Here = currentFolder;

    // Get .cs files in the current folder
    string[] csFiles = GetCsFiles(currentFolder);
    if (csFiles.Length > 0)
    {
      string csFilePath = csFiles[0];

      if (openFile)
      {
        OpenFileWithRider(csFilePath, print);
      }
    }
    else
    {
      print("No .cs files found in the directory.");
    }
  }
}
# ---------- rider: C# ----------
   ScriptUtilities.RunScript(openFile, ref Folder, Component, Print);
# ---------- end rider ----------
dom_2 = ConstructDomain(DomainStart=Slider(1.5, range=0..10), DomainEnd=Slider(6.51, range=0..10))
neg_3 = Negative(Value=range)
crv_4 = Curve(<curve referenced from the Rhino model>)
merge_3 = Merge(Data1=graft(neg_3), Data2=graft(range))
line = LineSDL(Start=dispatch.ListA, Direction=Vector(0, 0, 1), Length=merge)

scriptpar = ScriptParasite(Enable=toggle, Folder=rider)
c_script_2 = CSharpScript(x=crv_4, y=Slider(25, range=0..50), z=dom_2, u=pframes.Frames)  # -> out, A, B; inputs x: Curve, y: Int32, u: list of Plane
# ---------- c_script_2: C# usings ----------
using System.Linq;
# ---------- c_script_2: C# ----------
    var li = HorizontalPlanes(x, y, true);
    var t = x.DivideByCount(y, true);
    var amp = RangeInterval(z.T0, z.T1, li.Count);

    var k = PerpPlanes(x, y, true); 
    List<Curve> ret = new List<Curve>();
    List<Point3d> L = new List<Point3d>();
    List<Point3d> R = new List<Point3d>(); 
    for (int i = 0; i < li.Count; i++)
    {
      Plane p = li[i];
      var v = p.YAxis;
      var tmp = MovePt(p.Origin, v, amp[i]);
      L.Add(tmp); 
      tmp = MovePt(p.Origin, v, -amp[i]);
      R.Add(tmp); 
    }
    ret.Add(Curve.CreateInterpolatedCurve(L, 3));
    ret.Add(Curve.CreateInterpolatedCurve(R, 3));
    ret.Add(new Arc(R[0], -x.TangentAt(t[0]), L[0]).ToNurbsCurve());
    ret.Add(new Arc(R[R.Count - 1], x.TangentAt(t[t.Length - 1]), L[L.Count - 1]).ToNurbsCurve()); 
    A = ret;
    B = k;
# ---------- c_script_2: C# additional code ----------
  public static List<double> RangeInterval(double x, double y, int cnt)
  {
    List<double> amp = new List<double>();
    if (cnt == 1) return amp;
    double gap = (y - x) / (cnt - 1);
    for (int i = 0; i < cnt; i++)
    {
      amp.Add(x + gap * i);
    }

    return amp;
  }

  public static List<Plane> HorizontalPlanes(Curve x, int cnt, bool end)
  {
    var t = x.DivideByCount(cnt, end);
    List<Plane> li = new List<Plane>();
    for (int i = 0; i < t.Length; i++)
    {
      var tan = x.TangentAt(t[i]);
      Plane p = new Plane(x.PointAt(t[i]), tan, Vector3d.CrossProduct(Vector3d.ZAxis, tan));
      li.Add(p);
    }

    return li;
  }

  public static List<Plane> PerpPlanes(Curve x, int cnt, bool end)
  {
    var t = x.DivideByCount(cnt, end);
    List<Plane> li = new List<Plane>();
    for (int i = 0; i < t.Length; i++)
    {
      var tan = x.TangentAt(t[i]);
      Plane p = new Plane(x.PointAt(t[i]), tan);
      li.Add(p);
    }

    return li;
  }
  
  public static DataTree<T> MakeDataTree2D<T>(List<List<T>> ret)
  {
    DataTree<T> tree = new DataTree<T>();
    for (int i = 0; i < ret.Count; i++)
    {
      GH_Path path = new GH_Path(i);
      for (int j = 0; j < ret[i].Count; j++)
      {

        tree.Add(ret[i][j], path);
      }
    }

    return tree;
  }
  public Point3d MovePt(Point3d p, Vector3d v, double amp)
  {
    v.Unitize();
    Vector3d newV = Vector3d.Multiply(v, amp);
    Point3d ans = Point3d.Add(p, newV);
    return ans;
  }
# ---------- end c_script_2 ----------

line_2 = LineSDL(Start=dispatch.ListB, Direction=Vector(0, 0, 1), Length=merge_2)
amp = Amplitude(Vector=deplane.YAxis, Amplitude=merge_3)
rotate = Rotate(Geometry=line, Angle=1.570796327, Plane=dispatch.ListA)  # -> Geometry, Transform
panel_2 = Panel(c_script_2.B)
rotate_2 = Rotate(Geometry=line_2, Angle=1.570796327, Plane=dispatch.ListB)  # -> Geometry, Transform
move = Move(Geometry=deplane.Origin, Motion=amp)  # -> Geometry, Transform
join = JoinCurves(Curves=c_script_2.A, Preserve=False)
flip = FlipMatrix(Data=move.Geometry)
merge_4 = Merge(Data1=rotate.Geometry, Data2=rotate_2.Geometry)
intcrv = Interpolate(Vertices=flip, Degree=3, Periodic=False, KnotStyle=1)  # -> flatten(Curve), Length, Domain
flip_2 = FlipMatrix(Data=merge_4)
tstat = TreeStatistics(Tree=flip_2)  # -> Paths, Length, Count
divide_2 = DivideCurve(Curve=intcrv.Curve, Count="1", Kinks=False)  # -> Points, Tangents, Parameters
dispatch_2 = Dispatch(List=tstat.Paths, DispatchPattern=[True, False])  # -> ListA, ListB
flip_3 = FlipMatrix(Data=divide_2.Points)
cir = Circle(Plane=PlaneXY(0, 0, 0), Radius=1)
flip_4 = FlipMatrix(Data=divide_2.Tangents)
branch = TreeBranch(Tree=flip_2, Path=dispatch_2.ListA, MaintainPaths=True)
branch_2 = TreeBranch(Tree=flip_2, Path=dispatch_2.ListB, MaintainPaths=True)
item = ListItem(List=flip_3, Index=0, Wrap=True)  # -> Item, Item1
item_2 = ListItem(List=flip_4, Index=0, Wrap=True)
panel_3 = Panel("""-1
1""")
swp2 = Sweep2(Rail1=branch, Rail2=branch_2, Sections=crv, SameHeight=False)
multiplication = Multiplication(A=item_2, B=graft(panel_3))
arc = ArcSED(Start=item.Item, End=item.Item1, Direction=multiplication)  # -> Arc, Plane, Radius
