# Grasshopper definition 08_Arranging rectangles along a curved path.gh (Grasshopper 1.0.7)
# plug-ins: ScriptParasite

crv = Curve(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)
explode = Explode(Curve=crv, Recursive=True)  # -> Segments, Vertices
item = ListItem(List=explode.Segments, Index=0, Wrap=True)  # -> Item, Item1
item_2 = ListItem(List=explode.Vertices, Index=0, Wrap=True)
len = Length(Curve=item.Item)
crv_2 = Curve(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)
# 3 Level - 16
crv_3 = Curve(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)
series = Series(Start=0, Step=len, Count=Slider(10, range=0..10))  # -> flatten(Series)
neg = Negative(Value=series)  # -> reverse(Result)
neg_2 = Negative(Value=series)  # -> reverse(Result)
ccx = CurveCurve(CurveA=crv_3, CurveB=crv_2)  # -> Points, ParamsA, ParamsB
explode_2 = Explode(Curve=crv_3, Recursive=True)  # -> Segments, Vertices
neg_3 = Negative(Value=series)
cull_i = CullIndex(List=neg, Indices="-1", Wrap=True)  # -> flatten(List)
merge = Merge(Data1=neg_2, Data2=series)
toggle = BooleanToggle(True)
item_3 = ListItem(List=explode_2.Segments, Index=0, Wrap=True)  # -> Item, Item1
vec = Vector(item.Item)
merge_2 = Merge(Data1=series, Data2=neg_3)
crv_4 = Curve(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)
crv_5 = Curve(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)
merge_3 = Merge(Data1=cull_i, Data2=series)
dcon = DeleteConsecutive(Set=merge, Wrap=False)  # -> Set, Count
rider = RIder(openFile=toggle)  # -> Folder; inputs openFile: Boolean
# ---------- rider: C# usings ----------
using System.IO;
using System.Diagnostics;

public class ScriptUtilities
{
  public static string GetCurrentFolder(GH_Document doc)
  {
    string filePath = doc.FilePath;
    return Path.GetDirectoryName(filePath);
  }

  public static string[] GetCsFiles(string folderPath)
  {
    return Directory.GetFiles(folderPath, "*.cs");
  }

  public static void OpenFileWithRider(string filePath, Action<string> print)
  {
    try
    {
      // Define the path to the JetBrains Rider executable
      string riderPath = @"C:\Program Files\JetBrains\JetBrains Rider 2024.1.4\bin\rider64.exe";

      if (!File.Exists(riderPath))
      {
        print("Rider executable not found at: " + riderPath);
        return;
      }

      // Start the process to open the file with Rider
      ProcessStartInfo startInfo = new ProcessStartInfo
        {
          FileName = riderPath,
          Arguments = "\"" + filePath + "\"", // Enclose in quotes in case of spaces
          UseShellExecute = true
          };
      Process.Start(startInfo);
    }
    catch (Exception ex)
    {
      print("Error opening file with Rider: " + ex.Message);
    }
  }

  public static void RunScript(bool openFile, ref object Here, IGH_Component owner, Action<string> print)
  {
    // Get the current folder path
    GH_Document doc = owner.OnPingDocument();
    string currentFolder = GetCurrentFolder(doc);
    Here = currentFolder;

    // Get .cs files in the current folder
    string[] csFiles = GetCsFiles(currentFolder);
    if (csFiles.Length > 0)
    {
      string csFilePath = csFiles[0];

      if (openFile)
      {
        OpenFileWithRider(csFilePath, print);
      }
    }
    else
    {
      print("No .cs files found in the directory.");
    }
  }
}
# ---------- rider: C# ----------
   ScriptUtilities.RunScript(openFile, ref Folder, Component, Print);
# ---------- end rider ----------
sort = SortList(Keys=merge_2)  # -> Keys, ValuesA
unit = UnitVector(Vector=item_3.Item)
len_2 = Length(Curve=item_3.Item)
amp = Amplitude(Vector=vec, Amplitude=merge_3)
number_slider = Slider(5.5, range=0..10)
crv_6 = Curve(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)

scriptpar = ScriptParasite(Enable=toggle, Folder=rider)
c_script = CSharpScript(x=crv_5, y=crv_4)  # -> out, A, B, C, D; inputs x: Curve, y: Curve
# ---------- c_script: C# ----------
    
      var pts = Discontinuity(x);
      pts.Sort((u, v) => u.DistanceTo(Point3d.Origin).CompareTo(v.DistanceTo(Point3d.Origin)));
      var now = pts[0];
      Curve crv = MoveOrient(x, now, y.PointAt(0));
      A = crv;
      B = y.PointAt(0);
      var cps = CloPts(pts, now, 1);
      Vector3d n = cps[0] - now;
      C = n;
      D = now.DistanceTo(cps[0]);
# ---------- c_script: C# additional code ----------
    public T MoveOrient<T > (T obj, Point3d now, Point3d nxt, Plane baseNow = default(Plane), Plane baseNxt = default(Plane)) where T : GeometryBase
    {
      if (baseNow == default(Plane))
      {
        baseNow = Plane.WorldXY;
      }

      if (baseNxt == default(Plane))
      {
        baseNxt = Plane.WorldXY;
      }
      Plane st = new Plane(now, baseNow.XAxis, baseNow.YAxis);
      Plane en = new Plane(nxt, baseNxt.XAxis, baseNxt.YAxis);
      Transform orient = Transform.PlaneToPlane(st, en);
      obj.Transform(orient);
      return obj;
    }

    public Point3d MovePt(Point3d p, Vector3d v, double amp)
    {
      v.Unitize();
      Transform move = Transform.Translation(v * amp);
      p.Transform(move);
      return p;
    }

    public List<Point3d> Discontinuity(Curve x)
    {
      var seg = x.DuplicateSegments();
      List<Point3d> pts = new List<Point3d>();
      for (int i = 0; i < seg.Length; i++)
      {
        if (i == 0) pts.Add(seg[i].PointAtStart);
        pts.Add(seg[i].PointAtEnd);
      }

      if (x.IsClosed) pts.RemoveAt(pts.Count - 1);
      return pts;
    }

    public List<Point3d> CloPts(List < Point3d > pts, Point3d now, int cnt)
    {
      pts.Sort((u, v) => u.DistanceTo(now).CompareTo(v.DistanceTo(now)));
      List<Point3d> ans = new List<Point3d>();

      for (int i = 0; i < pts.Count; i++)
      {
        if (ans.Count == cnt) break;
        if (pts[i] == now) continue;
        ans.Add(pts[i]);
      }

      return ans;
    }
# ---------- end c_script ----------

contour = CurveContour(Curve=crv_2, Point=ccx.Points, Direction=unit, Distance=len_2)  # -> Contours, Parameters
move = Move(Geometry=item.Item1, Motion=amp)  # -> Geometry, Transform
move_2 = Move(Motion=Vector(0, 0, 10))  # -> Geometry, Transform
vec2pt = Vector2Pt(PointA=ccx.Points, PointB=contour.Contours, Unitize=False)  # -> Vector, Length
toggle_2 = BooleanToggle(True)
line = Line(move.Geometry)
round = Round(Number=number_slider)  # -> Nearest, Floor, Ceiling
contour_2 = Contour(Curve=crv_4, Point=c_script.B, Direction=c_script.C, Distance=c_script.D)  # -> flatten(Contours), Parameters
move_3 = Move(Geometry=crv_3, Motion=vec2pt.Vector)  # -> Geometry, Transform
clx = CurveLine(Curve=crv_6, Line=line)  # -> flatten(Points), Params, Count
int = Integer(number_slider)
ccx_2 = CurveCurve()  # -> Points, ParamsA, ParamsB
rider_2 = RIder(openFile=toggle_2)  # -> Folder; inputs openFile: Boolean; same code as rider
pt = Point(c_script.B)
panel = Panel(int)
panel_2 = Panel([round.Nearest, round.Floor, round.Ceiling])
vec2pt_2 = Vector2Pt(PointA=item_2, PointB=clx.Points, Unitize=False)  # -> Vector, Length
move_4 = Move(Geometry=crv, Motion=vec2pt_2.Vector)  # -> Geometry, Transform

c_script_2 = CSharpScript(x=c_script.A, y=contour_2.Contours, z=pt, u=Slider(11, range=0..100))  # -> out, A; inputs x: Curve, y: list of Point3d, z: Point3d, u: Int32
# ---------- c_script_2: C# ----------
    List<Curve> ans = new List<Curve>(); 
    for (int i = 0; i < Math.Min(u, y.Count); i++)
    {
      Curve k = x.DuplicateCurve(); 
      ans.Add(MoveOrient(k, z, y[i])); 
    }
    A = ans;
# ---------- c_script_2: C# additional code ----------
  public T MoveOrient<T>(T obj, Point3d now, Point3d nxt, Plane baseNow = default(Plane),
    Plane baseNxt = default(Plane)) where T : GeometryBase
  {
    if (baseNow == default(Plane))
    {
      baseNow = Plane.WorldXY;
    }

    if (baseNxt == default(Plane))
    {
      baseNxt = Plane.WorldXY;
    }

    Plane st = new Plane(now, baseNow.XAxis, baseNow.YAxis);
    Plane en = new Plane(nxt, baseNxt.XAxis, baseNxt.YAxis);
    Transform orient = Transform.PlaneToPlane(st, en);
    obj.Transform(orient);
    return obj;
  }
# ---------- end c_script_2 ----------
scriptpar_2 = ScriptParasite(Enable=toggle_2, Folder=rider_2)

panel_3 = Panel(move.Geometry)
panel_4 = Panel("""단위벡터
위치벡터""")
crv_7 = Curve(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)
planar = Planar(Curve=crv_7)  # -> Planar, Plane, Deviation
crv_8 = Curve(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)
pt_2 = Point([Point(4.002432334, 8.860955208, 0), Point(9.549340697, 7.227698856, 0), Point(11.09014858, 3.067517584, 0)])
pt_3 = Point(Point(34.66062327, -32.29459302, 0))
X = UnitX(Factor=1)
pt_4 = Point(Point(72.95856988, -8.290182043, 0))
unit_2 = UnitVector()
vec_2 = VectorXYZ(XComponent=Slider(5, range=0..10), YComponent=Slider(5, range=0..10), ZComponent=Slider(0, range=0..10))  # -> Vector, Length
pt_5 = ConstructPoint(XCoordinate=Slider(5, range=0..10), YCoordinate=Slider(5, range=0..10), ZCoordinate=Slider(0, range=0..10))
end = EndPoints(Curve=crv_7)  # -> Start, End
srf = Surface([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])
pln = Plane(planar.Plane)
panel_5 = Panel(planar.Planar)
vec_3 = Vector(crv_7)
vec_4 = Vector(pt_2)
join = BrepJoin(Breps=srf)  # -> Breps, Closed
pl = ConstructPlane(Origin=Point(0, 0, 0), XAxis=Vector(1, 0, 0), YAxis=Vector(0, 1, 0))
Y = UnitY(Factor=1)
vec2pt_3 = Vector2Pt(PointA=pt_3, PointB=pt_4, Unitize=False)  # -> Vector, Length
dist = Distance(PointA=pt_3, PointB=pt_4)
pt_6 = Point(pt_5)
vec_5 = Vector(vec_2.Vector)
vec_6 = Vector(pt_2)
panel_6 = Panel(srf)
move_5 = Move(Geometry=crv_8, Motion=vec_4)  # -> Geometry, Transform
deplane = DeconstructPlane(Plane=pln)  # -> Origin, XAxis, YAxis, ZAxis
pt_7 = Point(vec_5)
debrep = DeconstructBrep(Brep=join.Breps)  # -> Faces, Edges, Vertices
panel_7 = Panel(vec_3)
edges = BrepEdges(Brep=join.Breps)  # -> Naked, Interior, NonManifold
Z = UnitZ(Factor=1)
line_2 = LineSDL(Start=end.End, Direction=vec_3, Length=Slider(6.42, range=0..10))
panel_8 = Panel("PolySurface == Brep")
pt_8 = Point(vec_6)
planar_2 = IsPlanar(Interior=True)  # -> Planar, Plane
pt_9 = Point(debrep.Vertices)
vec_7 = Vector(pt_6)
vec_8 = Vector(deplane.XAxis)
xy = XYPlane(Origin=Point(0, 0, 0))
cir = Circle(Plane=vec_5, Radius=1)
crv_9 = Curve(debrep.Edges)
crv_10 = Curve(edges.Interior)
panel_9 = Panel(edges.NonManifold)
vdis = VectorDisplay(Anchor=xy, Vector=vec_5)
line_3 = Line(Line((19.25066501, -16.98426089, 0), (52.42039655, -9.346493761, 0)))
crv_11 = Curve(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)
pt_10 = Point(Point(-0.6823154145, -1.815545316, 0))
pt_11 = Point(Point(4.893698683, 7.001936946, 0))
vec_9 = Vector(line_3)
vec_10 = Vector(crv_11)
panel_10 = Panel([line_3, crv_11])
pt_12 = Point(Point(3.358279704, -5.273922259, 0))
vec_11 = Vector(pt_11)
vec_12 = Vector(pt_10)
vlen = VectorLength(Vector=vec_9)
vlen_2 = VectorLength(Vector=vec_10)
pl_2 = ConstructPlane(Origin=pt_12, XAxis=vec_11, YAxis=vec_12)
pln_2 = Plane(pt_12)
panel_11 = Panel([vlen, vlen_2])
rec = Rectangle({Plane=PlaneXY(79.39200383, -71.62499398, 0), Size=Domain2(u=-17.33527199..17.33527199, v=-9.369114364..9.369114364)})
arc = CircularArc({Angle=0, Angle=0.7069786431, Plane=Plane(origin=(103.9335162, -51.46831855, 0), x=(0.7030239318, 0.7111661911, 0), y=(-0.7111661911, 0.7030239318, 0)), Radius=28.75518432})
cir_2 = Circle(Plane=PlaneXY(0, 0, 0), Radius=1)
circle = Circle({Plane=Plane(origin=(31.68931434, -38.91556365, 0), x=(0.9735472949, -0.2284855896, 0), y=(0.2284855896, 0.9735472949, 0)), Radius=10.98341502})
box = Box({Plane=PlaneXY(58.67656956, -48.96145597, 0), X=Domain(0, 12.1868066), Y=Domain(0, 5.91979438), Z=Domain(0, 31.37926394)})
