# Grasshopper definition 09_Creating a polyline by connecting points.gh (Grasshopper 1.0.7)
# plug-ins: ScriptParasite

pt = Point(Tree({0;0}: [Point(8.360102611, 23.03302887, 0), Point(8.553503518, 13.43984358, 0)], {0;1}: [Point(17.06463073, 27.0165522, 0.9579941696), Point(17.06463073, 21.59253462, 4.654937278), Point(17.06463073, 15.77078763, 4.653572714), Point(17.06463073, 9.385434981, 1.626177295)], {0;2}: [Point(27.84526556, 24.06891358, 4.549172877), Point(27.84526556, 19.94086009, 7.041467193), Point(27.84526556, 16.12728719, 6.620386851), Point(27.84526556, 12.26803701, 2.769042926)], {0;3}: [Point(39.13667581, 27.11716779, 0), Point(39.13667581, 21.47096223, 5.760048053), Point(39.13667581, 15.65736813, 5.628133802), Point(39.13667581, 10.22893265, 1.56347406)], {0;4}: [Point(49.06322942, 25.38107834, 0), Point(49.34294195, 12.37331728, 0)]))
pt_2 = Point(Tree({0;0}: [Point(8.360102611, 23.03302887, 0), Point(8.553503518, 13.43984358, 0)], {0;1}: [Point(17.06463073, 27.0165522, 0.9579941696), Point(17.06463073, 21.59253462, 4.654937278), Point(17.06463073, 15.77078763, 4.653572714), Point(17.06463073, 9.385434981, 1.626177295)], {0;2}: [Point(27.84526556, 24.06891358, 4.549172877), Point(27.84526556, 19.94086009, 7.041467193), Point(27.84526556, 16.12728719, 6.620386851), Point(27.84526556, 12.26803701, 2.769042926)], {0;3}: [Point(39.13667581, 27.11716779, 0), Point(39.13667581, 21.47096223, 5.760048053), Point(39.13667581, 15.65736813, 5.628133802), Point(39.13667581, 10.22893265, 1.56347406)], {0;4}: [Point(49.06322942, 25.38107834, 0), Point(49.34294195, 12.37331728, 0)]))
tstat = TreeStatistics(Tree=pt)  # -> Paths, Length, Count
tstat_2 = TreeStatistics(Tree=pt_2)  # -> Paths, Length, Count
panel = Panel("""0
-1""")
# 3 Level - 05
pline = PolyLine(Vertices=pt_2, Closed=False)
panel_2 = Panel("""0
-1""")
explode = Explode(Curve=pline, Recursive=True)  # -> Segments, Vertices
item = ListItem(List=tstat.Paths, Index=panel_2, Wrap=True)
cull_i = CullIndex(List=tstat.Paths, Indices=panel_2, Wrap=True)
item_2 = ListItem(List=tstat_2.Paths, Index=panel, Wrap=True)
cull_i_2 = CullIndex(List=tstat_2.Paths, Indices=panel, Wrap=True)
branch = TreeBranch(Tree=pt, Path=cull_i, MaintainPaths=True)
branch_2 = TreeBranch(Tree=pt_2, Path=cull_i_2, MaintainPaths=True)
branch_3 = TreeBranch(Tree=pt, Path=item, MaintainPaths=True)
branch_4 = TreeBranch(Tree=pt_2, Path=item_2, MaintainPaths=True)
panel_3 = Panel("""0
-1""")
panel_4 = Panel("""0
-1""")
ins = InsertItems(List=branch_4, Indices=panel_3, Wrap=True)
ins_2 = InsertItems(List=branch_3, Item="0,0,0", Indices=panel_4, Wrap=True)
pshift = ShiftPaths(Data=ins, Offset=-1)
merge = Merge(Data1=simplify(ins_2), Data2=simplify(branch))
pshift_2 = ShiftPaths(Data=ins_2, Offset=-1)
merge_2 = Merge(Data1=pshift, Data2=branch_2)
flip = FlipMatrix(Data=merge)
viewer = ParamViewer(ins_2)
flip_2 = FlipMatrix(Data=merge_2)
cullpt = CullDuplicates(Points=flip, Tolerance=0.1, CullMode=2)  # -> Points, Indices, Valence
pline_2 = PolyLine(Vertices=flip_2, Closed=False)
pline_3 = PolyLine(Vertices=cullpt.Points, Closed=False)
pline_4 = PolyLine(Vertices=pt, Closed=False)
toggle = BooleanToggle(True)
rectangle = Rectangle(Plane=PlaneXY(0, 0, 0), XSize=Slider(100, range=0..100), YSize=Slider(100, range=0..100), Radius=0)  # -> Rectangle, Length
toggle_2 = BooleanToggle(True)
pt_3 = Point(Tree({0;0}: [Point(8.360102611, 23.03302887, 0), Point(8.553503518, 13.43984358, 0)], {0;1}: [Point(17.06463073, 27.0165522, 0.9579941696), Point(17.06463073, 21.59253462, 4.654937278), Point(17.06463073, 15.77078763, 4.653572714), Point(17.06463073, 9.385434981, 1.626177295)], {0;2}: [Point(27.84526556, 24.06891358, 4.549172877), Point(27.84526556, 19.94086009, 7.041467193), Point(27.84526556, 16.12728719, 6.620386851), Point(27.84526556, 12.26803701, 2.769042926)], {0;3}: [Point(39.13667581, 27.11716779, 0), Point(39.13667581, 21.47096223, 5.760048053), Point(39.13667581, 15.65736813, 5.628133802), Point(39.13667581, 10.22893265, 1.56347406)], {0;4}: [Point(49.06322942, 25.38107834, 0), Point(49.34294195, 12.37331728, 0)]))
rider = RIder(openFile=toggle)  # -> Folder; inputs openFile: Boolean
# ---------- rider: C# usings ----------
using System.IO;
using System.Diagnostics;

public class ScriptUtilities
{
  public static string GetCurrentFolder(GH_Document doc)
  {
    string filePath = doc.FilePath;
    return Path.GetDirectoryName(filePath);
  }

  public static string[] GetCsFiles(string folderPath)
  {
    return Directory.GetFiles(folderPath, "*.cs");
  }

  public static void OpenFileWithRider(string filePath, Action<string> print)
  {
    try
    {
      // Define the path to the JetBrains Rider executable
      string riderPath = @"C:\Program Files\JetBrains\JetBrains Rider 2024.1.4\bin\rider64.exe";

      if (!File.Exists(riderPath))
      {
        print("Rider executable not found at: " + riderPath);
        return;
      }

      // Start the process to open the file with Rider
      ProcessStartInfo startInfo = new ProcessStartInfo
        {
          FileName = riderPath,
          Arguments = "\"" + filePath + "\"", // Enclose in quotes in case of spaces
          UseShellExecute = true
          };
      Process.Start(startInfo);
    }
    catch (Exception ex)
    {
      print("Error opening file with Rider: " + ex.Message);
    }
  }

  public static void RunScript(bool openFile, ref object Here, IGH_Component owner, Action<string> print)
  {
    // Get the current folder path
    GH_Document doc = owner.OnPingDocument();
    string currentFolder = GetCurrentFolder(doc);
    Here = currentFolder;

    // Get .cs files in the current folder
    string[] csFiles = GetCsFiles(currentFolder);
    if (csFiles.Length > 0)
    {
      string csFilePath = csFiles[0];

      if (openFile)
      {
        OpenFileWithRider(csFilePath, print);
      }
    }
    else
    {
      print("No .cs files found in the directory.");
    }
  }
}
# ---------- rider: C# ----------
   ScriptUtilities.RunScript(openFile, ref Folder, Component, Print);
# ---------- end rider ----------
pop2d = Populate2D(Region=rectangle.Rectangle, Count=Slider(12, range=0..100), Seed=1)
area = Area(Geometry=rectangle.Rectangle)  # -> Area, Centroid
rider_2 = RIder(openFile=toggle_2)  # -> Folder; inputs openFile: Boolean; same code as rider

c_script = CSharpScript(x=pt_3)  # -> out, A, B, C, D; inputs x: tree of Point3d
# ---------- c_script: C# usings ----------
using System.Linq;
using Rhino.Render;
# ---------- c_script: C# ----------
    var li = ConvertDataTreeToList(x);
    List<Curve> ans = new List<Curve>(); 
    for (int i = 0; i < li.Count; i++)
    {
      var now = li[i]; 
      now.Sort((u, v) => u.Y.CompareTo(v.Y));
      var crv = new PolylineCurve(now);
      var crvs = crv.DuplicateSegments();
      foreach (var VARIABLE in crvs)
      {
        ans.Add(VARIABLE); 
      }
      li[i] = now; 
    }

    for (int i = 0; i < 4; i++)
    {
      List<Point3d> tmp = new List<Point3d>();
      for (int j = 0; j < li.Count(); j++)
      {
        if (li[j].Count == 2)
        {
          if(i == 0 || i == 3) continue;
          tmp.Add(li[j][i - 1]); 
        }
        else tmp.Add(li[j][i]); 
      }

      tmp.Sort((u, v) => u.X.CompareTo(v.X));
      var crv = new PolylineCurve(tmp);
      var crvs = crv.DuplicateSegments();
      foreach (var VARIABLE in crvs)
      {
        ans.Add(VARIABLE); 
      }
    }

    List<Surface> srf = new List<Surface>();
    HashSet<int> hS = new HashSet<int>(); 
    for (int i = 0; i < li.Count; i++)
    {
      for (int j = 0; j < li[i].Count; j++)
      {
        var nowP = li[i][j];
        var pic = PointsInCurves(ans, nowP);
        List<Point3d> ccwP = new List<Point3d>();
        for (int p = 0; p < pic.Count; p++)
        {
          var a = pic[p].PointAtEnd;
          var b = pic[p].PointAtStart;
          if (a == nowP) ccwP.Add(b);
          else ccwP.Add(a);

        }
        
        ccwP = SortPointsClockwise(ccwP, nowP);
        for (int p = 0; p < ccwP.Count; p++)
        {
          Surface tmp = NurbsSurface.CreateFromCorners(nowP, ccwP[p], ccwP[(p + 1) % ccwP.Count]);
          var code = tmp.PointAt(0.5, 0.5); 
          srf.Add(tmp);
        }

        if (i == 3 && j == 1)
        {
          A = pic;
          B = ccwP; 
        }

      }
    }

    C = srf;
# ---------- c_script: C# additional code ----------
  
  public List<Point3d> SortPointsClockwise(List<Point3d> points, Point3d referencePoint)
  {
    // 기준점과의 벡터를 이용하여 정렬
    points.Sort((pointA, pointB) =>
    {
      Vector3d vecA = pointA - referencePoint;
      Vector3d vecB = pointB - referencePoint;

      // z축을 기준으로 두 벡터의 외적을 계산
      var crossProduct = Vector3d.CrossProduct(vecA, vecB).Z; 

      // CCW 방향에 따라 정렬
      if (crossProduct > 0)
        return 1; // vecA가 vecB보다 시계방향으로 더 작은 각도를 가짐
      else if (crossProduct < 0)
        return -1; // vecB가 vecA보다 시계방향으로 더 작은 각도를 가짐
      else
      {
        // 외적이 0이면, 두 점이 같은 선상에 있음, 기준점에서 더 가까운 점을 먼저 배치
        double distA = vecA.Length;
        double distB = vecB.Length;
        return distA.CompareTo(distB);
      }
    });

    return points;
  }
  public List<Curve> PointsInCurves(List<Curve> crves, Point3d pt)
  {
    List<Curve> ans = new List<Curve>();
    for (int i = 0; i < crves.Count; i++)
    {
      double t;
      if (crves[i].ClosestPoint(pt, out t, 0.001))
      {
        ans.Add(crves[i]);
      }
    }

    return ans;
  }
  public List<List<T>> ConvertDataTreeToList<T>(DataTree<T> dataTree)
  {
    List<List<T>> list2D = new List<List<T>>();

    foreach (GH_Path path in dataTree.Paths)
    {
      List<T> branchList = dataTree.Branch(path).ToList();
      list2D.Add(branchList);
    }

    return list2D;
  }
# ---------- end c_script ----------
scriptpar = ScriptParasite(Enable=toggle, Folder=rider)

c_script_2 = CSharpScript(x=pop2d, y=area.Centroid)  # -> out, A; inputs x: list of Point3d, y: Point3d
# ---------- c_script_2: C# usings ----------
using System.Linq;
# ---------- c_script_2: C# ----------
    var ccwP = SortPointsCcw(x, y);
    A = ccwP;
# ---------- c_script_2: C# additional code ----------
  public List<Point3d> SortPointsCcw(List<Point3d> points, Point3d referencePoint)
  {
    points.Sort((pointA, pointB) =>
    {
      Vector3d vecA = pointA - referencePoint;
      Vector3d vecB = pointB - referencePoint;
      var crossProduct = Vector3d.CrossProduct(vecA, vecB).Z;

      if (crossProduct > 0)
        return -1; 
      else if (crossProduct < 0) 
        return 1;
      else
      {
        double distA = vecA.Length;
        double distB = vecB.Length;
        return distA.CompareTo(distB);
      }
    });
    return points;
  }
# ---------- end c_script_2 ----------
scriptpar_2 = ScriptParasite(Enable=toggle_2, Folder=rider_2)

geo = Geometry(c_script.B)
pline_5 = PolyLine(Vertices=c_script_2.A, Closed=False)
points = PointList(Points=c_script_2.A, Size=Slider(6, range=0..10))
pt_4 = Point(<point referenced from the Rhino model>)
pt_5 = Point(<point referenced from the Rhino model>)
xy = XYPlane(Origin=Point(0, 0, 0))
vec = Vector(pt_4)
vec_2 = Vector(pt_5)
number_slider = Slider(4, range=0..10)
cir = Circle(Plane=xy, Radius=1)
xprod = CrossProduct(VectorA=vec, VectorB=vec_2, Unitize=invert(False))  # -> Vector, Length
vdis = VectorDisplay(Anchor=xy, Vector=vec)
vdis_2 = VectorDisplay(Anchor=xy, Vector=vec_2)
amp = Amplitude(Vector=xprod.Vector, Amplitude=Slider(7.9, range=0..10))
vdis_3 = VectorDisplay(Anchor=xy, Vector=amp)
angle = Angle(VectorA=vec, VectorB=vec_2)  # -> Angle, Reflex
