# Grasshopper definition 10_Arrange the given units at the edges.gh (Grasshopper 1.0.7)
# plug-ins: Human, Kangaroo2 Components, ScriptParasite

brep = Brep(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)
brep_2 = Brep(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)
brep_3 = Brep(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)
brep_4 = Brep(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)
debrep = DeconstructBrep(Brep=brep)  # -> Faces, Edges, Vertices
brep_5 = Brep(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)
brep_6 = Brep(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)
debrep_2 = DeconstructBrep(Brep=brep_2)  # -> Faces, Edges, Vertices
smesh = SimpleMesh(Brep=brep_4)
# 3 Level - 19
debrep_3 = DeconstructBrep(Brep=brep_6)  # -> Faces, Edges, Vertices
debrep_4 = DeconstructBrep(Brep=brep_5)  # -> Faces, Edges, Vertices
expression = Expression(p=debrep.Vertices, Expression="p.X+p.Y")
debrep_5 = DeconstructBrep(Brep=brep_3)  # -> Faces, Edges, Vertices
midpt = CurveMiddle(Curve=debrep_2.Edges)
crv = Curve(flatten(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))
clean = CombineClean(Meshes=smesh)
item = ListItem(List=debrep_3.Faces, Index=0, Wrap=True)  # -> Item, Item1, Item2, Item3, Item4, Item5
pt = Point(debrep_2.Vertices)
crv_2 = Curve(flatten(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))
crv_3 = Curve(flatten(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))
pt_2 = Point(Point(5.553024042, 5.429078394, 0))
pt_3 = Point(Point(11.83952019, 14.51984488, 0))
pt_4 = Point(Point(10.17544768, 1.607874855, 0))
pt_5 = Point(Point(21.82395524, 3.518476625, 0))
pt_6 = Point(debrep_4.Vertices)
pt_7 = Point(Point(9.656081487, 6.614180005, 0))
pt_8 = Point(Point(21.71623204, 8.858813705, 0))
item_2 = ListItem(List=debrep_5.Vertices, Index=0, Wrap=True)
cps = ClosestPoints(Point=graft(pt), Cloud=midpt, Count="3")  # -> ClosestPoint, CPIndex, Distance
sort = SortList(Keys=expression, ValuesA=debrep.Vertices)  # -> Keys, ValuesA
explode = Explode(Curve=crv, Recursive=True)  # -> Segments, Vertices
demesh = DeconstructMesh(Mesh=clean)  # -> Vertices, Faces, Colours, Normals
sph = Sphere(Base=pt_6, Radius=1)
explode_2 = Explode(Curve=crv_2, Recursive=True)  # -> Segments, Vertices
vec2pt = Vector2Pt(PointA=pt_4, PointB=pt_5, Unitize=False)  # -> Vector, Length
vec2pt_2 = Vector2Pt(PointA=pt_2, PointB=pt_3, Unitize=False)  # -> Vector, Length
explode_3 = Explode(Curve=crv_3, Recursive=True)  # -> Segments, Vertices
disc = Discontinuity(Curve=[item.Item4, item.Item5], Level=1)  # -> Points, Parameters
vec2pt_3 = Vector2Pt(PointA=pt_7, PointB=pt_8, Unitize=False)  # -> Vector, Length
lng = ListLength(List=pt)
item_3 = ListItem(List=sort.ValuesA, Index="-2", Wrap=True)
panel = Panel("""-1
1""")
split = SplitWithBrep(Curve=debrep_4.Edges, Brep=graft(sph))  # -> Curve, Points
pdecon = Deconstruct(Point=demesh.Vertices)  # -> XComponent, YComponent, ZComponent
shift = ShiftList(List=explode.Segments, Shift="-1", Wrap=True)
vec2pt_4 = Vector2Pt(PointA=graft(pt), PointB=cps.ClosestPoint, Unitize=invert(False))  # -> Vector, Length
lng_2 = ListLength(List=demesh.Normals)
cull_i = CullIndex(List=explode.Vertices, Indices="-1", Wrap=True)
shift_2 = ShiftList(List=explode_2.Segments, Shift="-1", Wrap=True)
shift_3 = ShiftList(List=explode_3.Segments, Shift="-1", Wrap=True)
subtraction = Subtraction(A=vec2pt_2.Vector, B=vec2pt.Vector)
pl_origin = PlaneOrigin(Base=item.Item4, Origin=disc.Points)
panel_2 = Panel("""0,0,-1
0,0,1""")
cull_i_2 = CullIndex(List=explode_2.Vertices, Indices="-1", Wrap=True)
pt_9 = Point(vec2pt_3.Vector)
cull_i_3 = CullIndex(List=explode_3.Vertices, Indices="-1", Wrap=True)
panel_3 = Panel(vec2pt_3.Vector)
sort_2 = SortList(Keys=pdecon.ZComponent, ValuesA=demesh.Vertices, ValuesB=demesh.Normals)  # -> Keys, ValuesA, ValuesB
repeat = RepeatData(Data=graft(panel), Length=expr("x/2", lng))  # -> flatten(Data)
Z = UnitZ(Factor=1)
pshift = ShiftPaths(Data=split.Points, Offset=-1)
vec = Vector(shift)
cps_2 = ClosestPoints(Point=item_3, Cloud=sort.ValuesA, Count="2")  # -> ClosestPoint, CPIndex, Distance
vec_2 = Vector(explode.Segments)
vec_3 = Vector(explode_2.Segments)
vec_4 = Vector(shift_2)
pt_10 = Point(subtraction)
vec_5 = Vector(explode_3.Segments)
vec_6 = Vector(shift_3)
ma = MassAddition(Input=vec2pt_4.Vector)  # -> Result, PartialResults
panel_4 = Panel(subtraction)
repeat_2 = RepeatData(Data=graft(panel_2), Length=expr("x/2", lng_2))  # -> flatten(Data)
rev = Reverse(Vector=vec)
neg = Negative(Value=vec_4)
line = LineSDL(Start=cull_i, Direction=vec_2, Length="2")
item_4 = ListItem(List=cps_2.ClosestPoint, Index="1", Wrap=True)
subtraction_2 = Subtraction(A=vec_5, B=vec_6)
vec2pt_5 = Vector2Pt(PointA=graft(pt_6), PointB=pshift, Unitize=invert(False))  # -> Vector, Length
panel_5 = Panel("""-pi / 2
0
pi / 2
pi""")
multiplication = Multiplication(A=graft(repeat), B=Z)
addition = Addition(A=vec_3, B=neg)
orient = Orient(Geometry=brep_3, Source=item_2, Target=pl_origin)  # -> Geometry, Transform
pl = ConstructPlane(Origin=sort_2.ValuesA, XAxis=sort_2.ValuesB, YAxis=repeat_2)
angle = Angle(VectorA=vec_2, VectorB=rev)  # -> Angle, Reflex
vec2pt_6 = Vector2Pt(PointA=item_4, PointB=item_3, Unitize=False)  # -> Vector, Length
Z_2 = UnitZ(Factor=1)
line_2 = LineSDL(Start=cull_i_3, Direction=subtraction_2, Length=1)
ma_2 = MassAddition(Input=vec2pt_5.Vector)  # -> Result, PartialResults
pl_2 = ConstructPlane(Origin=graft(pt), XAxis=ma.Result, YAxis=multiplication)  # -> flatten(Plane)
pl_3 = ConstructPlane(Origin=item_3, XAxis=vec2pt_6.Vector, YAxis=Z_2)
line_3 = LineSDL(Start=cull_i_2, Direction=addition, Length=1)
division = Division(A=angle.Angle, B="2")
rot3d = Rotate3D(Geometry=orient.Geometry, Angle=panel_5, Center=disc.Points, Axis=Vector(0, 0, 1))  # -> Geometry, Transform
rotate = Rotate(Geometry=line, Angle=division, Plane=cull_i)  # -> Geometry, Transform
orient_2 = Orient(Geometry=brep, Source=pl_3, Target=pl_2)  # -> Geometry, Transform
crv_4 = Curve(flatten(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))
panel_6 = Panel(angle.Angle)
tstat = TreeStatistics(Tree=rot3d.Geometry)  # -> Paths, Length, Count
panel_7 = Panel("""10
20
30""")
previewmat = CustomPreviewMaterials(Geometry=orient_2.Geometry, DiffuseColor=RGB(255, 255, 255))
offset = OffsetCurve(Curve=crv_4, Distance=1, Corners=1)  # -> flatten(Curve)
ma_3 = MassAddition(Input=panel_7)  # -> Result, PartialResults
dispatch = Dispatch(List=tstat.Paths, DispatchPattern=[True, False])  # -> ListA, ListB
merge = Merge(Data1=graft(crv_4), Data2=graft(offset))
panel_8 = Panel(ma_3.PartialResults)
branch = TreeBranch(Tree=rot3d.Geometry, Path=dispatch.ListB, MaintainPaths=True)
branch_2 = TreeBranch(Tree=rot3d.Geometry, Path=dispatch.ListA, MaintainPaths=True)
disc_2 = Discontinuity(Curve=merge, Level=1)  # -> Points, Parameters
mirror = Mirror(Geometry=branch, Plane=item.Item5)  # -> Geometry, Transform
panel_9 = Panel("""-1
1""")
flip = FlipMatrix(Data=disc_2.Points)
repeat_3 = RepeatData(Data=graft(panel_9), Length=Slider(4, range=0..10))  # -> flatten(Data)
item_5 = ListItem(List=flip, Index=0, Wrap=True)  # -> Item, Item1
brep_7 = Brep(mirror.Geometry)
dup = DuplicateData(Data=panel_9, Number=Slider(4, range=0..10), Order=Toggle(False))
brep_8 = Brep(branch_2)
vec2pt_7 = Vector2Pt(PointA=item_5.Item, PointB=item_5.Item1, Unitize=False)  # -> Vector, Length
panel_10 = Panel(dup)
panel_11 = Panel(repeat_3)
dist = Distance()
brep_9 = Brep(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)
brep_10 = Brep(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)
pt_11 = Point(graft([Point(21, -16, 0), Point(24, -16, 0), Point(27, -16, 0), Point(31, -16, 0), Point(34, -16, 0)]))
pt_12 = Point([Point(24.20154273, -24.35507821, 0), Point(30.41685355, -24.55476691, 0)])
toggle = BooleanToggle(True)
pt_13 = Point([Point(21, -16, 0), Point(24, -16, 0), Point(27, -16, 0), Point(31, -16, 0), Point(34, -16, 0)])
pt_14 = Point([Point(24.20154273, -24.35507821, 0), Point(30.41685355, -24.55476691, 0)])
crv_cp = CurveClosestPoint()  # -> Point, Parameter, Distance
debrep_6 = DeconstructBrep(Brep=brep_9)  # -> Faces, Edges, Vertices
debrep_7 = DeconstructBrep(Brep=brep_10)  # -> Faces, Edges, Vertices
pull = PullPoint(ClosestOnly=True)  # -> ClosestPoint, Distance
dist_2 = Distance(PointA=pt_11, PointB=pt_12)
srf_cp = SurfaceClosestPoint()  # -> Point, UVPoint, Distance
pull_2 = PullPoint(Point=pt_13, Geometry=pt_14, ClosestOnly=True)  # -> ClosestPoint, Distance
rider = RIder(openFile=toggle)  # -> Folder; inputs openFile: Boolean
# ---------- rider: C# usings ----------
using System.IO;
using System.Diagnostics;

public class ScriptUtilities
{
  public static string GetCurrentFolder(GH_Document doc)
  {
    string filePath = doc.FilePath;
    return Path.GetDirectoryName(filePath);
  }

  public static string[] GetCsFiles(string folderPath)
  {
    return Directory.GetFiles(folderPath, "*.cs");
  }

  public static void OpenFileWithRider(string filePath, Action<string> print)
  {
    try
    {
      // Define the path to the JetBrains Rider executable
      string riderPath = @"C:\Program Files\JetBrains\JetBrains Rider 2024.1.4\bin\rider64.exe";

      if (!File.Exists(riderPath))
      {
        print("Rider executable not found at: " + riderPath);
        return;
      }

      // Start the process to open the file with Rider
      ProcessStartInfo startInfo = new ProcessStartInfo
        {
          FileName = riderPath,
          Arguments = "\"" + filePath + "\"", // Enclose in quotes in case of spaces
          UseShellExecute = true
          };
      Process.Start(startInfo);
    }
    catch (Exception ex)
    {
      print("Error opening file with Rider: " + ex.Message);
    }
  }

  public static void RunScript(bool openFile, ref object Here, IGH_Component owner, Action<string> print)
  {
    // Get the current folder path
    GH_Document doc = owner.OnPingDocument();
    string currentFolder = GetCurrentFolder(doc);
    Here = currentFolder;

    // Get .cs files in the current folder
    string[] csFiles = GetCsFiles(currentFolder);
    if (csFiles.Length > 0)
    {
      string csFilePath = csFiles[0];

      if (openFile)
      {
        OpenFileWithRider(csFilePath, print);
      }
    }
    else
    {
      print("No .cs files found in the directory.");
    }
  }
}
# ---------- rider: C# ----------
   ScriptUtilities.RunScript(openFile, ref Folder, Component, Print);
# ---------- end rider ----------
sort_3 = SortList(Keys=dist_2, ValuesA=pt_12)  # -> Keys, ValuesA
ln = Line(StartPoint=pt_13, EndPoint=pull_2.ClosestPoint)
brep_cp = BrepClosestPoint()  # -> Point, Normal, Distance
item_6 = ListItem(List=sort_3.ValuesA, Index=0, Wrap=True)

c_script = CSharpScript(obj=debrep_6.Edges, crv=debrep_6.Vertices, unit=debrep_7.Vertices, id=Slider(0, range=0..100), U=brep_10)  # -> out, A, B, C, D; inputs obj: list of Curve, crv: list of Point3d, unit: list of Point3d, id: Int32, U: Brep
# ---------- c_script: C# ----------
    List<Plane> p = new List<Plane>();
    for (int i = 0; i < crv.Count; i++)
    {
      var poc = PointsInCurves(obj, crv[i]);
      Vector3d normal = new Vector3d();
      for (int j = 0; j < poc.Count; j++)
      {
        var mid = CurveCenter(poc[j]);
        var tmpV = new Vector3d(mid - crv[i]);
        tmpV.Unitize();
        normal += tmpV; 
      }
      Plane pl = new Plane(crv[i], -normal, new Vector3d(0, 0, -normal.Z)); 
      p.Add(pl); 
    }

    var unitP = CloPts(unit, unit[id], 1);
    Vector3d unitNormal = new Vector3d(unitP[0] - unit[id]); 
    Plane unitPl = new Plane(unit[id], unitNormal, new Vector3d(0, 0, unitNormal.Z));
    List<Brep> ans = new List<Brep>(); 
    for (int i = 0; i < p.Count; i++)
    {
      Brep dU = U.DuplicateBrep();
      Brep oU = MoveOrientPlane(dU,  unitPl, p[i]);
      ans.Add(oU); 
    }

    A = ans; 
    B = unit[id];
    C = unitPl;
    D = p;
# ---------- c_script: C# additional code ----------
  public T MoveOrientPlane<T>(T obj, Plane baseNow, Plane baseNxt) where T : GeometryBase
  {
    Transform orient = Transform.PlaneToPlane(baseNow, baseNxt);
    obj.Transform(orient);
    return obj;
  }
  

  public Point3d CurveCenter(Curve c)
  {
    var arr = c.DivideByCount(2, true);
    var ans = c.PointAt(arr[1]);
    return ans; 
  }
  public List<Curve> PointsInCurves(List<Curve> crves, Point3d pt)
  {
    List<Curve> ans = new List<Curve>();
    for (int i = 0; i < crves.Count; i++)
    {
      double t;
      if (crves[i].ClosestPoint(pt, out t, 0.001))
      {
        ans.Add(crves[i]);
      }
    }

    return ans; 
  }
  
  public List<Point3d> CloPts(List<Point3d> pts, Point3d now, int cnt)
  {
    pts.Sort((u, v) => u.DistanceTo(now).CompareTo(v.DistanceTo(now)));
    List<Point3d> ans = new List<Point3d>();

    for (int i = 0; i < pts.Count; i++)
    {
      if (ans.Count == cnt) break;
      if (pts[i] == now) continue;
      ans.Add(pts[i]);
    }

    return ans;
  }
# ---------- end c_script ----------
scriptpar = ScriptParasite(Enable=toggle, Folder=rider)

ln_2 = Line(StartPoint=pt_11, EndPoint=item_6)
pln = Plane(c_script.C)
pln_2 = Plane(c_script.D)
pt_15 = Point([Point(24.20154273, -24.35507821, 0), Point(30.41685355, -24.55476691, 0)])
pt_16 = Point([Point(21, -16, 0), Point(24, -16, 0), Point(27, -16, 0), Point(31, -16, 0), Point(34, -16, 0)])
panel_12 = Panel(pull_2.Distance)
panel_13 = Panel(item_6)
cps_3 = ClosestPoints(Point=pt_16, Cloud=pt_15, Count="2")  # -> ClosestPoint, CPIndex, Distance
ln_3 = Line(StartPoint=pt_16, EndPoint=cps_3.ClosestPoint)
brep_11 = Brep(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)
number_slider = Slider(10, range=0..10)
toggle_2 = BooleanToggle(True)
debrep_8 = DeconstructBrep(Brep=brep_11)  # -> Faces, Edges, Vertices
rider_2 = RIder(openFile=toggle_2)  # -> Folder; inputs openFile: Boolean; same code as rider
item_7 = ListItem(List=debrep_8.Vertices, Index=Slider(45, range=0..100), Wrap=True)

c_script_2 = CSharpScript(edges=debrep_8.Edges, pt=item_7)  # -> out, A, B, C; inputs edges: list of Curve, pt: Point3d
# ---------- c_script_2: C# usings ----------
using Rhino.Runtime;
# ---------- c_script_2: C# ----------
    var crves = PointsInCurves(edges, pt);
    List<Vector3d> v = new List<Vector3d>();
    Vector3d normal = new Vector3d();
    List<Point3d> en = new List<Point3d>();
    for (int i = 0; i < crves.Count; i++)
    {
      var b = CurveCenter(crves[i]);
      Vector3d tmp = b - pt;
      tmp.Unitize();
      en.Add(MovePt(pt, tmp, 15));
      normal += tmp;
      v.Add(tmp);
    }

    Surface srf = NurbsSurface.CreateFromCorners(en[0], en[1], en[2]);
    C = srf;
    A = normal;
    B = v;
# ---------- c_script_2: C# additional code ----------
  public Point3d MovePt(Point3d p, Vector3d v, double amp)
  {
    v.Unitize();
    Transform move = Transform.Translation(v * amp);
    p.Transform(move);
    return p;
  }
  public Point3d CurveCenter(Curve c)
  {
    var arr = c.DivideByCount(2, true);
    var ans = c.PointAt(arr[1]);
    return ans;
  }
  public List<Curve> PointsInCurves(List<Curve> crves, Point3d pt)
  {
    List<Curve> ans = new List<Curve>();
    for (int i = 0; i < crves.Count; i++)
    {
      double t;
      if (crves[i].ClosestPoint(pt, out t, 0.001))
      {
        ans.Add(crves[i]);
      }
    }

    return ans;
  }
# ---------- end c_script_2 ----------
scriptpar_2 = ScriptParasite(Enable=toggle_2, Folder=rider_2)

number_slider_2 = Slider(15, range=0..100)
amp = Amplitude(Vector=c_script_2.B, Amplitude=number_slider_2)
srf = Surface(c_script_2.C)
amp_2 = Amplitude(Vector=c_script_2.A, Amplitude=number_slider_2)
vdis = VectorDisplay(Anchor=item_7, Vector=amp_2)
rev_2 = Reverse(Vector=amp_2)
vdis_2 = VectorDisplay(Anchor=item_7, Vector=amp)
vdis_3 = VectorDisplay(Anchor=item_7, Vector=rev_2)
