# Grasshopper definition 12_make a brick.gh (Grasshopper 1.0.7)
# plug-ins: ScriptParasite

srf = Surface(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)
srfsplit = SurfaceSplit()
sdivide = DivideSurface(Surface=srf, UCount=Slider(3, range=0..100), VCount=10)  # -> Points, Normals, Parameters
bbox = BoundingBox(Content=sdivide.Points, Plane=PlaneXY(0, 0, 0), UnionBox=True)  # -> Box, Box_2
number_slider = Slider(40, range=0..100)
number_slider_2 = Slider(40, range=0..100)
scale = Scale(Geometry=bbox.Box, Center=Point(0, 0, 0), Factor=Slider(1.7, range=0..10))  # -> Geometry, Transform
number_slider_3 = Slider(40, range=0..100)
srf_2 = Surface(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)
bbx = BrepBrep(BrepA=srf, BrepB=scale.Geometry)  # -> flatten(Curves), Points
srf_3 = Surface(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)
srf_4 = Surface(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)
srf_5 = Surface(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)
srf_6 = Surface(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)
divide = DivideDomain²(Domain=srf_2, UCount=Slider(8, range=0..20), VCount="1")
srf_7 = Surface(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)
srf_8 = Surface(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)
srfsplit_2 = SurfaceSplit(Surface=srf, Curves=bbx.Curves)
divide_2 = DivideDomain²(Domain=srf_5, UCount=Slider(8, range=0..20), VCount=number_slider)
divide_3 = DivideDomain²(Domain=srf_6, UCount=Slider(8, range=0..20), VCount=number_slider_2)
divide_4 = DivideDomain²(Domain=srf_7, UCount=Slider(8, range=0..20), VCount=number_slider_3)
subsrf = Isotrim(Surface=srf_2, Domain=divide)  # -> graft(Surface)
subsrf_2 = Isotrim(Surface=srf_5, Domain=divide_2)
subsrf_3 = Isotrim(Surface=srf_6, Domain=divide_3)
toggle = BooleanToggle(True)
divide_5 = DivideDomain²(Domain=srf_3, UCount=Slider(4, range=0..10), VCount="1")
divide_6 = DivideDomain²(Domain=srf_4, UCount=Slider(4, range=0..10), VCount="1")
subsrf_4 = Isotrim(Surface=srf_7, Domain=divide_4)
divide_7 = DivideDomain²(Domain=srfsplit_2, UCount="1", VCount=Slider(6, range=0..10))
tstat = TreeStatistics(Tree=subsrf)  # -> Paths, Length, Count
divide_8 = DivideDomain²(Domain=srf_8, UCount=Slider(4, range=0..10), VCount="1")
partition = PartitionList(List=subsrf_2, Size=number_slider)
partition_2 = PartitionList(List=subsrf_3, Size=number_slider_2)
subsrf_5 = Isotrim(Surface=srf_3, Domain=divide_5)  # -> graft(Surface)
tstat_2 = TreeStatistics(Tree=partition)  # -> Paths, Length, Count
partition_3 = PartitionList(List=subsrf_4, Size=number_slider_3)
tstat_3 = TreeStatistics(Tree=partition_2)  # -> Paths, Length, Count
subsrf_6 = Isotrim(Surface=srfsplit_2, Domain=divide_7)
subsrf_7 = Isotrim(Surface=srf_4, Domain=divide_6)  # -> graft(Surface)
dispatch = Dispatch(List=tstat.Paths, DispatchPattern=[True, False])  # -> ListA, ListB
rider = RIder(openFile=toggle)  # -> Folder; inputs openFile: Boolean
# ---------- rider: C# usings ----------
using System.IO;
using System.Diagnostics;

public class ScriptUtilities
{
  public static string GetCurrentFolder(GH_Document doc)
  {
    string filePath = doc.FilePath;
    return Path.GetDirectoryName(filePath);
  }

  public static string[] GetCsFiles(string folderPath)
  {
    return Directory.GetFiles(folderPath, "*.cs");
  }

  public static void OpenFileWithRider(string filePath, Action<string> print)
  {
    try
    {
      // Define the path to the JetBrains Rider executable
      string riderPath = @"C:\Program Files\JetBrains\JetBrains Rider 2024.1.4\bin\rider64.exe";

      if (!File.Exists(riderPath))
      {
        print("Rider executable not found at: " + riderPath);
        return;
      }

      // Start the process to open the file with Rider
      ProcessStartInfo startInfo = new ProcessStartInfo
        {
          FileName = riderPath,
          Arguments = "\"" + filePath + "\"", // Enclose in quotes in case of spaces
          UseShellExecute = true
          };
      Process.Start(startInfo);
    }
    catch (Exception ex)
    {
      print("Error opening file with Rider: " + ex.Message);
    }
  }

  public static void RunScript(bool openFile, ref object Here, IGH_Component owner, Action<string> print)
  {
    // Get the current folder path
    GH_Document doc = owner.OnPingDocument();
    string currentFolder = GetCurrentFolder(doc);
    Here = currentFolder;

    // Get .cs files in the current folder
    string[] csFiles = GetCsFiles(currentFolder);
    if (csFiles.Length > 0)
    {
      string csFilePath = csFiles[0];

      if (openFile)
      {
        OpenFileWithRider(csFilePath, print);
      }
    }
    else
    {
      print("No .cs files found in the directory.");
    }
  }
}
# ---------- rider: C# ----------
   ScriptUtilities.RunScript(openFile, ref Folder, Component, Print);
# ---------- end rider ----------
tstat_4 = TreeStatistics(Tree=partition_3)  # -> Paths, Length, Count
subsrf_8 = Isotrim(Surface=srf_8, Domain=divide_8)  # -> graft(Surface)
number_slider_4 = Slider(63, range=0..100)
series = Series(Start=0, Step=1, Count=tstat_2.Count)  # -> graft(Series)
series_2 = Series(Start=0, Step=1, Count=tstat_3.Count)  # -> graft(Series)
srf_9 = Surface(<surface referenced from the Rhino model>)
branch = TreeBranch(Tree=subsrf, Path=dispatch.ListB, MaintainPaths=True)  # -> simplify(Branch)
edges = BrepEdges(Brep=subsrf_5)  # -> simplify(Naked), Interior, NonManifold
branch_2 = TreeBranch(Tree=subsrf, Path=dispatch.ListA, MaintainPaths=True)
series_3 = Series(Start=0, Step=1, Count=tstat_4.Count)  # -> graft(Series)
edges_2 = BrepEdges(Brep=subsrf_7)  # -> simplify(Naked), Interior, NonManifold
edges_3 = BrepEdges(Brep=subsrf_8)  # -> simplify(Naked), Interior, NonManifold
shift = ShiftList(List=partition, Shift=series, Wrap=True)
shift_2 = ShiftList(List=partition_2, Shift=series_2, Wrap=True)
contour = Contour(Point=Point(0, 0, 0), Direction=Vector(0, 0, 1))
divide_9 = DivideDomain²(Domain=srf_9, UCount=Slider(10, range=0..100), VCount=Slider(1, range=0..100))
edges_4 = BrepEdges(Brep=branch_2)  # -> simplify(Naked), Interior, NonManifold
shift_3 = ShiftList(List=partition_3, Shift=series_3, Wrap=True)
item = ListItem(List=edges.Naked, Index=0, Wrap=True)  # -> flatten(Item), flatten(Item1)
number_slider_5 = Slider(25, range=0..100)
tstat_5 = TreeStatistics(Tree=edges_2.Naked)  # -> Paths, Length, Count
partition_4 = PartitionList(List=shift, Size="2")  # -> simplify(Chunks)
partition_5 = PartitionList(List=shift_2, Size="2")  # -> simplify(Chunks)
subsrf_9 = Isotrim(Surface=srf_9, Domain=divide_9)

scriptpar = ScriptParasite(Enable=toggle, Folder=rider)
c_script = CSharpScript(x=subsrf_9, y=Slider(100, range=0..100))  # -> out, A, B; inputs x: list of Surface, y: Int32
# ---------- c_script: C# usings ----------
using System.Linq;
# ---------- c_script: C# ----------
    List<Curve> contour = new List<Curve>();
    for (int i = 0; i < x.Count; i++)
    {
      var crv = x[i].ToBrep().DuplicateEdgeCurves();
      contour.Add(crv[2]);
      if (i == x.Count - 1) contour.Add(crv[1]); 
    }

    List<Curve> vertical = new List<Curve>(); 
    Curve st = contour[0];
    var pts = DividePts(st, y, true); 
    
    for (int i = 0; i < contour.Count - 1; i++)
    {
      var now = contour[i];
      var nxt = contour[i + 1];
      List<Point3d> nxtPts = new List<Point3d>(); 
      for (int j = 0; j < pts.Count; j++)
      {
        double t;
        nxt.ClosestPoint(pts[j], out t);
        var nxtPt = nxt.PointAt(t);
        nxtPts.Add(nxtPt);
        if (i % 2 == 0)
        {
          if(j % 2 == 0) vertical.Add(new Line(pts[j], nxtPt).ToNurbsCurve());
        }
        else
        {
          if (j % 2 == 1) vertical.Add(new Line(pts[j], nxtPt).ToNurbsCurve()); 
        }
      }

      pts = nxtPts; 


    }

    B = vertical; 
    A = contour;
# ---------- c_script: C# additional code ----------
  
  public static List<Point3d> DividePts(Curve crv, int cnt, bool end)
  {
    List<Point3d> ret = new List<Point3d>();
    var crvT = crv.DivideByCount(cnt, end);
    for (int i = 0; i < crvT.Length; i++)
    {
      var pt = crv.PointAt(crvT[i]);
      ret.Add(pt);
    }

    return ret;
  }
# ---------- end c_script ----------

tstat_6 = TreeStatistics(Tree=edges_3.Naked)  # -> Paths, Length, Count
item_2 = ListItem(List=edges_4.Naked, Index=0, Wrap=True)
partition_6 = PartitionList(List=shift_3, Size="2")  # -> simplify(Chunks)
number_slider_6 = Slider(20, range=0..100)
dispatch_2 = Dispatch(List=tstat_5.Paths, DispatchPattern=[True, False])  # -> ListA, ListB
dispatch_3 = Dispatch(List=item.Item1, DispatchPattern=[True, False])  # -> graft(ListA), ListB
join = BrepJoin(Breps=partition_4)  # -> Breps, Closed
join_2 = BrepJoin(Breps=partition_5)  # -> Breps, Closed
branch_3 = TreeBranch(Tree=edges_2.Naked, Path=dispatch_2.ListA, MaintainPaths=True)
flip = FlipCurve(Curve=edges_4.Naked, Guide=item_2)  # -> graft(Curve), Flag
dispatch_4 = Dispatch(List=tstat_6.Paths, DispatchPattern=[True, False])  # -> ListA, ListB
join_3 = BrepJoin(Breps=partition_6)  # -> Breps, Closed
branch_4 = TreeBranch(Tree=edges_2.Naked, Path=dispatch_2.ListB, MaintainPaths=True)
Z = UnitZ(Factor=1)
edges_5 = BrepEdges(Brep=join_2.Breps)  # -> Naked, Interior, NonManifold
item_3 = ListItem(List=branch_3, Index=0, Wrap=True)
edges_6 = BrepEdges(Brep=join.Breps)  # -> Naked, Interior, NonManifold
geo = Geometry(c_script.A)
geo_2 = Geometry(c_script.B)
viewer = ParamViewer(flip.Curve)
multiplication = Multiplication(A=number_slider_6, B="2")
divide_10 = DivideCurve(Curve=flip.Curve, Count=number_slider_6, Kinks=False)  # -> Points, Tangents, Parameters
divide_11 = DivideCurve(Curve=dispatch_3.ListA, Count=number_slider_5, Kinks=False)  # -> Points, Tangents, Parameters
branch_5 = TreeBranch(Tree=edges_3.Naked, Path=dispatch_4.ListB, MaintainPaths=True)
branch_6 = TreeBranch(Tree=edges_3.Naked, Path=dispatch_4.ListA, MaintainPaths=True)
edgesdir = EdgesFromDirections(Brep=join_3.Breps, Directions=Z, Reflex=True, Angle="0.25*pi")  # -> Edges, Indices, Map
loft = Loft(Curves=branch_4, Options={Adjust=False, Closed=False, LoftEnds=0, LoftSimp=0, LoftType=0, Rebuild=10, Refit=0.01})
edgesrf = EdgeSurface()
flip_2 = FlipCurve(Curve=branch_3, Guide=item_3)  # -> graft(Curve), Flag
end = EndPoints(Curve=edges_5.Naked)  # -> Start, End
tmatch = MatchText(Text=edges_6.Naked, RegEx="Line*", Case=True)
divide_12 = DivideCurve(Curve=flip.Curve, Count=multiplication, Kinks=False)  # -> Points, Tangents, Parameters
shatter = Shatter(Curve=flip.Curve, Parameters=divide_10.Parameters)
shatter_2 = Shatter(Curve=dispatch_3.ListA, Parameters=divide_11.Parameters)
crv = Curve(edgesdir.Edges)
srf4pt = _4PointSurface()
item_4 = ListItem(List=geo_2, Index=Slider(0, range=0..100), Wrap=True)
vec2pt = Vector2Pt(PointA=end.Start, PointB=end.End, Unitize=invert(False))  # -> Vector, Length
item_5 = ListItem(List=crv, Index=0, Wrap=True)
Z_2 = UnitZ(Factor=1)
item_6 = ListItem(List=divide_12.Parameters, Index="1", Wrap=True)
dispatch_5 = Dispatch(List=edges_6.Naked, DispatchPattern=tmatch)  # -> ListA, ListB
divide_13 = DivideCurve(Curve=flip_2.Curve, Count=Slider(8, range=0..100), Kinks=False)  # -> Points, Tangents, Parameters
midpt = CurveMiddle(Curve=shatter_2)
midpt_2 = CurveMiddle(Curve=shatter)
extr = ExtrudePoint()
number_slider_7 = Slider(0.5, range=0..1)
flip_3 = FlipCurve(Curve=crv, Guide=item_5)  # -> Curve, Flag
loft_2 = Loft(Curves=crv, Options={Adjust=True, Closed=False, LoftEnds=0, LoftSimp=0, LoftType=0, Rebuild=10, Refit=0.01})
join_4 = JoinCurves(Curves=dispatch_5.ListB, Preserve=False)
dprod = DotProduct(VectorA=vec2pt.Vector, VectorB=Z_2, Unitize=False)
crv_cp = CurveClosestPoint(Point=midpt, Curve=graft(dispatch_3.ListB))  # -> Point, Parameter, Distance
crv_cp_2 = CurveClosestPoint(Point=midpt_2, Curve=flip.Curve)  # -> Point, Parameter, Distance
shatter_3 = Shatter(Curve=flip_2.Curve, Parameters=divide_13.Parameters)
seam = Seam(Curve=flip.Curve, Seam=item_6)  # -> simplify(Curve)
patch = Patch(Spans=20, Flexibility=1, Trim=True)
curvepoint = PointOnCurve(parameter=0.5)
merge = Merge(Data1=simplify(dispatch_5.ListA), Data2=simplify(join_4))
loft_3 = Loft(Curves=flip_3.Curve, Options={Adjust=False, Closed=False, LoftEnds=0, LoftSimp=0, LoftType=0, Rebuild=10, Refit=0.01})
bool = Boolean(dprod)
item_7 = ListItem(List=crv_cp_2.Parameter, Index=0, Wrap=True)
item_8 = ListItem(List=crv_cp_2.Point, Index=0, Wrap=True)
dispatch_6 = Dispatch(List=edges_5.Naked, DispatchPattern=bool)  # -> ListA, ListB
pshift = ShiftPaths(Data=seam, Offset=-1)
midpt_3 = CurveMiddle(Curve=shatter_3)
merge_2 = Merge(Data1=divide_11.Points, Data2=crv_cp.Point)
item_9 = ListItem(List=merge, Index=0, Wrap=True)  # -> Item, Item1, Item2, Item3
crv_cp_3 = CurveClosestPoint(Point=midpt_3, Curve=flip_2.Curve)  # -> Point, Parameter, Distance
seam_2 = Seam(Curve=flip.Curve, Seam=item_7)
join_5 = JoinCurves(Curves=dispatch_6.ListB, Preserve=False)
loft_4 = Loft(Curves=pshift, Options={Adjust=False, Closed=False, LoftEnds=0, LoftSimp=0, LoftType=0, Rebuild=10, Refit=0.01})
item_10 = ListItem(List=crv_cp_3.Parameter, Index=0, Wrap=True)
edgesrf_2 = EdgeSurface(CurveA=item_9.Item, CurveB=item_9.Item1, CurveC=item_9.Item2, CurveD=item_9.Item3)
pshift_2 = ShiftPaths(Data=seam_2, Offset="-2")
merge_3 = Merge(Data1=simplify(dispatch_6.ListA), Data2=simplify(join_5))
partition_7 = PartitionList(List=merge_2, Size=number_slider_5)  # -> simplify(Chunks)
seam_3 = Seam(Curve=flip_2.Curve, Seam=item_10)
merge_4 = Merge(Data1=branch, Data2=loft_4)
loft_5 = Loft(Curves=pshift_2, Options={Adjust=False, Closed=False, LoftEnds=0, LoftSimp=0, LoftType=0, Rebuild=10, Refit=0.01})
item_11 = ListItem(List=merge_3, Index=0, Wrap=True)  # -> Item, Item1, Item2, Item3
pshift_3 = ShiftPaths(Data=seam_3, Offset="-2")
merge_5 = Merge(Data1=loft_5, Data2=branch)
divide_14 = DivideDomain²(Domain=merge_4, UCount="1", VCount=number_slider_6)
edgesrf_3 = EdgeSurface(CurveA=item_11.Item, CurveB=item_11.Item1, CurveC=item_11.Item2, CurveD=item_11.Item3)
loft_6 = Loft(Curves=pshift_3, Options={Adjust=False, Closed=False, LoftEnds=0, LoftSimp=0, LoftType=0, Rebuild=10, Refit=0.01})
divide_15 = DivideDomain²(Domain=merge_5, UCount="1", VCount=number_slider_6)
panel = Panel(seam_3)
subsrf_10 = Isotrim(Surface=merge_4, Domain=divide_14)
subsrf_11 = Isotrim(Surface=merge_5, Domain=divide_15)
