# Grasshopper definition 13_Grasshopper Parametric Light.gh (Grasshopper 1.0.7)

merge = Merge(Data1=Slider(1.1, range=0..10), Data2=Slider(2.3, range=0..10))
repeat = RepeatData(Data=merge, Length=Slider(22, range=0..100))
number_slider = Slider(0.25, range=0..1)
ma = MassAddition(Input=repeat)  # -> Result, PartialResults
bnd = Bounds(Numbers=ma.PartialResults)
dom = ConstructDomain(DomainStart=Slider(20, range=0..100), DomainEnd=Slider(50, range=0..100))
number_slider_2 = Slider(1.9, range=0..5)
remap = RemapNumbers(Value=ma.PartialResults, Source=bnd, Target=dom)  # -> Mapped, Clipped
xz = XZPlane(Origin=Point(0, 0, 0))
expression = Expression(x=number_slider, Expression="If(x ≥ 0.5, x - 0.5, x + 0.5)")
cir = Circle(Plane=xz, Radius=remap.Mapped)
panel = Panel("""0
-1""")
amp = Amplitude(Vector=xz, Amplitude=number_slider_2)
partition = PartitionList(List=cir, Size="2")
item = ListItem(List=cir, Index=panel, Wrap=True)
rev = Reverse(Vector=amp)
c_script = CSharpScript(
    size=Slider(54.3, range=0..100),
    interval=Slider(14.5, range=0..100),
    count=Slider(12, range=0..100),
    rot=Slider(1.6, range=0..10))  # -> out, graft(A); inputs size: Double, interval: Double, count: Int32, rot: Double
# ---------- c_script: C# usings ----------
using System.Linq;
# ---------- c_script: C# ----------
    List<double> li = Enumerable.Repeat(0.0, count).ToList();
    li[0] = size; 
    for (int i = 1; i < li.Count; i++)
    {
      li[i] = li[i - 1] + interval;
    }

    var rotAngle = RangeInterval(0, rot, count); 
    List<Curve> crv = new List<Curve>();
    for (int i = 0; i < li.Count; i++)
    {
      double r = li[i];
      var cir = new Circle(Plane.WorldYZ, r).ToNurbsCurve(); 
      cir.Rotate(rotAngle[i], Vector3d.ZAxis, Plane.WorldXY.Origin); 
      crv.Add(cir); 
    }

    A = crv;
# ---------- c_script: C# additional code ----------
  public static List<double> RangeInterval(double x, double y, int cnt)
  {
    List<double> amp = new List<double>();
    if (cnt == 1) return amp;
    double gap = (y - x) / (cnt - 1);
    for (int i = 0; i < cnt; i++)
    {
      amp.Add(x + gap * i);
    }

    return amp;
  }
# ---------- end c_script ----------
loft = Loft(Curves=partition, Options={Adjust=False, Closed=False, LoftEnds=0, LoftSimp=0, LoftType=0, Rebuild=10, Refit=0.01})  # -> flatten(Loft)
merge_2 = Merge(Data1=number_slider, Data2=expression)
merge_3 = Merge(Data1=amp, Data2=rev)  # -> graft(Result)
eval = EvaluateCurve(Curve=reparameterize(item), Parameter=graft(merge_2))  # -> Point, Tangent, Angle
pframes = PerpFrames(Curve=c_script.A, Count=Slider(9, range=0..100), Align=True)  # -> Frames, Parameters
move = Move(Geometry=loft, Motion=merge_3)  # -> Geometry, Transform
pline = PolyLine(Vertices=eval.Point, Closed=False)
edges = BrepEdges(Brep=move.Geometry)  # -> Naked, Interior, NonManifold
flip = FlipMatrix(Data=move.Geometry)
ext = ExtendCurve(Curve=pline, Type=0, Start=Slider(0.44, range=0..10), End=Slider(5, range=0..10))
cir_2 = Circle(Plane=pframes.Frames, Radius=Slider(5, range=0..10))
pshift = ShiftPaths(Data=edges.Naked, Offset=-1)
multiplication = Multiplication(A=number_slider_2, B=Slider(0.6, range=0..0.99))
loft_2 = Loft(Curves=cir_2, Options={Adjust=False, Closed=True, LoftEnds=0, LoftSimp=0, LoftType=0, Rebuild=10, Refit=0.01})
flip_2 = FlipMatrix(Data=pshift)
pipe = Pipe(Curve=ext, Radius=multiplication, Caps=0)
loft_3 = Loft(Curves=flip_2, Options={Adjust=False, Closed=False, LoftEnds=0, LoftSimp=0, LoftType=0, Rebuild=10, Refit=0.01})  # -> flatten(Loft)
partition_2 = PartitionList(List=loft_3, Size="2")
cap = CapHoles(Brep=pipe)
merge_4 = Merge(Data1=partition_2, Data2=flip)
join = BrepJoin(Breps=merge_4)  # -> flatten(Breps), Closed
lng = ListLength(List=join.Breps)
pi = Pi(Factor=1)
range = Range(Domain=Domain(0, 1), Steps=expr("x-1", lng))
multiplication_2 = Multiplication(A=pi, B=Slider(0.7, range=0..1))
item_2 = ListItem(List=flatten(pline), Index=0, Wrap=True)
dom_2 = ConstructDomain(DomainStart=0, DomainEnd=multiplication_2)
bnd_2 = Bounds(Numbers=range)
remap_2 = RemapNumbers(Value=range, Source=bnd_2, Target=dom_2)  # -> Mapped, Clipped
rotax = RotateAxis(Geometry=join.Breps, Angle=remap_2.Mapped, Axis=item_2)  # -> Geometry, Transform
sdiff = SolidDifference(BrepsA=rotax.Geometry, BrepsB=flatten(cap))
