# Grasshopper definition 14_Kinetic facade Tutorial_(from adam youtube).gh (Grasshopper 1.0.7)
# plug-ins: ScriptParasite

number_slider = Slider(39, range=0..100)
xy = XYPlane(Origin=Point(0, 0, 0))
number_slider_2 = Slider(92, range=0..1000)
rectangle = Rectangle(Plane=xy, XSize=number_slider, YSize=number_slider, Radius=0)  # -> Rectangle, Length
division = Division(A=number_slider, B="2")
boxrec = BoxRectangle(Rectangle=rectangle.Rectangle, Height=division)
range = Range(Domain=Domain(0, 1), Steps=expr("x - 1", number_slider_2))
toggle = BooleanToggle(True)
debrep = DeconstructBrep(Brep=boxrec)  # -> Faces, Edges, Vertices
xz = XZPlane(Origin=Point(0, 0, 0))
pi = Pi(Factor=Slider(0.2, range=0..1))
graph = GraphMapper(range, x0=0, x1=1, y0=0, y1=1, container_name="Sine", Equation_px=[0, 0.1660678089], Equation_py=[0, 0.8636108637])
pt = ConstructPoint(XCoordinate=0, YCoordinate=Slider(0.26, range=0..1), ZCoordinate=0)
item = ListItem(List=debrep.Faces, Index=0, Wrap=True)
rider = RIder(openFile=toggle)  # -> Folder; inputs openFile: Boolean
# ---------- rider: C# usings ----------
using System.IO;
using System.Diagnostics;

public class ScriptUtilities
{
  public static string GetCurrentFolder(GH_Document doc)
  {
    string filePath = doc.FilePath;
    return Path.GetDirectoryName(filePath);
  }

  public static string[] GetCsFiles(string folderPath)
  {
    return Directory.GetFiles(folderPath, "*.cs");
  }

  public static void OpenFileWithRider(string filePath, Action<string> print)
  {
    try
    {
      // Define the path to the JetBrains Rider executable
      string riderPath = @"C:\Program Files\JetBrains\JetBrains Rider 2024.1.4\bin\rider64.exe";

      if (!File.Exists(riderPath))
      {
        print("Rider executable not found at: " + riderPath);
        return;
      }

      // Start the process to open the file with Rider
      ProcessStartInfo startInfo = new ProcessStartInfo
        {
          FileName = riderPath,
          Arguments = "\"" + filePath + "\"", // Enclose in quotes in case of spaces
          UseShellExecute = true
          };
      Process.Start(startInfo);
    }
    catch (Exception ex)
    {
      print("Error opening file with Rider: " + ex.Message);
    }
  }

  public static void RunScript(bool openFile, ref object Here, IGH_Component owner, Action<string> print)
  {
    // Get the current folder path
    GH_Document doc = owner.OnPingDocument();
    string currentFolder = GetCurrentFolder(doc);
    Here = currentFolder;

    // Get .cs files in the current folder
    string[] csFiles = GetCsFiles(currentFolder);
    if (csFiles.Length > 0)
    {
      string csFilePath = csFiles[0];

      if (openFile)
      {
        OpenFileWithRider(csFilePath, print);
      }
    }
    else
    {
      print("No .cs files found in the directory.");
    }
  }
}
# ---------- rider: C# ----------
   ScriptUtilities.RunScript(openFile, ref Folder, Component, Print);
# ---------- end rider ----------
rectangle_2 = Rectangle(Plane=xz, XSize=Slider(89, range=0..100), YSize=Slider(24, range=0..100), Radius=0)  # -> Rectangle, Length
iso = IsoCurve(Surface=reparameterize(item), UVPoint=pt)  # -> UIsocurve, VIsocurve
bnd = Bounds(Numbers=graph)
dom = ConstructDomain(DomainStart=Slider(0, range=0..1), DomainEnd=pi)
srfsplit = SurfaceSplit(Surface=item, Curves=iso.UIsocurve)
remap = RemapNumbers(Value=graph, Source=bnd, Target=dom)  # -> Mapped, Clipped

scriptpar = ScriptParasite(Enable=toggle, Folder=rider)
c_script = CSharpScript(
    rectangle=rectangle_2.Rectangle,
    yDir=Slider(0.2, range=0..1),
    xDir=Slider(0.1, range=0..1),
    cnt=number_slider_2,
    shape=remap.Mapped,
    depth=Slider(1.13, range=0..2),
    interval=Slider(0.09, range=0..2))  # -> out, A, B; inputs rectangle: Rectangle3d, yDir: Double, xDir: Double, cnt: Int32, shape: list of Double, depth: Double, interval: Double
# ---------- c_script: C# usings ----------
using System.Linq;
using Plane = Grasshopper.Kernel.Geometry.Plane;
# ---------- c_script: C# ----------
    Curve crv = rectangle.ToNurbsCurve();
    Surface srf = PlanarSrf(crv);
    srf = IntervalTrim(xDir, yDir, srf);
    var range = RangeInterval(0, 1, cnt);
    List<Curve> crves = new List<Curve>();
    for (int i = 0; i < cnt; i++)
    {
      var isoC = IsoCurveU(srf, range[i]);
      isoC.Rotate(shape[i], Vector3d.XAxis, CurveCenter(isoC));
      crves.Add(isoC);
    }

    List<Brep> ret = new List<Brep>();
    for (int i = 0; i < cnt; i++)
    {
      var now = crves[i];
      var osNow = now.Offset(Rhino.Geometry.Plane.WorldYZ, depth, 0.01, 0);
      var nurbSrf = NurbsSurface.CreateRuledSurface(now, osNow[0]).ToBrep().Faces[0];
      var extSrf = Brep.CreateFromOffsetFace(nurbSrf, interval, 0.01, true, true); 
      ret.Add(extSrf);
    }
    B = ret;  
    A = crves;
# ---------- c_script: C# additional code ----------
  public Point3d CurveCenter(Curve c)
  {
    var arr = c.DivideByCount(2, true);
    var ans = c.PointAt(arr[1]);
    return ans;
  }
  public Surface PlanarSrf(Curve c)
  {
    string log;
    Surface ret = null;
    if (c.IsValidWithLog(out log) && c.IsPlanar() && c.IsClosed)
    {
      var tmp = Brep.CreatePlanarBreps(c, 0.01);
      ret = tmp[0].Faces[0];
      return ret;
    }
    return ret;
  }

  public Curve IsoCurveU(Surface srf, double uDir)
  {
    var ret = srf.IsoCurve(1, srf.Domain(0).T0 + uDir * (srf.Domain(0).T1 - srf.Domain(0).T0));
    return ret;
  }

  public static List<double> RangeInterval(double x, double y, int cnt)
  {
    List<double> amp = new List<double>();
    if (cnt == 1) return amp;
    double gap = (y - x) / (cnt - 1);
    for (int i = 0; i < cnt; i++)
    {
      amp.Add(x + gap * i);
    }
    return amp;
  }
  
  public Surface IntervalTrim(double xDir, double yDir, Surface srf)
  {
    return srf.Trim(new Interval(srf.Domain(0).T1 * xDir, srf.Domain(0).T1),
      new Interval(srf.Domain(1).T1 * yDir, srf.Domain(1).T1));
  }
# ---------- end c_script ----------

item_2 = ListItem(List=srfsplit, Index=0, Wrap=True)
planar = IsPlanar(Surface=item_2, Interior=True)  # -> Planar, Plane
range_2 = Range(Domain=Domain(0, 1), Steps=expr("x - 1", Slider(108, range=0..1000)))
amp = Amplitude(Vector=planar.Plane, Amplitude=Slider(5, range=0..10))
move = Move(Geometry=item_2, Motion=amp)  # -> Geometry, Transform
pt_2 = ConstructPoint(XCoordinate=range_2, YCoordinate=0, ZCoordinate=0)
crv = Curve(c_script.A)
brep = Brep(c_script.B)
iso_2 = IsoCurve(Surface=reparameterize(move.Geometry), UVPoint=pt_2)  # -> UIsocurve, flatten(VIsocurve)
graph_2 = GraphMapper(range_2, x0=0, x1=1, y0=0, y1=1, container_name="Gaussian", factor=0.6518117189, mean=0.5, sdev=0.2645997852)
lng = ListLength(List=iso_2.VIsocurve)
multiplication = Multiplication(A=Slider(0.46, range=0..1), B=lng)
dom_2 = ConstructDomain(DomainStart=Slider(32.2, range=0..100), DomainEnd=Slider(7.7, range=0..100))
item_3 = ListItem(List=iso_2.VIsocurve, Index=multiplication, Wrap=True)
remap_2 = RemapNumbers(Value=graph_2, Source="0 to 1", Target=dom_2)  # -> Mapped, Clipped
midpt = CurveMiddle(Curve=item_3)
midpt_2 = CurveMiddle(Curve=iso_2.VIsocurve)
number_slider_3 = Slider(20, range=0..1000)
pl = ConstructPlane(Origin=midpt_2, XAxis=amp, YAxis=iso_2.VIsocurve)
pull = PullPoint(Point=midpt_2, Geometry=midpt, ClosestOnly=True)  # -> ClosestPoint, Distance
sort = SortList(Keys=pull.Distance, ValuesA=iso_2.VIsocurve)  # -> Keys, ValuesA
number_slider_4 = Slider(0.5, range=0..1)
item_4 = ListItem(List=sort.ValuesA, Index=Slider(100, range=0..100), Wrap=True)
rotate = Rotate(Geometry=sort.ValuesA, Angle=degrees(remap_2.Mapped), Plane=pl)  # -> graft(Geometry), Transform
offset = OffsetCurve(Curve=rotate.Geometry, Distance=number_slider_4, Plane=graft(pl), Corners=1)
division_2 = Division(A=number_slider_4, B=Slider(3.81, range=0..10))
rulesrf = RuledSurface(CurveA=rotate.Geometry, CurveB=offset)
planar_2 = IsPlanar(Surface=rulesrf, Interior=True)  # -> Planar, Plane
amp_2 = Amplitude(Vector=planar_2.Plane, Amplitude=division_2)
rev = Reverse(Vector=amp_2)
merge = Merge(Data1=amp_2, Data2=rev)
extr = Extrude(Base=rulesrf, Direction=rev)
sunion = SolidUnion(Breps=extr)
fmerge = MergeFaces(Brep=sunion)  # -> Breps, Before, After
