# Grasshopper definition 15_making a gable roof.gh (Grasshopper 1.0.7)

crv = Curve([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])
explode = Explode(Curve=crv, Recursive=True)  # -> Segments, Vertices
disc = Discontinuity(Curve=crv, Level=1)  # -> Points, Parameters
pi = Pi(Factor=Slider(0.2, range=0..2))
pline = PolyLine(Vertices=disc.Points, Closed=invert(False))
kinkcrv = KinkyCurve(Vertices=explode.Vertices, Degree=Slider(3, range=0..10), Angle=pi)  # -> Curve, Length, Domain
crv_2 = Curve([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])
disc_2 = Discontinuity(Curve=kinkcrv.Curve, Level=1)  # -> Points, Parameters
c_script = CSharpScript(x=crv_2)  # -> out, A, B; inputs x: list of Curve
# ---------- c_script: C# usings ----------
using System.Data;
using System.Linq;
# ---------- c_script: C# ----------
    List<Curve> pureCurve = new List<Curve>();
    List<List<Point3d>> purePts = new List<List<Point3d>>(); 
    for (int i = 0; i < x.Count; i++)
    {
      var pts = PureDiscontinuity(x[i]);
      purePts.Add(pts); 
      pts.Add(pts[0]); 
      var crv = Curve.CreateControlPointCurve(pts, 1);
      pureCurve.Add(crv); 
    }
    A = pureCurve;
    B = MakeDataTree2D(purePts);
# ---------- c_script: C# additional code ----------
  public static DataTree<T> MakeDataTree2D<T>(List<List<T>> ret)
  {
    DataTree<T> tree = new DataTree<T>();
    for (int i = 0; i < ret.Count; i++)
    {
      GH_Path path = new GH_Path(i);
      for (int j = 0; j < ret[i].Count; j++)
      {

        tree.Add(ret[i][j], path);
      }
    }

    return tree;
  }
  public List<Point3d> PureDiscontinuity(Curve x)
  {
    var seg = x.DuplicateSegments();
    List<Point3d> pts = new List<Point3d>();
    for (int i = 0; i < seg.Length - 1; i++)
    {
      var nowC = seg[i];
      var nxtC = seg[i + 1];
      var nowV = nowC.PointAtEnd - nowC.PointAtStart;
      var nxtV = nxtC.PointAtEnd - nxtC.PointAtStart;
      nowV.Unitize();
      nxtV.Unitize();
      double dp = Math.Abs(Vector3d.Multiply(nowV, nxtV));
      if (i == 0)
      {
        var prevC = seg[seg.Length - 1];
        var prevV = prevC.PointAtEnd - prevC.PointAtStart;
        prevV.Unitize();
        if (Math.Abs(Vector3d.Multiply(prevV, nowV)) < 0.99) pts.Add(nowC.PointAtStart);
      }

      if (dp < 0.99)
      {
        pts.Add(nowC.PointAtEnd);
      }
    }

    if (!x.IsClosed) pts.Add(seg[seg.Length - 1].PointAtEnd);
    return pts;
  }
# ---------- end c_script ----------
pline_2 = PolyLine(Vertices=disc_2.Points, Closed=invert(False))
crv_3 = Curve(c_script.A)
neg = Negative(Value=Slider(4.1, range=0..100))
offset = OffsetCurve(Curve=crv_3, Distance=Slider(-3.8, range=-5..0), Corners=1)
offset_2 = OffsetCurve(Curve=pline_2, Distance=neg, Corners=1)
explode_2 = Explode(Curve=crv_3, Recursive=True)  # -> Segments, Vertices
explode_3 = Explode(Curve=offset, Recursive=True)  # -> Segments, Vertices
explode_4 = Explode(Curve=offset_2, Recursive=True)  # -> Segments, Vertices
boundary = BoundarySurfaces(Edges=pline_2)  # -> simplify(Surfaces)
explode_5 = Explode(Curve=pline_2, Recursive=True)  # -> Segments, Vertices
len = Length(Curve=explode_3.Segments)
len_2 = Length(Curve=explode_4.Segments)
sort = SortList(Keys=len, ValuesA=explode_2.Segments)  # -> Keys, ValuesA
panel = Panel("""0
1""")
sort_2 = SortList(Keys=len_2, ValuesA=explode_5.Segments)  # -> Keys, ValuesA
panel_2 = Panel("""0
1""")
cull_i = CullIndex(List=sort.ValuesA, Indices=panel, Wrap=True)
cull_i_2 = CullIndex(List=sort_2.ValuesA, Indices=panel_2, Wrap=True)
join = JoinCurves(Curves=cull_i_2, Preserve=False)
join_2 = JoinCurves(Curves=cull_i, Preserve=False)  # -> simplify(Curves)
item = ListItem(List=join, Index=0, Wrap=True)
c_script_2 = CSharpScript(x=join_2, y=Slider(0.66, range=0..1), z=Slider(3.41, range=0..100), u=Slider(5.48, range=0..100))  # -> out, A; inputs x: tree of Curve, y: Double, z: Double, u: Double
# ---------- c_script_2: C# usings ----------
using System.Runtime.InteropServices;
# ---------- c_script_2: C# ----------
    var li = ConvertTreeToNestedList(x);
    List<List<Curve>> ret = new List<List<Curve>>(); 
    for (int i = 0; i < li.Count; i++)
    {
      var now = li[i][0];
      var nxt = li[i][1];
      var nowP = Discontinuity(now);
      var nxtP = Discontinuity(nxt);
      nxtP.Reverse(); 
      List<Point3d> inlinePts = new List<Point3d>();
      for (int j = 0; j < nowP.Count; j++)
      {
        Curve tmp = new Line(nowP[j], nxtP[j]).ToNurbsCurve();
        Point3d k = tmp.PointAt(y * tmp.Domain.T1);
        inlinePts.Add(k); 
      }
      var mid = Curve.CreateControlPointCurve(inlinePts, 1);
      var centerPointMid = MovePt(CurveCenter(mid), Vector3d.ZAxis, z);
      mid = MoveOrientPoint(mid, CurveCenter(mid), centerPointMid);
      var dnNow = MoveOrientPoint(now, CurveCenter(now), MovePt(CurveCenter(now), Vector3d.ZAxis, -u));
      var dnNxt = MoveOrientPoint(nxt, CurveCenter(nxt), MovePt(CurveCenter(nxt), Vector3d.ZAxis, -u));
      List<Curve> threeCurve = new List<Curve> { dnNow, now, mid, nxt, dnNxt }; 
      ret.Add(threeCurve); 
    }
    A = MakeDataTree2D(ret);
# ---------- c_script_2: C# additional code ----------
  public T MoveOrientPoint<T>(T obj, Point3d now, Point3d nxt) where T : GeometryBase
  {
    T copy = (T) obj.Duplicate();
    Plane baseNow = Plane.WorldXY;
    Plane st = new Plane(now, baseNow.XAxis, baseNow.YAxis);
    Plane en = new Plane(nxt, baseNow.XAxis, baseNow.YAxis);
    Transform orient = Transform.PlaneToPlane(st, en);
    copy.Transform(orient);
    return copy;
  }
  public Point3d MovePt(Point3d p, Vector3d v, double amp)
  {
    v.Unitize();
    Transform move = Transform.Translation(v * amp);
    p.Transform(move);
    return p;
  }
  public Point3d CurveCenter(Curve c)
  {
    var arr = c.DivideByCount(2, true);
    var ans = c.PointAt(arr[1]);
    return ans;
  }

  public static DataTree<T> MakeDataTree2D<T>(List<List<T>> ret)
  {
    DataTree<T> tree = new DataTree<T>();
    for (int i = 0; i < ret.Count; i++)
    {
      GH_Path path = new GH_Path(i);
      for (int j = 0; j < ret[i].Count; j++)
      {

        tree.Add(ret[i][j], path);
      }
    }

    return tree;
  }
  public List<Point3d> Discontinuity(Curve x)
  {
    var seg = x.DuplicateSegments();
    List<Point3d> pts = new List<Point3d>();
    for (int i = 0; i < seg.Length; i++)
    {
      if (i == 0) pts.Add(seg[i].PointAtStart);
      pts.Add(seg[i].PointAtEnd);
    }

    if (x.IsClosed) pts.RemoveAt(pts.Count - 1);
    return pts;
  }
  public List<List<T>> ConvertTreeToNestedList<T>(DataTree<T> tree)
  {
    List<List<T>> nestedList = new List<List<T>>();
    foreach (GH_Path path in tree.Paths)
    {
      List<T> subList = new List<T>(tree.Branch(path));
      nestedList.Add(subList);
    }
    return nestedList;;
  }
# ---------- end c_script_2 ----------
Z = UnitZ(Factor=Slider(3, range=0..10))
flip = FlipCurve(Curve=join, Guide=item)  # -> simplify(Curve), Flag
disc_3 = Discontinuity(Curve=flip.Curve, Level=1)  # -> Points, Parameters
loft = Loft(Curves=c_script_2.A, Options={Adjust=True, Closed=True, LoftEnds=0, LoftSimp=0, LoftType=3, Rebuild=10, Refit=0.01})
crv_4 = Curve([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])
path_mapper = PathMapper(disc_3.Points, source="{A;B}(i)", target="{A;i}")
item_2 = ListItem(List=flip.Curve, Index=0, Wrap=True)  # -> Item, Item1
disc_4 = Discontinuity(Curve=crv_4, Level=1)  # -> Points, Parameters
cap = CapHoles(Brep=loft)
move = Move(Geometry=flip.Curve, Motion=Z)  # -> Geometry, Transform
extr = Extrude(Base=flip.Curve, Direction=Z)
explode_6 = Explode(Curve=item_2.Item, Recursive=True)  # -> graft(Segments), Vertices
explode_7 = Explode(Curve=item_2.Item1, Recursive=True)  # -> graft(Segments), Vertices
viewer = ParamViewer(disc_4.Points)
flip_2 = FlipMatrix(Data=disc_4.Points)
item_3 = ListItem(List=move.Geometry, Index=0, Wrap=True)  # -> Item, Item1
avr = Average(Input=path_mapper)
pline_3 = PolyLine(Vertices=path_mapper, Closed=False)
number_slider = Slider(3, range=0..10)
merge = Merge(Data1=explode_6.Segments, Data2=explode_7.Segments)
viewer_2 = ParamViewer(flip_2)
midpt = CurveMiddle(Curve=pline_3)
pshift = ShiftPaths(Data=avr, Offset=-1)
item_4 = ListItem(List=merge, Index=0, Wrap=True)  # -> Item, Item1
pshift_2 = ShiftPaths(Data=midpt, Offset=-1)
pline_4 = PolyLine(Vertices=pshift, Closed=False)
tweencrv = TweenCurve(CurveA=item_4.Item, CurveB=item_4.Item1, Factor=Slider(0.5, range=0..1), BlendType=0)
merge_2 = Merge(Data1=number_slider, Data2=Slider(6, range=0..10), Data3=number_slider)
weave = Weave(Pattern=[0, 1], Stream0=flip.Curve, Stream1=pline_4, NullGaps=False)
pline_5 = PolyLine(Vertices=pshift_2, Closed=False)
pshift_3 = ShiftPaths(Data=tweencrv, Offset=-1)
Z_2 = UnitZ(Factor=merge_2)
Z_3 = UnitZ(Factor=Slider(6, range=0..10))
move_2 = Move(Geometry=weave, Motion=Z_2)  # -> Geometry, Transform
join_3 = JoinCurves(Curves=pshift_3, Preserve=False)
loft_2 = Loft(Curves=move_2.Geometry, Options={Adjust=False, Closed=False, LoftEnds=0, LoftSimp=0, LoftType=3, Rebuild=10, Refit=0.01})
move_3 = Move(Geometry=join_3, Motion=Z_3)  # -> simplify(Geometry), Transform
edges = BrepEdges(Brep=loft_2)  # -> Naked, Interior, NonManifold
merge_3 = Merge(Data1=item_3.Item, Data2=move_3.Geometry, Data3=item_3.Item1)
join_4 = JoinCurves(Curves=edges.Naked, Preserve=False)
loft_opt = LoftOptions(Closed=False, Adjust=False, Rebuild=0, Refit=0, Type=Slider(3, range=0..10))
project = Project(Geometry=join_4, Plane=PlaneXY(0, 0, 0))  # -> Geometry, Transform
loft_3 = Loft(Curves=merge_3, Options=loft_opt)
merge_4 = Merge(Data1=simplify(join_4), Data2=simplify(project.Geometry))
join_5 = BrepJoin(Breps=[boundary, loft_3, extr])  # -> Breps, Closed
panel_3 = Panel(loft_3)
loft_4 = Loft(Curves=merge_4, Options={Adjust=False, Closed=False, LoftEnds=0, LoftSimp=0, LoftType=3, Rebuild=10, Refit=0.01})
cap_2 = CapHoles(Brep=join_5.Breps)
join_6 = BrepJoin(Breps=flatten([loft_2, loft_4]))  # -> Breps, Closed
cap_3 = CapHoles(Brep=join_6.Breps)
fmerge = MergeFaces(Brep=cap_3)  # -> Breps, Before, After
