# Grasshopper definition 18_Planar curve to surface.gh (Grasshopper 1.0.7)

# 3 Level - 10
crv = Curve([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])
pt = Point([Point(22, -18, 0), Point(20, -24, 0), Point(20, -38, 0), Point(27, -40, 0), Point(34, -39, 4.531401037), Point(46, -36, 0), Point(47, -32, 0), Point(45, -28, 0), Point(42, -17, 0), Point(35, -17, 0), Point(27, -15, 0), Point(18, -30, 0), Point(44, -21, 0), Point(42, -40, -11.83581077), Point(35, -42, 0)])
srf = Surface(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)

# ----
# checking curve
cp = ControlPoints(Curve=crv)  # -> Points, Weights, Knots
lng = ListLength(List=cp.Points)  # -> flatten(Length)

midpt = CurveMiddle(Curve=crv)
fcircle = CircleFit(Points=pt)  # -> Circle, Radius, Deviation
srfpt = SurfacePoints(Surface=srf)  # -> Points, Weights, Greville, UCount, VCount
crv_cp = CurveClosestPoint(Point=pt, Curve=fcircle.Circle)  # -> Point, Parameter, Distance
fcircle_2 = CircleFit(Points=midpt)  # -> Circle, Radius, Deviation
bnd = Bounds(Numbers=crv_cp.Distance)
crv_2 = Curve([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])
alongcrv = SortAlongCurve(Points=midpt, Curve=fcircle_2.Circle)  # -> Points, Indices
panel = Panel(bnd)
item = ListItem(List=crv, Index=alongcrv.Indices, Wrap=True)
c_script = CSharpScript(crv=crv_2, degree=Slider(3, range=0..10), ptCnt=Slider(8, range=0..10))  # -> out, A, B; inputs crv: list of Curve, degree: Int32, ptCnt: Int32
# ---------- c_script: C# ----------
    
      List<Curve> newCrv = new List<Curve>();
      Point3d pts = new Point3d();
      for (int i = 0; i < crv.Count; i++)
      {
        Curve now = crv[i];
        var reCrv = now.Rebuild(ptCnt, degree, true);
        newCrv.Add(reCrv);
        pts += CurveCenter(reCrv);
      }

      pts /= crv.Count;

      newCrv.Sort((x, y) =>
        {
        Point3d pointA = CurveCenter(x);
        Point3d pointB = CurveCenter(y);
        Point3d referencePoint = pts;
        Vector3d vecA = pointA - referencePoint;
        Vector3d vecB = pointB - referencePoint;
        var crossProduct = Vector3d.CrossProduct(vecA, vecB).Z;
        if (crossProduct > 0)
          return -1;
        else if (crossProduct < 0)
          return 1;
        else
        {
          double distA = vecA.Length;
          double distB = vecB.Length;
          return distA.CompareTo(distB);
        }
        });

      A = newCrv;
      B = pts;
# ---------- c_script: C# additional code ----------
    public Point3d CurveCenter(Curve c)
    {
      var arr = c.DivideByCount(2, true);
      var ans = c.PointAt(arr[1]);
      return ans;
    }

    public List<Point3d> SortPointsCcw(List < Point3d > points, Point3d referencePoint)
    {
      points.Sort((pointA, pointB) =>
        {
        Vector3d vecA = pointA - referencePoint;
        Vector3d vecB = pointB - referencePoint;
        var crossProduct = Vector3d.CrossProduct(vecA, vecB).Z;
        if (crossProduct > 0)
          return -1;
        else if (crossProduct < 0)
          return 1;
        else
        {
          double distA = vecA.Length;
          double distB = vecB.Length;
          return distA.CompareTo(distB);
        }
        });
      return points;
    }
# ---------- end c_script ----------

# ----
# method 2
number_slider = Slider(10, range=0..10)
reb = RebuildCurve(Curve=item, Degree="3", Count=number_slider, Tangents=False)
item_2 = ListItem(List=reb, Index=0, Wrap=True)
divide = DivideCurve(Curve=item_2, Count="1", Kinks=False)  # -> Points, Tangents, Parameters
pline = PolyLine(Vertices=divide.Points, Closed=False)
flip = FlipCurve(Curve=reb, Guide=pline)  # -> Curve, Flag
loft = Loft(Curves=flip.Curve, Options={Adjust=False, Closed=True, LoftEnds=0, LoftSimp=0, LoftType=0, Rebuild=10, Refit=0.01})

# ----
# method 1
panel_2 = Panel("3")
fit = FitCurve(Curve=item, Degree=panel_2, Tolerance="0.01")
item_3 = ListItem(List=fit, Index=0, Wrap=True)
divide_2 = DivideCurve(Curve=item_3, Count="1", Kinks=False)  # -> Points, Tangents, Parameters
pline_2 = PolyLine(Vertices=divide_2.Points, Closed=False)
flip_2 = FlipCurve(Curve=fit, Guide=pline_2)  # -> Curve, Flag
loft_2 = Loft(Curves=flip_2.Curve, Options={Adjust=False, Closed=True, LoftEnds=0, LoftSimp=0, LoftType=0, Rebuild=10, Refit=0.01})

crv_3 = Curve(c_script.A)
pt_2 = Point(c_script.B)
loft_3 = Loft(Curves=crv_3, Options={Adjust=True, Closed=True, LoftEnds=0, LoftSimp=0, LoftType=0, Rebuild=10, Refit=0.01})
loft_opt = LoftOptions(Closed=False, Adjust=Toggle(True), Rebuild=Slider(10, range=0..10), Refit="0.01", Type=0)
