# Grasshopper definition 19_Draw a perpendicular line from the longest side of a polygon.gh (Grasshopper 1.0.7)
# plug-ins: ScriptParasite

crv = Curve(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)
crv_2 = Curve(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)
crv_3 = Curve(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)
crv_4 = Curve(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)
explode = Explode(Curve=crv_3, Recursive=True)  # -> Segments, Vertices
explode_2 = Explode(Curve=crv_4, Recursive=True)  # -> Segments, Vertices
planar = IsPlanar(Surface=crv_2, Interior=True)  # -> Planar, Plane
explode_3 = Explode(Curve=crv_2, Recursive=True)  # -> Segments, Vertices
toggle = BooleanToggle(True)
planar_2 = IsPlanar(Surface=crv, Interior=True)  # -> Planar, Plane
len = Length(Curve=explode.Segments)
len_2 = Length(Curve=explode_2.Segments)
bbox = BoundingBox(Content=crv_2, Plane=planar.Plane, UnionBox=True)  # -> Box, Box_2
len_3 = Length(Curve=explode_3.Segments)
panel = Panel("왜 안될까..?")
bbox_2 = BoundingBox(Content=crv, Plane=planar_2.Plane, UnionBox=True)  # -> Box, Box_2
sort = SortList(Keys=len, ValuesA=explode.Segments)  # -> Keys, reverse(ValuesA)
sort_2 = SortList(Keys=len_2, ValuesA=explode_2.Segments)  # -> Keys, reverse(ValuesA)
rider = RIder(openFile=toggle)  # -> Folder; inputs openFile: Boolean
# ---------- rider: C# usings ----------
using System.IO;
using System.Diagnostics;

public class ScriptUtilities
{
  public static string GetCurrentFolder(GH_Document doc)
  {
    string filePath = doc.FilePath;
    return Path.GetDirectoryName(filePath);
  }

  public static string[] GetCsFiles(string folderPath)
  {
    return Directory.GetFiles(folderPath, "*.cs");
  }

  public static void OpenFileWithRider(string filePath, Action<string> print)
  {
    try
    {
      // Define the path to the JetBrains Rider executable
      string riderPath = @"C:\Program Files\JetBrains\JetBrains Rider 2024.1.4\bin\rider64.exe";

      if (!File.Exists(riderPath))
      {
        print("Rider executable not found at: " + riderPath);
        return;
      }

      // Start the process to open the file with Rider
      ProcessStartInfo startInfo = new ProcessStartInfo
        {
          FileName = riderPath,
          Arguments = "\"" + filePath + "\"", // Enclose in quotes in case of spaces
          UseShellExecute = true
          };
      Process.Start(startInfo);
    }
    catch (Exception ex)
    {
      print("Error opening file with Rider: " + ex.Message);
    }
  }

  public static void RunScript(bool openFile, ref object Here, IGH_Component owner, Action<string> print)
  {
    // Get the current folder path
    GH_Document doc = owner.OnPingDocument();
    string currentFolder = GetCurrentFolder(doc);
    Here = currentFolder;

    // Get .cs files in the current folder
    string[] csFiles = GetCsFiles(currentFolder);
    if (csFiles.Length > 0)
    {
      string csFilePath = csFiles[0];

      if (openFile)
      {
        OpenFileWithRider(csFilePath, print);
      }
    }
    else
    {
      print("No .cs files found in the directory.");
    }
  }
}
# ---------- rider: C# ----------
   ScriptUtilities.RunScript(openFile, ref Folder, Component, Print);
# ---------- end rider ----------
debrep = DeconstructBrep(Brep=bbox.Box)  # -> Faces, Edges, Vertices
crv_5 = Curve(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)
sort_3 = SortList(Keys=len_3, ValuesA=explode_3.Segments)  # -> Keys, reverse(ValuesA)
debrep_2 = DeconstructBrep(Brep=bbox_2.Box)  # -> Faces, Edges, Vertices
clean = CleanTree(RemoveNulls=True, RemoveInvalid=True, RemoveEmpty=False, Tree=debrep.Faces)
item = ListItem(List=sort.ValuesA, Index=0, Wrap=True)
item_2 = ListItem(List=sort_2.ValuesA, Index=0, Wrap=True)
item_3 = ListItem(List=sort_3.ValuesA, Index=0, Wrap=True)

c_script = CSharpScript(crv=crv_5, cnt=Slider(100, range=0..100), id=Slider(8, range=0..100))  # -> out, A, B, C; inputs crv: Curve, cnt: Int32, id: Int32
# ---------- c_script: C# usings ----------
using System.Linq;
using Rhino.Geometry.Intersect;
# ---------- c_script: C# ----------
    List<Curve> seg = crv.DuplicateSegments().ToList(); 
    seg.Sort((a, b) => b.GetLength().CompareTo(a.GetLength()));
    Curve longSeg = seg[id & seg.Count];
    List<Point3d> divSeg = DividePts(longSeg, cnt, true);
    Surface ps = PlanarSrf(crv);
    List<Curve> ret = new List<Curve>(); 
    
    for (int i = 0; i < divSeg.Count; i++)
    {
      Point3d now = divSeg[i];
      double u, v;
      ps.ClosestPoint(now, out u, out v);
      var tmp = ps.IsoCurve(1, u);
      ret.Add(tmp); 
      
    }

    A = longSeg; 
    B = ret;
# ---------- c_script: C# additional code ----------
  public Surface PlanarSrf(Curve c)
  {
    string log;
    Surface ret = null;
    if (c.IsValidWithLog(out log) && c.IsPlanar() && c.IsClosed)
    {
      var tmp = Brep.CreatePlanarBreps(c, 0.01);
      ret = tmp[0].Faces[0];
      return ret;
    }

    return ret;
  }

  public static List<Point3d> DividePts(Curve crv, int cnt, bool end)
  {
    List<Point3d> ret = new List<Point3d>();
    var crvT = crv.DivideByCount(cnt, end);
    for (int i = 0; i < crvT.Length; i++)
    {
      var pt = crv.PointAt(crvT[i]);
      ret.Add(pt);
    }

    return ret;
  }
# ---------- end c_script ----------
scriptpar = ScriptParasite(Enable=toggle, Folder=rider)

explode_4 = Explode(Curve=debrep_2.Edges, Recursive=True)  # -> flatten(Segments), Vertices
boundary = BoundarySurfaces(Edges=crv_3)
boundary_2 = BoundarySurfaces(Edges=crv_4)
item_4 = ListItem(List=clean, Index=0, Wrap=True)
pframes = PerpFrames(Curve=item, Count=Slider(20, range=0..100), Align=True)  # -> Frames, Parameters
pframes_2 = PerpFrames(Curve=item_2, Count=Slider(20, range=0..100), Align=True)  # -> Frames, Parameters
crv_cp = CurveClosestPoint(Point=explode.Vertices, Curve=item)  # -> Point, Parameter, Distance
divide = DivideCurve(Curve=item_3, Count=Slider(30, range=0..30), Kinks=False)  # -> Points, Tangents, Parameters
crv_6 = Curve(c_script.B)
len_4 = Length(Curve=explode_4.Segments)
planar_3 = IsPlanar(Surface=crv_5, Interior=True)  # -> Planar, Plane
sec = BrepPlane(Brep=boundary, Plane=pframes.Frames)  # -> Curves, Points

# ----
# divide surface
srf_cp = SurfaceClosestPoint(Point=divide.Points, Surface=item_4)  # -> Point, UVPoint, Distance
iso = IsoCurve(Surface=item_4, UVPoint=srf_cp.UVPoint)  # -> flatten(UIsocurve), VIsocurve

sec_2 = BrepPlane(Brep=boundary_2, Plane=pframes_2.Frames)  # -> Curves, Points
sort_4 = SortList(Keys=len_4, ValuesA=explode_4.Segments)  # -> Keys, reverse(ValuesA)
panel_2 = Panel("""0
1""")
sort_5 = SortList(Keys=crv_cp.Distance)  # -> reverse(Keys), ValuesA
pln = Plane(pframes.Frames)
ccx = CurveCurve()  # -> Points, ParamsA, ParamsB
trim = TrimWithRegion(Curve=crv_6, Region=crv_5, Plane=planar_3.Plane)  # -> flatten(Inside), Outside
deplane = DeconstructPlane(Plane=pln)  # -> Origin, XAxis, YAxis, ZAxis
bcx = BrepCurve()  # -> Curves, Points
item_5 = ListItem(List=sort_5.Keys, Index=0, Wrap=True)
item_6 = ListItem(List=sort_4.ValuesA, Index=panel_2, Wrap=True)
crv_7 = Curve(trim.Inside)
llx = LineLine()  # -> ParamA, ParamB, PointA, PointB
line = LineSDL(Start=pframes.Frames, Direction=deplane.XAxis, Length=item_5)
item_7 = ListItem(List=item_6, Index=0, Wrap=True)
project = Project(Curve=line, Brep=crv_3, Direction=Vector(0, 0, 1))
flip = FlipCurve(Curve=item_6, Guide=item_7)  # -> Curve, Flag

# ----
# ci = curve in
# co = curve out
trim_2 = TrimWithRegion(Curve=iso.UIsocurve, Region=crv_2, Plane=planar.Plane)  # -> flatten(Inside), Outside
crv_8 = Curve(trim_2.Inside)

divide_2 = DivideCurve(Curve=flip.Curve, Count=Slider(33, range=0..100), Kinks=False)  # -> Points, Tangents, Parameters
flip_2 = FlipMatrix(Data=divide_2.Points)
item_8 = ListItem(List=flip_2, Index=0, Wrap=True)  # -> Item, Item1
ln = Line(StartPoint=item_8.Item, EndPoint=item_8.Item1)
project_2 = Project(Curve=ln, Brep=crv, Direction=Vector(0, 0, 1))
