# Grasshopper definition 20_Classify the given square cells into 2 branches.gh (Grasshopper 1.0.7)
# plug-ins: LunchBox

# 3 Level - 12
number_slider = Slider(20, range=0..20)
number_slider_2 = Slider(16, range=0..20)
number_slider_3 = Slider(9, range=0..20)
number_slider_4 = Slider(16, range=0..20)
srf = Surface(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)
srf_2 = Surface(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)
srf_3 = Surface(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)
srf_4 = Surface(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)
panel = Panel("""A
B
C
D
E
F
G
H
I
J
H
K
L""")
quads = QuadPanels(Surface=srf, UDivisions=number_slider, VDivisions=number_slider)
quads_2 = QuadPanels(Surface=srf_2, UDivisions=number_slider_2, VDivisions=number_slider_2)
quads_3 = QuadPanels(Surface=srf_3, UDivisions=number_slider_3, VDivisions=number_slider_3)
quads_4 = QuadPanels(Surface=srf_4, UDivisions=number_slider_4, VDivisions=number_slider_4)
series = Series(Start=0, Step=1, Count=number_slider_3)  # -> graft(Series)
python = GhPythonScript(Panels=quads, U=number_slider, V=number_slider)  # -> out, DT; inputs Panels: list of Surface, U: Int32, V: Int32
# ---------- python: Python ----------
__author__ = "BaekInchan"
__version__ = "2024.02.11"

import rhinoscriptsyntax as rs
import ghpythonlib.treehelpers as th

T = [[], []]

for i in range(U) : 
    for j in range(V) : 
        if(i <= j) :
            T[0].append(Panels[i * V + j])
        else : 
            T[1].append(Panels[i * V + j])

DT = th.list_to_tree(T, none_and_holes = True)
# ---------- end python ----------
split = SplitList(List=panel, Index=Slider(3, range=0..10))  # -> ListA, ListB
series_2 = Series(Start=0, Step=1, Count=number_slider_4)  # -> graft(Series)
series_3 = Series(Start=0, Step=1, Count=number_slider_2)
partition = PartitionList(List=quads_3, Size=number_slider_3)
partition_2 = PartitionList(List=quads_4, Size=number_slider_4)
lng = ListLength(List=partition)
partition_3 = PartitionList(List=quads_2, Size=number_slider_2)
panel_2 = Panel(split.ListA)
panel_3 = Panel(split.ListB)
smaller = SmallerThan(FirstNumber=series_3, SecondNumber=graft(series_3))  # -> SmallerThan, OrEqualTo
shift = ShiftList(List=partition, Shift=series, Wrap=invert(True))
series_4 = Series(Start=0, Step=1, Count=number_slider_3)  # -> graft(Series)
split_2 = SplitList(List=partition_2, Index=series_2)  # -> ListA, ListB
tstat = TreeStatistics(Tree=python.DT)  # -> Paths, Length, Count
series_5 = Series(Start=0, Step=1, Count=lng)
dispatch = Dispatch(List=tstat.Paths, DispatchPattern=[True, False])  # -> ListA, ListB
dispatch_2 = Dispatch(List=partition_3, DispatchPattern=smaller.SmallerThan)  # -> ListA, ListB
index = ItemIndex(List=partition, Item=shift)
shift_2 = ShiftList(List=series_5, Shift=series_4, Wrap=invert(True))
branch = TreeBranch(Tree=python.DT, Path=dispatch.ListA, MaintainPaths=True)
branch_2 = TreeBranch(Tree=python.DT, Path=dispatch.ListB, MaintainPaths=True)
cull_i = CullIndex(List=partition, Indices=index, Wrap=True)
preview = CustomPreview(Geometry=split_2.ListA, Material=ColourSwatch(SwatchColor=RGB(60, 189, 163)))
preview_2 = CustomPreview(Geometry=split_2.ListB, Material=ColourSwatch(SwatchColor=RGB(177, 57, 163)))
difference = SetDifference(SetA=series_5, SetB=shift_2)
preview_3 = CustomPreview(Geometry=branch, Material=ColourSwatch(SwatchColor=RGB(60, 189, 163)))
preview_4 = CustomPreview(Geometry=branch_2, Material=ColourSwatch(SwatchColor=RGB(177, 57, 163)))
item = ListItem(List=partition, Index=difference, Wrap=True)
preview_5 = CustomPreview(Geometry=dispatch_2.ListA, Material=ColourSwatch(SwatchColor=RGB(60, 189, 163)))
preview_6 = CustomPreview(Geometry=dispatch_2.ListB, Material=ColourSwatch(SwatchColor=RGB(177, 57, 163)))
number_slider_5 = Slider(25, range=0..100)
srf_5 = Surface(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)
c_script = CSharpScript(x=srf_5, y=Slider(55, range=0..100))  # -> out, A, B, C; inputs x: Surface, y: Int32
# ---------- c_script: C# usings ----------
using System.Linq;
# ---------- c_script: C# ----------
    var dsd = DivideSurfaceDomain(x, y, y);
    List<Surface> ret1 = new List<Surface>(); 
    List<Surface> ret2 = new List<Surface>();
    for (int i = 0; i < dsd.Count; i++)
    {
      List<Surface> temp = new List<Surface>();
      for (int j = 0; j < dsd[i].Count; j++)
      {
        if (j < i) ret1.Add(dsd[i][j]); 
        else ret2.Add(dsd[i][j]);
      }
    }

    A = ret1;
    B = ret2;
    C = dsd;
# ---------- c_script: C# additional code ----------
  
  public List<List<Surface>> DivideSurfaceDomain(Surface srf, int uCount, int vCount)
  {
    List<List<Surface>> dividedSurfaces = new List<List<Surface>>();
    // Calculate U intervals
    List<Interval> uIntervals = CreateIntervals(srf.Domain(0), uCount);
    // Calculate V intervals
    List<Interval> vIntervals = CreateIntervals(srf.Domain(1), vCount);
    // Create subsurfaces
    foreach (var uInterval in uIntervals)
    {
      List<Surface> subSurfaces = new List<Surface>();
      foreach (var vInterval in vIntervals)
      {
        Surface subSurface = srf.Trim(uInterval, vInterval);
        if (subSurface != null)
        {
          subSurfaces.Add(subSurface);
        }
      }
      dividedSurfaces.Add(subSurfaces);
    }

    return dividedSurfaces;
  }

  private List<Interval> CreateIntervals(Interval domain, int count)
  {
    List<Interval> intervals = new List<Interval>();
    double start = domain.T0;
    double step = (domain.T1 - domain.T0) / count;

    for (int i = 0; i < count; i++)
    {
      double end = start + step;
      intervals.Add(new Interval(start, end));
      start = end;
    }

    return intervals;
  }
# ---------- end c_script ----------
srf_6 = Surface(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)
srf_7 = Surface(c_script.A)
srf_8 = Surface(c_script.B)
divide = DivideDomain²(Domain=srf_6, UCount=number_slider_5, VCount=number_slider_5)
subsrf = Isotrim(Surface=srf_6, Domain=divide)
