# Grasshopper definition 41_make mullion facade.gh (Grasshopper 1.0.7)
# plug-ins: ScriptParasite

crv = Curve([<curve referenced from the Rhino model> x3])
xy = XYPlane(Origin=Point(0, 0, 0))
toggle = BooleanToggle(True)
offset = OffsetCurve(Curve=crv, Distance=Slider(18, range=0..100), Plane=xy, Corners=1)
rider = RIder(openFile=toggle)  # -> Folder; inputs openFile: Boolean
# ---------- rider: C# usings ----------
using System.IO;
using System.Diagnostics;

public class ScriptUtilities
{
  public static string GetCurrentFolder(GH_Document doc)
  {
    string filePath = doc.FilePath;
    return Path.GetDirectoryName(filePath);
  }

  public static string[] GetCsFiles(string folderPath)
  {
    return Directory.GetFiles(folderPath, "*.cs");
  }

  public static void OpenFileWithRider(string filePath, Action<string> print)
  {
    try
    {
      // Define the path to the JetBrains Rider executable
      string riderPath = @"C:\Program Files\JetBrains\JetBrains Rider 2024.1.4\bin\rider64.exe";

      if (!File.Exists(riderPath))
      {
        print("Rider executable not found at: " + riderPath);
        return;
      }

      // Start the process to open the file with Rider
      ProcessStartInfo startInfo = new ProcessStartInfo
        {
          FileName = riderPath,
          Arguments = "\"" + filePath + "\"", // Enclose in quotes in case of spaces
          UseShellExecute = true
          };
      Process.Start(startInfo);
    }
    catch (Exception ex)
    {
      print("Error opening file with Rider: " + ex.Message);
    }
  }

  public static void RunScript(bool openFile, ref object Here, IGH_Component owner, Action<string> print)
  {
    // Get the current folder path
    GH_Document doc = owner.OnPingDocument();
    string currentFolder = GetCurrentFolder(doc);
    Here = currentFolder;

    // Get .cs files in the current folder
    string[] csFiles = GetCsFiles(currentFolder);
    if (csFiles.Length > 0)
    {
      string csFilePath = csFiles[0];

      if (openFile)
      {
        OpenFileWithRider(csFilePath, print);
      }
    }
    else
    {
      print("No .cs files found in the directory.");
    }
  }
}
# ---------- rider: C# ----------
   ScriptUtilities.RunScript(openFile, ref Folder, Component, Print);
# ---------- end rider ----------
crv_2 = Curve([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])

scriptpar = ScriptParasite(Enable=toggle, Folder=rider)
c_script = CSharpScript(x=crv_2)  # -> out, A; inputs x: list of Curve
# ---------- c_script: C# ----------
    List<Vector3d> yDir = new List<Vector3d>();
    for (int i = 0; i < x.Count; i++)
    {
      var crv = x[i]; 
      var offsetCrv = crv.Offset(Plane.WorldXY, 10)
    }
# ---------- end c_script ----------
