# Grasshopper definition 5 Level-01.gh (Grasshopper 1.0.7)

# 5 Level - 01
number_slider = Slider(1.6, range=0..10)
crv = Curve([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])
c_script = CSharpScript(crv=crv, dist=number_slider)  # -> out, A, B; inputs crv: list of Curve, dist: Double
# ---------- c_script: C# usings ----------
using System.Linq;
# ---------- c_script: C# ----------
    List<List<Curve>> outLinesList = new List<List<Curve>>();
    List<Curve> cir = new List<Curve>();
    var joinCrv = Curve.JoinCurves(crv); 
    foreach (var c in joinCrv)
    {
      List<Curve> tmp = new List<Curve>(); 
      var offset1 = OffsetCurve(c, Plane.WorldXY, dist);
      var offset2 = OffsetCurve(c, Plane.WorldXY, -dist);
      tmp.Add(offset1);
      tmp.Add(offset2); 
      var enPt = c.PointAtEnd; 
      var stPt = c.PointAtStart;
      var enCrv = PointsInCurves(crv, enPt);
      var stCrv = PointsInCurves(crv, stPt);
      if (enCrv.Count == 1)
      {
        Curve inCir = new Circle(enPt, dist / 2).ToNurbsCurve();
        Curve arc = new Arc(offset1.PointAtEnd, offset1.TangentAtEnd, offset2.PointAtEnd).ToNurbsCurve();
        cir.Add(inCir); 
        tmp.Add(arc); 
      }
      else
      {
        tmp.Add(new Line(offset1.PointAtEnd, offset2.PointAtEnd).ToNurbsCurve()); 
      }
      if (stCrv.Count == 1)
      {
        Curve arc = new Arc(offset1.PointAtStart, -offset1.TangentAtStart, offset2.PointAtStart).ToNurbsCurve();
        Curve inCir = new Circle(stPt, dist / 2).ToNurbsCurve();
        cir.Add(inCir);
        tmp.Add(arc); 
      }
      else
      {
        tmp.Add(new Line(offset1.PointAtStart, offset2.PointAtStart).ToNurbsCurve());
      }

      var joinTmp = Curve.JoinCurves(tmp).ToList();
      outLinesList.Add(joinTmp); 
    }

    A = MakeDataTree2D(outLinesList);
    B = cir;
# ---------- c_script: C# additional code ----------
  public List<Curve> PointsInCurves(List<Curve> crves, Point3d pt)
  {
    List<Curve> ans = new List<Curve>();
    for (int i = 0; i < crves.Count; i++)
    {
      double t;
      if (crves[i].ClosestPoint(pt, out t, 0.001))
      {
        ans.Add(crves[i]);
      }
    }

    return ans;
  }
  
  public static DataTree<T> MakeDataTree2D<T>(List<List<T>> ret)
  {
    DataTree<T> tree = new DataTree<T>();
    for (int i = 0; i < ret.Count; i++)
    {
      GH_Path path = new GH_Path(i);
      for (int j = 0; j < ret[i].Count; j++)
      {

        tree.Add(ret[i][j], path);
      }
    }

    return tree;
  }
  public Curve OffsetCurve(Curve c, Plane p, double interval)
  {
    var seg = c.DuplicateSegments();
    var joinseg = Curve.JoinCurves(seg);
    List<Curve> outLines = new List<Curve>();
    for (int i = 0; i < joinseg.Length; i++)
    {
      outLines.AddRange(c.Offset(p, interval, 0, CurveOffsetCornerStyle.Sharp));
    }

    var ret = Curve.JoinCurves(outLines);
    return ret[0];
  }
# ---------- end c_script ----------
runion = RegionUnion(Curves=flatten(c_script.A))
merge = Merge(Data1=runion, Data2=c_script.B)
boundary = BoundarySurfaces(Edges=merge)
